# Grasshopper definition PatternGenerator.gh (Grasshopper 1.0.7)

# ----
# cylinder
# cylinder
transformation = Slider(1, range=0..1)

D = Slider(23, range=10..30)
height = Slider(4.673, range=0..10)
force = Slider(5.619, range=0..10)

updownpercent = Slider(1, range=0..1)
# res
presspercent = Slider(0, range=0..1)

D_2 = Slider(17, range=0..20)
force_2 = Slider(24.271, range=0..100)
N = Slider(7, range=4..10)

# ----
# waterbomb
# waterbomb
transformation_2 = Slider(0, range=0..1)

D_3 = Slider(13, range=0..50)
force_3 = Slider(46.714, range=0..100)

D_4 = Slider(17, range=0..20)
force_4 = Slider(8.24, range=0..100)

# ----
# waterbomb + RES
# waterbomb + RES
transformation_3 = Slider(0, range=0..1)

outer_circle_offset = Slider(3, range=0..10)
b = Slider(10, range=0..10)
cluster = Cluster_2(outer_circle_offset=outer_circle_offset, b=b, diameter=D_2, force_max=force_2, N=N, foldper=transformation_2)  # -> _2d_pattern, s_0
preview = CustomPreview(Geometry=cluster.s_0, Material=ColourSwatch(SwatchColor=RGB(57, 118, 230)))

material_stifiness = Slider(0.001, range=0.001..0.03)
cluster_2 = Cluster(material_stiffiness=material_stifiness, diameter=D_3, F=force_3, fold_percent=transformation)  # -> _2d_pattern, top_surface, buttom_surface, side_surface, kppi
preview_2 = CustomPreview(Geometry=cluster_2._2d_pattern, Material=ColourSwatch(SwatchColor=RGB(148, 32, 230)))
preview_3 = CustomPreview(Geometry=[cluster_2.buttom_surface, cluster_2.top_surface], Material=ColourSwatch(SwatchColor=RGB(142, 171, 230)))
preview_4 = CustomPreview(Geometry=cluster_2.side_surface, Material=ColourSwatch(SwatchColor=RGB(57, 118, 230)))

# ----
# res
outer_circle_offset_2 = Slider(4, range=0..10)
cluster_3 = Cluster_3(D_3=outer_circle_offset_2, D=D, H=height, force=force, updownpercent=updownpercent, relay=presspercent)  # -> _2d_pattern, grp_2
preview_5 = CustomPreview(Geometry=cluster_3._2d_pattern, Material=ColourSwatch(SwatchColor=RGB(148, 32, 230)))
preview_6 = CustomPreview(Geometry=cluster_3.grp_2, Material=ColourSwatch(SwatchColor=RGB(57, 118, 230)))

res_outer_circle_offset = Slider(4, range=0..10)
res_beta = Slider(127, range=110..160)
res_number_of_arms = Slider(6, range=3..9)

wb_outer_circle_offset = Slider(3, range=0..10)
number_slider = Slider(10, range=0..10)

cluster_4 = Cluster_4(
    res_radius_offset=res_outer_circle_offset,
    res_beta=res_beta,
    res_arms=res_number_of_arms,
    wb_b=number_slider,
    wb_outer_circle_offset=wb_outer_circle_offset,
    wb_diameter=D_4,
    force=force_4,
    fold_percent=transformation_3)  # -> _2d_water_bomb, _2d_res, _3d_water_bomb, _3d_res
preview_7 = CustomPreview(Geometry=cluster_4._2d_water_bomb, Material=ColourSwatch(SwatchColor=RGB(148, 32, 230)))
preview_8 = CustomPreview(Geometry=cluster_4._2d_res, Material=ColourSwatch(SwatchColor=RGB(148, 32, 230)))
preview_9 = CustomPreview(Geometry=cluster_4._3d_water_bomb, Material=ColourSwatch(SwatchColor=RGB(57, 118, 230)))
preview_10 = CustomPreview(Geometry=cluster_4._3d_res, Material=ColourSwatch(SwatchColor=RGB(230, 230, 129)))

preview_11 = CustomPreview(Geometry=cluster._2d_pattern, Material=ColourSwatch(SwatchColor=RGB(148, 32, 230)))

# ==== cluster Cluster
transformation = Slider(1, range=0..1)
material_stiffiness = ClusterInput()
diameter = ClusterInput()
F = ClusterInput()
fold_percent = ClusterInput()
material_stiffiness_2 = Number(material_stiffiness)
N = Number(6)
diameter_2 = Number(diameter)

series = Series(Start=30, Step=0.5, Count=41)
c_script = CSharpScript(F=F, D=diameter_2, material=material_stiffiness_2, Alpha=series)  # -> out, alpha, delta; inputs F: Double, D: Double, material: Double, Alpha: list of Double
# ---------- c_script: C# ----------
double press_force = -F;
double properA= 0;
double F_delta = F;

for(int i=0; i< Alpha.Count; i++){
    double a = Alpha[i];
    double force =material*D*D* (
            -0.1517*Math.Pow((a-30),3) +
            0.1410*Math.Pow((a-30),2) +
            0.4294*(a-30)*Math.Pow(10, -5));
    double d = Math.Abs(force-press_force);
    if(F_delta > d){
        F_delta = d;
        properA = a;
    }

}

alpha = properA;
delta = F_delta;
/*
double kppi = F/(D*D*(
    -0.1517*Math.Pow((Alpha-30),3) +
    0.1410*Math.Pow((Alpha-30),2) +
    0.4294*(Alpha-30)*Math.Pow(10, -5)));
Kppi = kppi; */

//F(n=6) =material*diameter^2 * ( −0.1517(α − 30◦)^3 + 0.1410(α − 30◦)^2 + 0.4294(α − 30◦) × 10^−5 )
# ---------- end c_script ----------

# ----
# n=6: |edge of polygon| =R
division = Division(A=diameter_2, B=2)

polygon = Polygon(Plane=PlaneXY(0, 0, 0), Radius=division, Segments=6, FilletRadius=0)  # -> Polygon, Length

# ----
# calculate H
c_script_2 = CSharpScript(alpha=c_script.alpha, Lc=division)  # -> out, Hc; inputs alpha: Double, Lc: Double
# ---------- c_script_2: C# ----------
double H_cunit = Lc* Math.Sqrt( 2*Math.Sqrt(3)* Math.Sin((2*alpha- 60)/180*Math.PI));
Hc = H_cunit;
# ---------- end c_script_2 ----------

# ----
# calculate current height
multiplication = Multiplication(A=c_script_2.Hc, B=fold_percent)

rad = Radians(Degrees=c_script.alpha)
pt = ConstructPoint(XCoordinate=division, YCoordinate=0, ZCoordinate=0)

# ----
# length a&b
c_script_3 = CSharpScript(R=division, n=N, alpha=rad)  # -> out, A, B; inputs R: Double, n: Int32, alpha: Double
# ---------- c_script_3: C# ----------
//according to paper : a crawling robot driven by multi stable origami

double theta = Math.PI * (n-2)/(2*n);
double lambda = alpha/theta;
double a = 2*R*(Math.PI/n);

double l = 2*R*Math.Cos(theta*(1-lambda));

double b = Math.Sqrt(l*l + a*a - 2*a*l*Math.Cos(alpha));

B =l;
A = b; 

// default: n equals to 6
//A= R/Math.Sin(Math.PI/6) * Math.Sin(alpha);
# ---------- end c_script_3 ----------

xy = XYPlane(Origin=Point(0, 0, 0))
arrpolar = PolarArray(Geometry=pt, Plane=PlaneXY(0, 0, 0), Count=N, Angle=6.283185307)  # -> Geometry, Transform
pl_offset = PlaneOffset(BasePlane=xy, Offset=multiplication)
item = ListItem(List=arrpolar.Geometry, Index=1, Wrap=True)
arc = Arc(Plane=pl_offset, Radius=division, Angle=Domain(0, 3.141592654))  # -> Arc, Length
sph = Sphere(Base=pt, Radius=c_script_3.A)
scx = SurfaceCurve(Surface=sph, Curve=arc.Arc)  # -> Curves, Points, UVPoints, Normals, Parameters, Tangents
arrpolar_2 = PolarArray(Geometry=scx.Points, Plane=PlaneXY(0, 0, 0), Count=N, Angle=6.283185307)  # -> Geometry, Transform
kppi = ClusterOutput()
item_2 = ListItem(List=arrpolar_2.Geometry, Index=1, Wrap=True)

ln = Line(StartPoint=item, EndPoint=item_2)
ln_2 = Line(StartPoint=item, EndPoint=pt)

ln_3 = Line(StartPoint=pt, EndPoint=item_2)
ln_4 = Line(StartPoint=scx.Points, EndPoint=item_2)
ln_5 = Line(StartPoint=pt, EndPoint=scx.Points)

# ----
# Top surface
pline = PolyLine(Vertices=arrpolar_2.Geometry, Closed=True)
boundary = BoundarySurfaces(Edges=pline)

# ----
# Buttom surface
boundary_2 = BoundarySurfaces(Edges=polygon.Polygon)

# ----
# one-side surface
boundary_3 = BoundarySurfaces(Edges=flatten([ln, ln_2, ln_3]))
boundary_4 = BoundarySurfaces(Edges=flatten([ln_4, ln_3, ln_5]))

buttom_surface = ClusterOutput(boundary_2)
_2d_pattern = ClusterOutput(ln_2)
top_surface = ClusterOutput(boundary)
arrpolar_3 = PolarArray(Geometry=[boundary_3, boundary_4], Plane=PlaneXY(0, 0, 0), Count=N, Angle=6.283185307)  # -> Geometry, Transform
side_surface = ClusterOutput(arrpolar_3.Geometry)

# ==== cluster Cluster_2
list = ValueList({"Model": 0, "Drawings": 1}, selected="Model")
b = ClusterInput()
force_max = ClusterInput()
outer_circle_offset = ClusterInput()
diameter = ClusterInput()
N = ClusterInput()
# display-model
model = Number(list)
# constant: b
b_2 = Number(b)
# maximum force
force_max_2 = Number(force_max)
# diameter
diameter_2 = Number(diameter)

# ----
# calculate x: (R/X=15/2
c_script = CSharpScript(D=diameter_2)  # -> out, H; inputs D: Double
# ---------- c_script: C# ----------
H = D/2/15*2; //according to the ratio R/X = 15/2
# ---------- end c_script ----------

X = Number(c_script.H)

# ----
# n: 4 —> 10
theta0 = Number(70)
series = Series(Start=4, Step=1, Count=7)

# ----
# radius
innerr = Number(expr("x/2", diameter_2))

# ----
# constant value: b
rad = Radians(Degrees=b_2)

rad_2 = Radians(Degrees=theta0)

# ----
# calculate maximum force
c_script_2 = CSharpScript(N=series, theta0=rad_2, b=rad, r=innerr)  # -> out, Alpha, GammaV, Force, Theta; inputs N: Double, theta0: Double, b: Double, r: Double
# ---------- c_script_2: C# ----------
double n = N;
//double pi = Math.PI;

double B = 2 * Math.PI / N;
double alpha = (Math.PI - N * b) / N;

double d0 = Math.Acos(//ok
  Math.Cos(theta0) * Math.Cos(theta0) +
  Math.Sin(theta0) * Math.Sin(theta0) * Math.Cos(B));


double lastF =0;
double F = 0;
double theta = Math.PI/2; //find the maximum force

do{
    theta = theta-0.1/180*Math.PI;
    lastF = F;

    double d = Math.Acos(//ok
      Math.Cos(theta) * Math.Cos(theta) +
      Math.Sin(theta) * Math.Sin(theta) * Math.Cos(B));

    double epsilon0 = Math.Acos(Math.Tan(d / 2) / Math.Tan(theta0));//ok
    double epsilon = Math.Acos(Math.Tan(d / 2) / Math.Tan(theta));//ok


    double f = Math.Acos(//ok
      Math.Cos(b / 2) * Math.Cos(b / 2) * Math.Cos(d) +
      Math.Sin(b) * Math.Sin(d) * Math.Sin(epsilon) +
      Math.Sin(b / 2) * Math.Sin(b / 2) *
      (Math.Cos(epsilon) * Math.Cos(epsilon) - Math.Cos(d) * Math.Sin(epsilon) * Math.Sin(epsilon))
      );
    double f0 = Math.Acos(//ok
      Math.Cos(b / 2) * Math.Cos(b / 2) * Math.Cos(d) +
      Math.Sin(b) * Math.Sin(d) * Math.Sin(epsilon) +
      Math.Sin(b / 2) * Math.Sin(b / 2) *
      (Math.Cos(epsilon0) * Math.Cos(epsilon0) - Math.Cos(d) * Math.Sin(epsilon0) * Math.Sin(epsilon0))
      );



    double d_theta = (-Math.Sin(2 * theta) * (Math.Cos(B) - 1)) / Math.Sin(d);//ok
    double d_theta0 = (-Math.Sin(2 * theta0) * (Math.Cos(B) - 1)) / Math.Sin(d);//ok
    double A =
      1 -
      Math.Pow(
      Math.Cos(b / 2) * Math.Cos(b / 2) * Math.Cos(d) +
      Math.Sin(b) * Math.Sin(d) * Math.Sin(epsilon) +
      Math.Sin(b / 2) * Math.Sin(b / 2) * (
      Math.Cos(epsilon) * Math.Cos(epsilon) - Math.Cos(d) * Math.Sin(epsilon) * Math.Sin(epsilon)
      )
      , 2);
    A = Math.Sqrt(A);//ok
    double eps_theta = (1 - 2 * Math.Cos(2 * d) + Math.Cos(B) + 2 * Math.Cos(4 * theta) * Math.Sin(B / 2) * Math.Sin(B / 2)) * Math.Tan(d / 2)
      / (4 * Math.Sin(d) * Math.Sin(d) * Math.Sin(theta) * Math.Sin(theta) * Math.Sin(epsilon));//ok
    double eps_theta0 = (1 - 2 * Math.Cos(2 * d) + Math.Cos(B) + 2 * Math.Cos(4 * theta0) * Math.Sin(B / 2) * Math.Sin(B / 2)) * Math.Tan(d / 2)
      / (4 * Math.Sin(d) * Math.Sin(d) * Math.Sin(theta0) * Math.Sin(theta0) * Math.Sin(epsilon0));//ok
    double f_theta = fTheta(A, b, d, d_theta, eps_theta, epsilon);//ok
    double f_theta0 = fTheta(A, b, d0, d_theta0, eps_theta0, epsilon0);//ok

    double eta=0,phi = 0;
    double eta0=0,phi0 = 0;
    double eta_theta = 0;
    eta_phi(alpha, d, f, b, epsilon, theta, d_theta, 1.166099, eps_theta, ref eta, ref phi, ref eta_theta);
    //eta_phi(alpha, d, f0, b, epsilon0, theta0, d_theta0, f_theta0, eps_theta0, ref eta0, ref phi0, ref eta_theta0);

    double gammaM_theta = gamma(theta, n, b);
    //double gammaM0_theta = gamma(theta0, n, b);

    double gammaV = phi - eta;
    if(theta > Math.PI / 2)
      gammaV = phi + eta;
    double gammaV0 = phi0 - eta0;

    GammaV = gammaV;
    Alpha = alpha;

    double gammaM = -Math.Acos(1 / Math.Sin(alpha) / Math.Cos(b / 2) * Math.Sin(f / 2) - 1 / Math.Tan(alpha) * Math.Tan(b / 2));
    double gammaM0 = -Math.Acos(1 / Math.Sin(alpha) / Math.Cos(b / 2) * Math.Sin(f0 / 2) - 1 / Math.Tan(alpha) * Math.Tan(b / 2));

    double phi_theta = 1 / Math.Cos(f / 2) *
      (1 / Math.Sin(alpha) * Math.Sin(b / 2) * Math.Tan(f / 2) - 1 / Math.Tan(alpha) / Math.Cos(f / 2)) * f_theta /
      (2 * Math.Sqrt(1 - Math.Pow(1 / Math.Sin(alpha) / Math.Cos(f / 2) * Math.Sin(b / 2) - 1 / Math.Tan(alpha) * Math.Tan(f / 2), 2)));


    double gammaV_theta = phi_theta - eta_theta;
    if(theta > Math.PI / 2)
      gammaV_theta = phi_theta + eta_theta;


    //Print("eta_theta={0:0.00000}", eta_theta);
    //Print("phi_theta={0:0.00000}", phi_theta);
    //Print("f={0:0.00000}", f);
    //Print("gammaV_theta={0:0.00000}", gammaV_theta);

    F = N * ((gammaM - gammaM0) * gammaM_theta + (gammaV - gammaV0) * gammaV_theta) / (Math.Sin(theta) * r);

} while(lastF <F);
Force = lastF;
Theta = theta;
# ---------- c_script_2: C# additional code ----------
  double gamma(double theta, double n, double b)
  {
    double pi = Math.PI;
    return
      -(((((2 * Math.Cos(2 * (pi / n)) - 2) * Math.Cos(theta) * Math.Sin(theta) / (2 *
      (Math.Cos(Math.Acos(Math.Cos(2 * (pi / n)) * Math.Sin(theta) * Math.Sin(theta) + Math.Cos(theta) * Math.Cos(theta)) / 2) * Math.Cos(Math.Acos(Math.Cos(2 * (pi / n)) * Math.Sin(theta) * Math.Sin(theta) + Math.Cos(theta) * Math.Cos(theta)) / 2) *
      Math.Sqrt(1 - Math.Pow((Math.Cos(2 * (pi / n)) * Math.Sin(theta) * Math.Sin(theta) + Math.Cos(theta) * Math.Cos(theta)), 2)))) +
      Math.Tan(Math.Acos(Math.Cos(2 * (pi / n)) * Math.Sin(theta) * Math.Sin(theta) + Math.Cos(theta) * Math.Cos(theta)) / 2) / (Math.Cos(theta) * Math.Cos(theta) *
      Math.Tan(theta))) * Math.Cos(Math.Acos(Math.Tan(Math.Acos(Math.Cos(2 * (pi / n)) * Math.Sin(theta) * Math.Sin(theta) +
      Math.Cos(theta) * Math.Cos(theta)) / 2) / Math.Tan(theta))) * Math.Sin(Math.Acos(Math.Cos(2 * (pi / n)) *
      Math.Sin(theta) * Math.Sin(theta) + Math.Cos(theta) * Math.Cos(theta))) / (Math.Sqrt(1 - Math.Pow((Math.Tan(Math.Acos(Math.Cos(2 *
      (pi / n)) * Math.Sin(theta) * Math.Sin(theta) + Math.Cos(theta) * Math.Cos(theta)) / 2) / Math.Tan(theta)), 2)) *
      Math.Tan(theta)) - (2 * Math.Cos(2 * (pi / n)) - 2) * Math.Cos(Math.Acos(Math.Cos(2 *
      (pi / n)) * Math.Sin(theta) * Math.Sin(theta) + Math.Cos(theta) * Math.Cos(theta))) * Math.Cos(theta) * Math.Sin(Math.Acos(Math.Tan(Math.Acos(Math.Cos(2 *
      (pi / n)) * Math.Sin(theta) * Math.Sin(theta) + Math.Cos(theta) * Math.Cos(theta)) / 2) / Math.Tan(theta))) *
      Math.Sin(theta) / Math.Sqrt(1 - Math.Pow((Math.Cos(2 * (pi / n)) * Math.Sin(theta) * Math.Sin(theta) + Math.Cos(theta) * Math.Cos(theta)), 2))) *
      Math.Sin(b) + (2 * Math.Cos(2 * (pi / n)) - 2) * Math.Pow(Math.Cos(b / 2), 2) * Math.Cos(theta) *
      Math.Sin(Math.Acos(Math.Cos(2 * (pi / n)) * Math.Sin(theta) * Math.Sin(theta) + Math.Cos(theta) * Math.Cos(theta))) *
      Math.Sin(theta) / Math.Sqrt(1 - Math.Pow((Math.Cos(2 * (pi / n)) * Math.Sin(theta) * Math.Sin(theta) + Math.Cos(theta) * Math.Cos(theta)), 2)) -
      (((2 * Math.Cos(2 * (pi / n)) - 2) * Math.Cos(theta) * Math.Sin(theta) / (2 *
      (Math.Cos(Math.Acos(Math.Cos(2 * (pi / n)) * Math.Sin(theta) * Math.Sin(theta) + Math.Cos(theta) * Math.Cos(theta)) / 2) * Math.Cos(Math.Acos(Math.Cos(2 * (pi / n)) * Math.Sin(theta) * Math.Sin(theta) + Math.Cos(theta) * Math.Cos(theta)) / 2) *
      Math.Sqrt(1 - Math.Pow((Math.Cos(2 * (pi / n)) * Math.Sin(theta) * Math.Sin(theta) + Math.Cos(theta) * Math.Cos(theta)), 2)))) +
      Math.Tan(Math.Acos(Math.Cos(2 * (pi / n)) * Math.Sin(theta) * Math.Sin(theta) + Math.Cos(theta) * Math.Cos(theta)) / 2) / (Math.Cos(theta) * Math.Cos(theta) *
      Math.Tan(theta))) * (2 + 2 * Math.Cos(Math.Acos(Math.Cos(2 * (pi / n)) *
      Math.Sin(theta) * Math.Sin(theta) + Math.Cos(theta) * Math.Cos(theta)))) * Math.Cos(Math.Acos(Math.Tan(Math.Acos(Math.Cos(2 *
      (pi / n)) * Math.Sin(theta) * Math.Sin(theta) + Math.Cos(theta) * Math.Cos(theta)) / 2) / Math.Tan(theta))) / (Math.Sqrt(1 -
      Math.Pow((Math.Tan(Math.Acos(Math.Cos(2 * (pi / n)) * Math.Sin(theta) * Math.Sin(theta) + Math.Cos(theta) * Math.Cos(theta)) / 2) / Math.Tan(theta)), 2)) *
      Math.Tan(theta)) + (2 * Math.Cos(2 * (pi / n)) - 2) * Math.Cos(theta) *
      Math.Sin(Math.Acos(Math.Cos(2 * (pi / n)) * Math.Sin(theta) * Math.Sin(theta) + Math.Cos(theta) * Math.Cos(theta))) *
      Math.Sin(Math.Acos(Math.Tan(Math.Acos(Math.Cos(2 * (pi / n)) * Math.Sin(theta) * Math.Sin(theta) + Math.Cos(theta) * Math.Cos(theta)) / 2) / Math.Tan(theta))) *
      Math.Sin(theta) / Math.Sqrt(1 - Math.Pow((Math.Cos(2 * (pi / n)) * Math.Sin(theta) * Math.Sin(theta) +
      Math.Cos(theta) * Math.Cos(theta)), 2))) * Math.Sin(Math.Acos(Math.Tan(Math.Acos(Math.Cos(2 * (pi / n)) *
      Math.Sin(theta) * Math.Sin(theta) + Math.Cos(theta) * Math.Cos(theta)) / 2) / Math.Tan(theta))) * Math.Pow(Math.Sin(b / 2), 2)) *
      Math.Cos(Math.Acos((Math.Pow(Math.Cos(Math.Acos(Math.Tan(Math.Acos(Math.Cos(2 * (pi / n)) * Math.Sin(theta) * Math.Sin(theta) +
      Math.Cos(theta) * Math.Cos(theta)) / 2) / Math.Tan(theta))), 2) - Math.Cos(Math.Acos(Math.Cos(2 * (pi / n)) *
      Math.Sin(theta) * Math.Sin(theta) + Math.Cos(theta) * Math.Cos(theta))) * Math.Pow(Math.Sin(Math.Acos(Math.Tan(Math.Acos(Math.Cos(2 *
      (pi / n)) * Math.Sin(theta) * Math.Sin(theta) + Math.Cos(theta) * Math.Cos(theta)) / 2) / Math.Tan(theta))), 2)) *
      Math.Pow(Math.Sin(b / 2), 2) + Math.Cos(Math.Acos(Math.Cos(2 * (pi / n)) * Math.Sin(theta) * Math.Sin(theta) +
      Math.Cos(theta) * Math.Cos(theta))) * Math.Pow(Math.Cos(b / 2), 2) + Math.Sin(Math.Acos(Math.Cos(2 * (pi / n)) *
      Math.Sin(theta) * Math.Sin(theta) + Math.Cos(theta) * Math.Cos(theta))) * Math.Sin(Math.Acos(Math.Tan(Math.Acos(Math.Cos(2 *
      (pi / n)) * Math.Sin(theta) * Math.Sin(theta) + Math.Cos(theta) * Math.Cos(theta)) / 2) / Math.Tan(theta))) *
      Math.Sin(b)) / 2) / (2 * (Math.Cos(b / 2) * Math.Sin((pi - b * n) / n) * Math.Sqrt(1 -
      Math.Pow(((Math.Pow(Math.Cos(Math.Acos(Math.Tan(Math.Acos(Math.Cos(2 * (pi / n)) * Math.Sin(theta) * Math.Sin(theta) + Math.Cos(theta) * Math.Cos(theta)) / 2) / Math.Tan(theta))), 2) -
      Math.Cos(Math.Acos(Math.Cos(2 * (pi / n)) * Math.Sin(theta) * Math.Sin(theta) + Math.Cos(theta) * Math.Cos(theta))) *
      Math.Pow(Math.Sin(Math.Acos(Math.Tan(Math.Acos(Math.Cos(2 * (pi / n)) * Math.Sin(theta) * Math.Sin(theta) +
      Math.Cos(theta) * Math.Cos(theta)) / 2) / Math.Tan(theta))), 2)) * Math.Pow(Math.Sin(b / 2), 2) +
      Math.Cos(Math.Acos(Math.Cos(2 * (pi / n)) * Math.Sin(theta) * Math.Sin(theta) + Math.Cos(theta) * Math.Cos(theta))) *
      Math.Pow(Math.Cos(b / 2), 2) + Math.Sin(Math.Acos(Math.Cos(2 * (pi / n)) * Math.Sin(theta) * Math.Sin(theta) +
      Math.Cos(theta) * Math.Cos(theta))) * Math.Sin(Math.Acos(Math.Tan(Math.Acos(Math.Cos(2 * (pi / n)) *
      Math.Sin(theta) * Math.Sin(theta) + Math.Cos(theta) * Math.Cos(theta)) / 2) / Math.Tan(theta))) * Math.Sin(b)), 2)) *
      Math.Sqrt(1 - Math.Pow((Math.Sin(Math.Acos((Math.Pow(Math.Cos(Math.Acos(Math.Tan(Math.Acos(Math.Cos(2 * (pi / n)) * Math.Sin(theta) * Math.Sin(theta) +
      Math.Cos(theta) * Math.Cos(theta)) / 2) / Math.Tan(theta))), 2) - Math.Cos(Math.Acos(Math.Cos(2 * (pi / n)) *
      Math.Sin(theta) * Math.Sin(theta) + Math.Cos(theta) * Math.Cos(theta))) * Math.Pow(Math.Sin(Math.Acos(Math.Tan(Math.Acos(Math.Cos(2 *
      (pi / n)) * Math.Sin(theta) * Math.Sin(theta) + Math.Cos(theta) * Math.Cos(theta)) / 2) / Math.Tan(theta))), 2)) *
      Math.Pow(Math.Sin(b / 2), 2) + Math.Cos(Math.Acos(Math.Cos(2 * (pi / n)) * Math.Sin(theta) * Math.Sin(theta) +
      Math.Cos(theta) * Math.Cos(theta))) * Math.Pow(Math.Cos(b / 2), 2) + Math.Sin(Math.Acos(Math.Cos(2 * (pi / n)) *
      Math.Sin(theta) * Math.Sin(theta) + Math.Cos(theta) * Math.Cos(theta))) * Math.Sin(Math.Acos(Math.Tan(Math.Acos(Math.Cos(2 *
      (pi / n)) * Math.Sin(theta) * Math.Sin(theta) + Math.Cos(theta) * Math.Cos(theta)) / 2) / Math.Tan(theta))) *
      Math.Sin(b)) / 2) / (Math.Cos(b / 2) * Math.Sin((pi - b * n) / n)) - Math.Tan(b / 2) / Math.Tan((pi -
      b * n) / n)), 2)))));
  }

  double fTheta(double A, double b, double d, double d_theta, double eps_theta, double epsilon)
  {
    double f_theta = 1 / A *
      (Math.Cos(b / 2) * Math.Cos(b / 2) * Math.Sin(d) * d_theta
      - Math.Sin(b) * ( Math.Sin(d) * Math.Cos(epsilon) * eps_theta + Math.Sin(epsilon) * Math.Cos(d) * d_theta)
      - Math.Sin(b / 2) * Math.Sin(b / 2) * Math.Sin(epsilon)
      * (-2 * (1 + Math.Cos(d)) * Math.Cos(epsilon) * eps_theta + Math.Sin(epsilon) * Math.Sin(d) * d_theta));
    return f_theta;
  }

  void eta_phi(double alpha, double d, double f, double b, double epsilon, double theta, double d_theta, double f_theta, double eps_theta, ref double eta, ref double phi, ref double eta_theta)
  {
    double k6 = Math.Sin(d) * Math.Sin(f);
    double k5 = Math.Sin(d) * Math.Sin(f) * Math.Cos(b / 2);
    double k4 = Math.Cos(d) * Math.Sin(f) * Math.Sin(b / 2);
    double k3 = Math.Sin(d) * Math.Cos(f) * Math.Sin(b / 2);
    double k2 = Math.Cos(b / 2);
    double k1 = Math.Cos(d) * Math.Cos(f) * Math.Cos(b / 2);
    double h3 = Math.Cos(epsilon) * k6;
    if(theta > Math.PI / 2)
      h3 = -h3;
    double h2 = -k4 + Math.Sin(epsilon) * k5;
    double h1 = k1 - k2 + Math.Sin(epsilon) * k3;

    eta = 2 * Math.Atan((-h3 + Math.Sqrt(Math.Pow(h3, 2) - Math.Pow(h1, 2) + Math.Pow(h2, 2))) / (h1 - h2));
    phi = Math.PI - Math.Acos(
      1 / Math.Sin(alpha) * Math.Sin(b / 2) / Math.Cos(f / 2) -
      1 / Math.Tan(alpha) * Math.Tan(f / 2));
    double B = Math.Sqrt(h3 * h3 - h1 * h1 + h2 * h2);

    double k6_theta = Math.Sin(d) * Math.Cos(f) * f_theta + Math.Cos(d) * Math.Sin(f) * d_theta;//ok
    double k5_theta = Math.Cos(b / 2) * (Math.Sin(d) * Math.Cos(f) * f_theta + Math.Cos(d) * Math.Sin(f) * d_theta);//ok
    double k4_theta = Math.Sin(b / 2) * (Math.Cos(d) * Math.Cos(f) * f_theta - Math.Sin(d) * Math.Sin(f) * d_theta);//ok
    double k3_theta = -Math.Sin(b / 2) * (Math.Sin(d) * Math.Sin(f) * f_theta - Math.Cos(d) * Math.Cos(f) * d_theta);//ok
    double k1_theta = -Math.Cos(b / 2) * (Math.Cos(d) * Math.Sin(f) * f_theta + Math.Sin(d) * Math.Cos(f) * d_theta);//ok

    double h3_theta = -k6 * Math.Sin(epsilon) * eps_theta + Math.Cos(epsilon) * k6_theta;
    if(theta > Math.PI / 2)
      h3_theta = -h3_theta;
    double h2_theta = -k4_theta + k5 * Math.Cos(epsilon) * eps_theta + Math.Sin(epsilon) * k5_theta;//ok
    double h1_theta = k1_theta + k3 * Math.Cos(epsilon) * eps_theta + Math.Sin(epsilon) * k3_theta;//ok

    eta_theta = 2 / Math.Pow(h1 - h2, 2) / (Math.Pow((-h3 + B) / (h1 - h2), 2) + 1)
      * (
      (h1 - h2) * (1 / B * (h3 * h3_theta - h1 * h1_theta + h2 * h2_theta) - h3_theta)
      - (B - h3) * (h1_theta - h2_theta)
      );


  }
# ---------- end c_script_2 ----------
deg = Degrees(Radians=c_script_2.Theta)
panel = Panel(deg)

# ----
# inner circle
cir = Circle(Plane=PlaneXY(0, 0, 0), Radius=innerr)

end = EndPoints(Curve=cir)  # -> Start, End

# ----
# constant value: b/2
division = Division(A=rad, B=2)

# ----
# calculate proper N & Dppi
c_script_3 = CSharpScript(F=force_max_2, Force=c_script_2.Force)  # -> out, N, resultF, Dppi; inputs F: Double, Force: list of Double
# ---------- c_script_3: C# ----------
int indx =0;
double properF= 0;

for (int i = 0;i < Force.Count;i++)
{
    if(Math.Abs(F -properF) > Math.Abs(Force[i] -properF)){
        indx = 4+i;
        properF = Force[i];

    }
}

N = indx;
resultF= properF;
Dppi = 399;
# ---------- end c_script_3 ----------
# fixed d
# fixed x
N_2 = Number(N)

rotate = Rotate(Geometry=end.Start, Angle=expr("-x", division), Plane=PlaneXY(0, 0, 0))  # -> Geometry, Transform
rotate_2 = Rotate(Geometry=end.Start, Angle=division, Plane=PlaneXY(0, 0, 0))  # -> Geometry, Transform
avr = Average(Input=[rotate_2.Geometry, rotate.Geometry])
pdecon = Deconstruct(Point=avr)  # -> XComponent, YComponent, ZComponent

# ----
# outer circle
# circle: 15/19
eval = Evaluate(F="D/2*(19/15)", D=diameter_2)
cir_2 = Circle(Plane=PlaneXY(0, 0, 0), Radius=eval)

eval_2 = Evaluate(F="D*sin(b)*1.5", D=diameter_2, b=division)
pt = ConstructPoint(XCoordinate=pdecon.XComponent, YCoordinate=expr("-x", eval_2), ZCoordinate=pdecon.ZComponent)
pt_2 = ConstructPoint(XCoordinate=pdecon.XComponent, YCoordinate=eval_2, ZCoordinate=pdecon.ZComponent)
X_2 = UnitX(Factor=1)

ln = Line(StartPoint=pt, EndPoint=pt_2)
len = Length(Curve=ln)
line = LineSDL(Start=pt_2, Direction=X_2, Length=len)
line_2 = LineSDL(Start=pt, Direction=X_2, Length=len)
ccx = CurveCurve(CurveA=cir_2, CurveB=line_2)  # -> Points, ParamsA, ParamsB
seam = Seam(Curve=cir_2, Seam=ccx.ParamsA)
ccx_2 = CurveCurve(CurveA=seam, CurveB=line)  # -> Points, ParamsA, ParamsB

foldper = ClusterInput()

# ----
# calculate current theta
# folding range: 70-110
c_script_4 = CSharpScript(foldPer=foldper, D=diameter_2)  # -> out, curTheta, curHeight, curSideRotation; inputs foldPer: Double, D: Double
# ---------- c_script_4: C# ----------
// folding range: 70-110
double theta = (70+(110-70)*foldPer)/180*Math.PI;
curHeight = D/2* Math.Cos(theta);

curTheta = theta;

//0 -> 60
curSideRotation = (40 * foldPer + theta-Math.PI/2)/180*Math.PI;
# ---------- end c_script_4 ----------

ln_2 = Line(StartPoint=rotate_2.Geometry, EndPoint=rotate.Geometry)
X_3 = UnitX(Factor=X)

xy = XYPlane(Origin=Point(0, 0, 0))
ln_3 = Line(StartPoint=rotate_2.Geometry, EndPoint=xy)
ln_4 = Line(StartPoint=rotate.Geometry, EndPoint=xy)

ln_5 = Line(StartPoint=pt, EndPoint=rotate.Geometry)
ln_6 = Line(StartPoint=rotate_2.Geometry, EndPoint=pt_2)
subcrv = SubCurve(BaseCurve=seam, Domain=ccx_2.ParamsA)
ln_7 = Line(StartPoint=pt, EndPoint=ccx.Points)
ln_8 = Line(StartPoint=ccx_2.Points, EndPoint=pt_2)

move = Move(Geometry=ln_2, Motion=X_3)  # -> Geometry, Transform
line_3 = LineSDL(Start=rotate_2.Geometry, Direction=X_2, Length=X_3)
line_4 = LineSDL(Start=rotate.Geometry, Direction=X_2, Length=X_3)

# ----
# remain dis_X
c_script_5 = CSharpScript(D=diameter_2, theta=c_script_4.curTheta)  # -> out, foldR, remainX, foldH; inputs D: Double, theta: Double
# ---------- c_script_5: C# ----------
double R = D/2*Math.Sin(theta);
remainX = D/2 - R;
foldH = D/2*Math.Cos(theta);
foldR = R;
# ---------- end c_script_5 ----------

# ----
# curGammaV
c_script_6 = CSharpScript(N=N_2, theta=c_script_4.curTheta, b=rad)  # -> out, Alpha, GammaV; inputs N: Double, theta: Double, b: Double
# ---------- c_script_6: C# ----------
    double theta0 = 0;

    double B = 2 * Math.PI / N;
    double alpha = (Math.PI - N * b) / N;

    double d = Math.Acos(
      Math.Cos(theta) * Math.Cos(theta) +
      Math.Sin(theta) * Math.Sin(theta) * Math.Cos(B));
    double d0 = Math.Acos(
      Math.Cos(theta0) * Math.Cos(theta0) +
      Math.Sin(theta0) * Math.Sin(theta0) * Math.Cos(B));

    double epsilon = Math.Acos(Math.Tan(d / 2) / Math.Tan(theta));
    double epsilon0 = Math.Acos(Math.Tan(d / 2) / Math.Tan(theta0));//0000000

    double f = Math.Acos(
      Math.Cos(b / 2) * Math.Cos(b / 2) * Math.Cos(d) +
      Math.Sin(b) * Math.Sin(d) * Math.Sin(epsilon) +
      Math.Sin(b / 2) * Math.Sin(b / 2) *
      (Math.Cos(epsilon) * Math.Cos(epsilon) - Math.Cos(d) * Math.Sin(epsilon) * Math.Sin(epsilon))
      );
    double f0 = Math.Acos(
      Math.Cos(b / 2) * Math.Cos(b / 2) * Math.Cos(d) +
      Math.Sin(b) * Math.Sin(d) * Math.Sin(epsilon) +
      Math.Sin(b / 2) * Math.Sin(b / 2) *
      (Math.Cos(epsilon0) * Math.Cos(epsilon0) - Math.Cos(d) * Math.Sin(epsilon0) * Math.Sin(epsilon0))
      );

    double k6 = Math.Sin(d) * Math.Sin(f);
    double k5 = Math.Sin(d) * Math.Sin(f) * Math.Cos(b / 2);
    double k4 = Math.Cos(d) * Math.Sin(f) * Math.Sin(b / 2);
    double k3 = Math.Sin(d) * Math.Cos(f) * Math.Sin(b / 2);
    double k2 = Math.Cos(b / 2);
    double k1 = Math.Cos(d) * Math.Cos(f) * Math.Cos(b / 2);
    double h3 = Math.Cos(epsilon) * k6;
    if(theta > Math.PI / 2)
      h3 = -h3;
    double h2 = -k4 + Math.Sin(epsilon) * k5;
    double h1 = k1 - k2 + Math.Sin(epsilon) * k3;

    double eta = 2 * Math.Atan((-h3 + Math.Sqrt(Math.Pow(h3, 2) - Math.Pow(h1, 2) + Math.Pow(h2, 2))) / (h1 - h2));
    double phi = Math.PI - Math.Acos(
      1 / Math.Sin(alpha) * Math.Sin(b / 2) / Math.Cos(f / 2) -
      1 / Math.Tan(alpha) * Math.Tan(f / 2));

    double d_theta = (-Math.Sin(2 * theta) * (Math.Cos(B) - 1)) / Math.Sin(d);
    double d_theta0 = (-Math.Sin(2 * theta0) * (Math.Cos(B) - 1)) / Math.Sin(d);
    double A = Math.Pow(1 - (Math.Cos(b / 2) * Math.Cos(b / 2) * Math.Cos(d) + Math.Sin(b) * Math.Sin(d) * Math.Sin(epsilon) + Math.Sin(b / 2) * Math.Sin(b / 2) * Math.Pow(Math.Cos(epsilon) * Math.Cos(epsilon) - Math.Cos(d) * Math.Sin(epsilon) * Math.Sin(epsilon), 2)), 0.5);
    double eps_theta = (1 - 2 * Math.Cos(2 * d) + Math.Cos(B) + 2 * Math.Cos(4 * theta) * Math.Sin(B) * Math.Sin(B)) * Math.Tan(d / 2) / (4 * Math.Sin(d) * Math.Sin(d) * Math.Sin(theta) * Math.Sin(theta) * Math.Sin(epsilon));
    double eps_theta0 = (1 - 2 * Math.Cos(2 * d) + Math.Cos(B) + 2 * Math.Cos(4 * theta0) * Math.Sin(B) * Math.Sin(B)) * Math.Tan(d / 2) / (4 * Math.Sin(d) * Math.Sin(d) * Math.Sin(theta0) * Math.Sin(theta0) * Math.Sin(epsilon0));
    double f_theta = fTheta(A, b, d, d_theta, eps_theta, epsilon);
    double f_theta0 = fTheta(A, b, d, d_theta0, eps_theta0, epsilon0);
    double gammaM_theta = gamma(alpha, b, f, f_theta);
    double gammaM0_theta = gamma(alpha, b, f, f_theta0);

    double gammaV = phi - eta;
    if(theta > Math.PI / 2)
      gammaV = phi + eta;

// offest 0.08 radians
    GammaV = gammaV + 0.08;
    Alpha = alpha;
# ---------- c_script_6: C# additional code ----------
  double gamma(double alpha, double b, double f, double f_theta)
  {
    double up = 1 / Math.Sin(alpha) / Math.Cos(b / 2) * Math.Cos(f / 2) * f_theta;
    double down = 2 * Math.Pow(1 - Math.Pow(1 / Math.Sin(alpha) / Math.Cos(b / 2) * Math.Cos(f / 2) - 1 / Math.Tan(alpha) * Math.Tan(b / 2), 2), 0.5);
    return up / down;
  }

  double fTheta(double A, double b, double d, double d_theta, double eps_theta, double epsilon)
  {
    double f_theta = 1 / A * (Math.Cos(b / 2) * Math.Cos(b / 2) * Math.Sin(d) * d_theta - Math.Sin(b) * ( Math.Sin(d) * Math.Cos(epsilon) * eps_theta + Math.Sin(epsilon) * Math.Cos(d) * d_theta) - Math.Sin(b / 2) * Math.Sin(b / 2) * Math.Sin(epsilon) * (-2 * (1 + Math.Cos(d)) * Math.Cos(epsilon) * eps_theta + Math.Sin(epsilon) * Math.Sin(d) + d_theta));
    return f_theta;
  }
# ---------- end c_script_6 ----------

# ----
# side_fixed
boundary = BoundarySurfaces(Edges=flatten([line_3, line_4, move.Geometry, ln_5, ln_6, ln_8, ln_7, subcrv]))

X_4 = UnitX(Factor=expr("-x", c_script_5.remainX))

move_2 = Move(Geometry=ln_2, Motion=X_4)  # -> Geometry, Transform
move_3 = Move(Geometry=move.Geometry, Motion=X_4)  # -> Geometry, Transform
rotax = RotateAxis(Geometry=move_3.Geometry, Angle=c_script_4.curSideRotation, Axis=move_2.Geometry)  # -> Geometry, Transform
end_2 = EndPoints(Curve=rotax.Geometry)  # -> Start, End
pdecon_2 = Deconstruct(Point=end_2.Start)  # -> XComponent, YComponent, ZComponent

cyl = Cylinder(Base=ln_2, Radius=line_3, Length=move.Geometry)
yz = YZPlane(Origin=end_2.Start)
sec = BrepPlane(Brep=cyl, Plane=yz)  # -> Curves, Points
item = ListItem(List=sec.Curves, Index=1, Wrap=True)
end_3 = EndPoints(Curve=item)  # -> Start, End
pdecon_3 = Deconstruct(Point=end_3.Start)  # -> XComponent, YComponent, ZComponent

subtraction = Subtraction(A=pdecon_3.ZComponent, B=pdecon_2.ZComponent)
c_script_7 = CSharpScript(theta=c_script_4.curTheta, Z=pdecon_2.ZComponent)  # -> out, h; inputs theta: Double, Z: Double
# ---------- c_script_7: C# ----------
if(theta <Math.PI)
    h = -Z;
else
    h=Z;
# ---------- end c_script_7 ----------
num = Number(subtraction)

addition = Addition(A=c_script_4.curHeight, B=num)
Z = UnitZ(Factor=addition)
Z_2 = UnitZ(Factor=num)
move_4 = Move(Geometry=rotate.Geometry, Motion=X_4)  # -> Geometry, Transform
move_5 = Move(Geometry=rotate_2.Geometry, Motion=X_4)  # -> Geometry, Transform
move_6 = Move(Geometry=xy, Motion=Z)  # -> Geometry, Transform
move_7 = Move(Geometry=move_4.Geometry, Motion=Z_2)  # -> Geometry, Transform
move_8 = Move(Geometry=move_5.Geometry, Motion=Z_2)  # -> Geometry, Transform
ln_9 = Line(StartPoint=move_7.Geometry, EndPoint=move_6.Geometry)
move_9 = Move(Geometry=rotax.Geometry, Motion=Z_2)  # -> Geometry, Transform
ln_10 = Line(StartPoint=move_8.Geometry, EndPoint=move_6.Geometry)
# N
# b_fixed
c_script_8 = CSharpScript(N=N_2, b=rad)  # -> out, angle; inputs N: Int32, b: Double
# ---------- c_script_8: C# ----------
angle = (2* Math.PI - (2*N*b))/ (2*N);
# ---------- end c_script_8 ----------
gammav = Number(c_script_6.GammaV)
alpha = Number(c_script_6.Alpha)
ln_11 = Line(StartPoint=move_8.Geometry, EndPoint=move_7.Geometry)
rotate_3 = Rotate(Geometry=move_8.Geometry, Angle=c_script_8.angle, Plane=PlaneXY(0, 0, 0))  # -> Geometry, Transform
boundary_2 = BoundarySurfaces(Edges=flatten([ln_11, ln_9, ln_10]))
pl_3pt = Plane3Pt(PointA=move_6.Geometry, PointB=move_8.Geometry, PointC=rotate_3.Geometry)
xz = XZPlane(Origin=Point(0, 0, 0))
arc = Arc(Plane=pl_3pt, Radius=innerr, Angle=c_script_8.angle)  # -> Arc, Length
addition_2 = Addition(A=alpha, B=rad)
lnpt = LinePt(Line=item, Point=pt_2)
lnpt_2 = LinePt(Line=move.Geometry, Point=pt_2)
end_4 = EndPoints(Curve=arc.Arc)  # -> Start, End
rotate_4 = Rotate(Geometry=xz, Angle=addition_2, Plane=PlaneXY(0, 0, 0))  # -> Geometry, Transform

# ----
# side_folded
rulesrf = RuledSurface(CurveA=ln_11, CurveB=item)
orient = Orient(Geometry=boundary, Source=lnpt_2, Target=lnpt)  # -> Geometry, Transform

ln_12 = Line(StartPoint=move_6.Geometry, EndPoint=end_4.End)
rotax_2 = RotateAxis(Geometry=end_4.End, Angle=expr("-x", gammav), Axis=ln_10)  # -> Geometry, Transform
mirror = Mirror(Geometry=rotax_2.Geometry, Plane=rotate_4.Geometry)  # -> Geometry, Transform
rotax_3 = RotateAxis(Geometry=arc.Arc, Angle=expr("-x", gammav), Axis=ln_10)  # -> Geometry, Transform
rotax_4 = RotateAxis(Geometry=ln_12, Angle=expr("-x", gammav), Axis=ln_10)  # -> Geometry, Transform
vec2pt = Vector2Pt(PointA=move_6.Geometry, PointB=rotax_2.Geometry, Unitize=False)  # -> Vector, Length
vec2pt_2 = Vector2Pt(PointA=move_6.Geometry, PointB=mirror.Geometry, Unitize=False)  # -> Vector, Length
mirror_2 = Mirror(Geometry=rotax_4.Geometry, Plane=rotate_4.Geometry)  # -> Geometry, Transform
pl_3pt_2 = Plane3Pt(PointA=move_6.Geometry, PointB=rotax_2.Geometry, PointC=mirror.Geometry)
angle = Angle(VectorA=vec2pt.Vector, VectorB=vec2pt_2.Vector)  # -> Angle, Reflex
arc_2 = Arc(Plane=pl_3pt_2, Radius=innerr, Angle=angle.Angle)  # -> Arc, Length

boundary_3 = BoundarySurfaces(Edges=flatten([rotax_3.Geometry, rotax_4.Geometry, ln_10]))
boundary_4 = BoundarySurfaces(Edges=flatten([rotax_4.Geometry, arc_2.Arc, mirror_2.Geometry]))
mirror_3 = Mirror(Geometry=boundary_3, Plane=rotate_4.Geometry)  # -> Geometry, Transform

group = Group(Objects=[boundary_3, mirror_3.Geometry, boundary_2, rulesrf, orient.Geometry, boundary_4])
arrpolar = PolarArray(Geometry=group, Plane=PlaneXY(0, 0, 0), Count=N_2, Angle=6.283185307)  # -> Geometry, Transform

# ----
# buttom surface
eval_3 = Evaluate(F="2*PI/N-b", N=N_2, b=division)
dom = ConstructDomain(DomainStart=division, DomainEnd=eval_3)
arc_3 = Arc(Plane=PlaneXY(0, 0, 0), Radius=innerr, Angle=dom)  # -> Arc, Length
addition_3 = Addition(A=eval, B=outer_circle_offset)
merge = Merge(Data1=arc_3.Arc, Data2=subcrv, Data3=ln_7, Data4=ln_8)  # -> flatten(Result)
cir_3 = Circle(Plane=PlaneXY(0, 0, 0), Radius=addition_3)

merge_2 = Merge(Data1=ln_6, Data2=ln_5, Data3=merge)

arrpolar_2 = PolarArray(Geometry=merge_2, Plane=PlaneXY(0, 0, 0), Count=N_2, Angle=6.283185307)  # -> Geometry, Transform
join = JoinCurves(Curves=flatten(arrpolar_2.Geometry), Preserve=False)

# ----
# cutting lines
merge_3 = Merge(Data1=merge, Data2=line_3, Data3=line_4)  # -> flatten(Result)
arrpolar_3 = PolarArray(Geometry=merge_3, Plane=PlaneXY(0, 0, 0), Count=N_2, Angle=6.283185307)  # -> flatten(Geometry), Transform
group_2 = Group(Objects=[cir_3, arrpolar_3.Geometry])  # -> flatten(Group)

boundary_5 = BoundarySurfaces(Edges=flatten([join, cir_3]))
group_3 = Group(Objects=flatten([arrpolar.Geometry, boundary_5]))
filter = StreamFilter(Gate=model, Stream0=group_3)
s_0 = ClusterOutput(filter)

# ----
# folding lines
merge_4 = Merge(Data1=ln_6, Data2=ln_5, Data3=move.Geometry, Data4=ln_2)
join_2 = JoinCurves(Curves=[ln_4, ln_3], Preserve=False)
arrpolar_4 = PolarArray(Geometry=join_2, Plane=PlaneXY(0, 0, 0), Count=expr("2*x", N_2), Angle=6.283185307)  # -> flatten(Geometry), Transform
arrpolar_5 = PolarArray(Geometry=merge_4, Plane=PlaneXY(0, 0, 0), Count=N_2, Angle=6.283185307)  # -> flatten(Geometry), Transform
dppi = Number(c_script_3.Dppi)
c_script_9 = CSharpScript(dpi=dppi)  # -> out, dash, gap; inputs dpi: Double
# ---------- c_script_9: C# ----------
// 1 inch = 25.4 mm
double d = 0.025;
double ppi = 25.4/(dpi*d)-1;

dash = d;
gap = d*ppi;
# ---------- end c_script_9 ----------

dash = DashPattern(Curve=arrpolar_5.Geometry, Pattern=flatten([c_script_9.dash, c_script_9.gap]))  # -> Dashes, Gaps
dash_2 = DashPattern(Curve=arrpolar_4.Geometry, Pattern=flatten([c_script_9.dash, c_script_9.gap]))  # -> Dashes, Gaps

merge_5 = Merge(Data1=dash.Dashes, Data2=dash_2.Dashes)  # -> flatten(Result)

_2d_pattern = ClusterOutput([merge_5, group_2])

# ==== cluster Cluster_3
D = ClusterInput()
force = ClusterInput()
H = ClusterInput()

# ----
# Dppi:92-399
series = Series(Start=92, Step=1, Count=308)

D_2 = Number(D)

# ----
# constant value
alpha = Alpha(1.047197551)

force_2 = Number(force)
H_2 = Number(H)

# ----
# Outter circle
cir = Circle(Plane=PlaneXY(0, 0, 0), Radius=expr("x/2", D_2))

# ----
# calculate beta
c_script = CSharpScript(H=H_2, D=D_2)  # -> out, beta; inputs H: Double, D: Double
# ---------- c_script: C# ----------
//calculate the value of beta based on Height
//according to equation (1) in paper
beta = 2 * Math.Atan(D*0.62 * 0.5 / H);
# ---------- end c_script ----------

D_3 = ClusterInput()

# ----
# calculate number of arms
c_script_2 = CSharpScript(F=force_2, Beta=c_script.beta, D=D_2, Dppi=series)  # -> ppi, all_N, Dis; inputs F: Double, Beta: Double, D: Double, Dppi: list of Double
# ---------- c_script_2: C# ----------
// given: F D H & Dppi_list
// keep beta & ppi
double[] ppi_list = new double[7]; // 3~9
double[] min_dis = new double[7]{1,1,1,1,1,1,1};
List<double> n_list = new List<double>();
double max_n = -1000;

for(int i =0; i<Dppi.Count; i++){
    double dppi = Dppi[i];
    //F = 0.37460448 * N + 0.07150102 * D + 0.01259251 * Beta - 0.005434 * PPI + 0.90218455
    double n = (F -(0.07150102 * D + 0.01259251 * (Beta/Math.PI*180) - 0.005434 * dppi + 0.90218455))/0.37460448;
    if(max_n<n)
        max_n = n;

    n_list.Add(n);

    if(n>=3 && n<=9){
        double n_floor = Math.Floor(n+0.5); //3~9
        int indx = (int)n_floor-3;

        double dis = Math.Abs(n_floor-n);
        if(dis < 0.1 && min_dis[indx]>dis){
            min_dis[indx]= dis;
            ppi_list[indx]= dppi;

        }

    }
}

ppi = ppi_list;
//max_N = max_n;
all_N = n_list;
Dis = min_dis;
# ---------- end c_script_2 ----------
c_script_3 = CSharpScript(F=force_2, H=H_2, D=D_2, Dppi=series)  # -> Beta, ppi, N, Dis; inputs F: Double, H: Double, D: Double, Dppi: list of Double; disabled
# ---------- c_script_3: C# ----------
// given: F D H & Dppi_list
// keep beta & ppi
double[] beta_list = new double[7]; // 3~9
double[] ppi_list = new double[7]; // 3~9
double[] last_dis = new double[7]{1,1,1,1,1,1,1};
List<double> n_list = new List<double>();

for(int i =0; i<Dppi.Count; i++){
    double dppi = Dppi[i];

    double beta  = (H + 0.2458623*D -0.00137354*dppi - 5.16672134)/0.01742353;
    //F = 0.37460448 * N + 0.07150102 * D + 0.01259251 * Beta - 0.005434 * PPI + 0.90218455
    double n = (F -(0.07150102 * D + 0.01259251 * beta - 0.005434 * dppi + 0.90218455))/0.37460448;
    n_list.Add(n);

    if(n>=3 && n<=9){
        double n_floor = Math.Floor(n+0.5); //3~9
        int indx = (int)n_floor-3;

        double dis = Math.Abs(n_floor-n);
        if(dis < 0.1 && last_dis[indx]>dis){
            last_dis[indx]= dis;
            ppi_list[indx]= dppi;
            beta_list[indx]= beta;
        }

    }
}

Beta = beta_list;
ppi = ppi_list;
N = n_list;
# ---------- end c_script_3 ----------
bnd = Bounds(Numbers=c_script_2.all_N)
dedomain = DeconstructDomain(Domain=bnd)  # -> Start, End
c_script_4 = CSharpScript(ppi_list=c_script_2.ppi, max_N=dedomain.End, min_N=dedomain.Start)  # -> out, ppi, n; inputs ppi_list: list of Double, max_N: Double, min_N: Double
# ---------- c_script_4: C# ----------
if(max_N<3){
    n= 3;
    ppi = 92;
}else if(min_N >9){
    n = 9;
    ppi = 399;    
}else{
    for(int i =0; i<ppi_list.Count; i++){
        if(ppi_list[i]!=0){
            ppi = ppi_list[i];
            n = 3+i; // 0~7 + 3 = 3~9
            break;
        }
    }
}
# ---------- end c_script_4 ----------
N = Integer(c_script_4.n)
dppi = Number(c_script_4.ppi)

offset = OffsetCurve(Curve=cir, Distance=D_3, Plane=PlaneXY(0, 0, 0), Corners=1)

# ----
# Inner R
multiplication = Multiplication(A=D_2, B=0.31)

# ----
# Inner circle
cir_2 = Circle(Plane=PlaneXY(0, 0, 0), Radius=multiplication)

# ----
# calculate position of point A & D
c_script_5 = CSharpScript(D=D_2, alpha=alpha, beta=c_script.beta)  # -> out, pointA, pointD; inputs D: Double, alpha: Double, beta: Double
# ---------- c_script_5: C# ----------
    double innerD = 0.62 * D; //inner diameter
    //calculate ther position of point A
    Point3d p = new Point3d();
    p.X = innerD / 2 * Math.Sin(alpha / 2);
    p.Y = -innerD / 2 * Math.Cos(alpha / 2);
    pointA = p;
    //calculate ther position of point D
    double L = innerD * Math.Sin(alpha / 2) / (1 - Math.Cos(beta));
    p.X = p.X - L;
    pointD = p;
# ---------- end c_script_5 ----------

# ----
# G: generate point B
rotate = Rotate(Geometry=c_script_5.pointA, Angle=expr("2*pi/x", N), Plane=PlaneXY(0, 0, 0))  # -> Geometry, Transform

# ----
# Vect_y with length of point D
Y = UnitY(Factor=c_script_5.pointD)

# ----
# point B rotates -alpha
# G: generate point B’’
# Vect_z with length of Height
rotate_2 = Rotate(Geometry=rotate.Geometry, Angle=expr("-x", alpha), Plane=PlaneXY(0, 0, 0))  # -> Geometry, Transform
Z = UnitZ(Factor=H_2)
move = Move(Geometry=rotate_2.Geometry, Motion=Z)  # -> Geometry, Transform

# ----
# 1-mm segment on line a
line = LineSDL(Start=c_script_5.pointD, Direction=Y, Length=1)

# ----
# point B’
rotax = RotateAxis(Geometry=rotate.Geometry, Angle=expr("-x", c_script.beta), Axis=line)  # -> Geometry, Transform

# ----
# intersection points: point E & E’
# point E
clx = CurveLine(Curve=cir, Line=line)  # -> Points, Params, Count
item = ListItem(List=clx.Points, Index=1, Wrap=True)

# ----
# middle point of B’ B’’
avr = Average(Input=[rotax.Geometry, move.Geometry])

# ----
# vector B’’B’
subtraction = Subtraction(A=rotax.Geometry, B=move.Geometry)

# ----
# plane o
lnpt = LinePt(Line=line, Point=rotax.Geometry)

# ----
# plane j
pl = PlaneNormal(Origin=avr, ZAxis=subtraction)

# ----
# line q1
ppx = PlanePlane(PlaneA=lnpt, PlaneB=pl)

# ----
# line q’
rotax_2 = RotateAxis(Geometry=ppx, Angle=c_script.beta, Axis=line)  # -> Geometry, Transform

vec = Vector(rotax_2.Geometry)
updownpercent = ClusterInput()
updownpercent_2 = Number(updownpercent)
relay = ClusterInput()

# ----
# point A
pt = Point(c_script_5.pointA)

# ----
# calculate v and |AK|
c_script_6 = CSharpScript(outerD=D_2, n=N, vec_q=vec, pointA=pt, pointB=rotate.Geometry, pointE=item)  # -> out, AK, pQ, pQ_2, value_v, delta; inputs outerD: Double, n: Double, vec_q: Vector3d, pointA: Point3d, pointB: Point3d, pointE: Point3d
# ---------- c_script_6: C# ----------
double deltaR = outerD/2*(1-0.62);
double theta = 2*Math.PI/n;
//normalize the vector q'; direction is left&up
//Vector3d k_q = vec_q/ Math.Sqrt( Math.Pow(vec_q.X,2) + Math.Pow(vec_q.Y,2) +Math.Pow(vec_q.Z,2))*(-1);
//xielv of line q_
double k_q = vec_q.Y/vec_q.X;
// middile point T of point E & B
Point3d pointT = new Point3d(pointB.X+pointE.X , pointB.Y+pointE.Y, pointB.Z+pointE.Z)/2;
//Vector EB
Vector3d vecEB = new Vector3d(pointB.X-pointE.X , pointB.Y-pointE.Y, pointB.Z-pointE.Z)/2;
// intersecting point of line f2 and x-axis
Point3d pointN = new Point3d(vecEB.Y/vecEB.X*pointT.Y + pointT.X, 0, 0);
// intersecting point of line f2 and line a'
Point3d pointS = new Point3d(pointE.X, (pointT.X-pointE.X)*vecEB.X/vecEB.Y+pointT.Y, 0);

double min_delta =1000; //set a upper limit

double min_AK =0;
// range of v : 0~1
double min_v=0.5;

for(double v=-0.5; v<=50; v+=0.02){
    //point Q: the center of circle
    Point3d pointQ = pointN + v*(pointS-pointN);
    Point3d pointQ_ = new Point3d(Math.Cos(theta)*pointQ.X+Math.Sin(theta)*pointQ.Y, -Math.Sin(theta)*pointQ.X+Math.Cos(theta)*pointQ.Y, 0);
    double Q_r = Math.Sqrt(Math.Pow(pointQ.X - pointB.X, 2)+ Math.Pow(pointQ.Y- pointB.Y,2));

    Vector3d vecQA = new Vector3d(pointA.X - pointQ.X, pointA.Y-pointQ.Y, 0);
    double a = 1+Math.Pow(k_q, 2);
    double b = 2* (vecQA.X+ k_q*vecQA.Y);
    double c = Math.Pow(vecQA.X, 2) + Math.Pow(vecQA.Y, 2)- Math.Pow(Q_r,2);
    double KA_X = (-1*b + Math.Sqrt(Math.Pow(b, 2)-4*a*c))/(2*a);

    double F_y = -Math.Sqrt(Math.Pow(Q_r, 2)- Math.Pow(pointE.X-pointQ_.X, 2))+ pointQ_.Y;

    double dis_AK = Math.Sqrt((Math.Pow(k_q, 2)+1)*Math.Pow(KA_X,2));
    double dis_EF = Math.Sqrt(Math.Pow(F_y-pointE.Y, 2));

    if(min_delta >Math.Abs(dis_AK - dis_EF) ){ //the minimum v
        min_delta = Math.Abs(dis_AK - dis_EF);
        min_v = v;
        min_AK = dis_AK;
    }
}

value_v = min_v;
AK = min_AK;
delta = min_delta;
# ---------- end c_script_6 ----------
panel = Panel(c_script_6.AK)
panel_2 = Panel(c_script_6.delta)
panel_3 = Panel(c_script_6.value_v)

num = Number(c_script_6.AK)

# ----
# list of A points
arrpolar = PolarArray(Geometry=pt, Plane=PlaneXY(0, 0, 0), Count=N, Angle=6.283185307)  # -> Geometry, Transform

# ----
# transform angles
number_slider = Slider(0, range=0..1)
rad = Radians(Degrees=relay)

# ----
# polygon generated by A points
pline = PolyLine(Vertices=arrpolar.Geometry, Closed=True)

# ----
# A: beta/ B: upDown percent
c_script_7 = CSharpScript(beta=c_script.beta, upPercent=updownpercent_2, foldPercent=relay)  # -> out, angle; inputs beta: Double, upPercent: Double, foldPercent: Double
# ---------- c_script_7: C# ----------
double a =0;

if(upPercent != 1){
    a = beta*upPercent;
}else{
    a = beta*upPercent + foldPercent *(Math.PI-beta);
}

if(a <0)
    angle =0;
else if(a>Math.PI)
    angle =Math.PI;
else
    angle =a;
# ---------- end c_script_7 ----------
multiplication_2 = Multiplication(A=c_script.beta, B=updownpercent_2)
num_2 = Number(c_script_7.angle)

amp = Amplitude(Vector=rotax_2.Geometry, Amplitude=expr("-x", num))
inner_r = Number(multiplication)

# ----
# number of arms
num_3 = Number(N)

# ----
# point K
move_2 = Move(Geometry=pt, Motion=amp)  # -> Geometry, Transform

# ----
# arc going through B&K&E
arc = Arc3Pt(PointA=rotate.Geometry, PointB=move_2.Geometry, PointC=item)  # -> Arc, Plane, Radius

# ----
# segment AK on line q’
ln = Line(StartPoint=pt, EndPoint=move_2.Geometry)

# ----
# arc BKE
crv = Curve(arc.Arc)

# ----
# segment AK
line_2 = Line(ln)

# ----
# list of arcs BEK
arrpolar_2 = PolarArray(Geometry=arc.Arc, Plane=PlaneXY(0, 0, 0), Count=N, Angle=6.283185307)  # -> Geometry, Transform

# ----
# arc AF
item_2 = ListItem(List=arrpolar_2.Geometry, Index=-1, Wrap=True)

# ----
# point F
line_3 = LineSDL(Start=item, Direction=line, Length=num)
clx_2 = CurveLine(Curve=item_2, Line=line_3)  # -> Points, Params, Count

# ----
# segment EF on line a
ln_2 = Line(StartPoint=item, EndPoint=clx_2.Points)

# ----
# sub curve BK
# sub curve KE
clx_3 = CurveLine(Curve=crv, Line=line_2)  # -> Points, Params, Count
dedomain_2 = DeconstructDomain(Domain=crv)  # -> Start, End
dom = ConstructDomain(DomainStart=clx_3.Params, DomainEnd=dedomain_2.End)
subcrv = SubCurve(BaseCurve=crv, Domain=dom)
subcrv_2 = SubCurve(BaseCurve=crv, Domain=clx_3.Params)

# ----
# sub curve AF
clx_4 = CurveLine(Curve=item_2, Line=line_3)  # -> Points, Params, Count
dom_2 = ConstructDomain(DomainStart=clx_4.Params, DomainEnd=dedomain_2.End)
subcrv_3 = SubCurve(BaseCurve=item_2, Domain=dom_2)

# ----
# cutting lines
# folding lines
# list of AK & EF
arrpolar_3 = PolarArray(Geometry=[ln, ln_2], Plane=PlaneXY(0, 0, 0), Count=N, Angle=6.283185307)  # -> Geometry, Transform
merge = Merge(Data1=offset, Data2=arrpolar_2.Geometry)
merge_2 = Merge(Data1=pline, Data2=arrpolar_3.Geometry)

# ----
# point E/F
end = EndPoints(Curve=ln_2)  # -> Start, End

subcrv_4 = SubCurve(BaseCurve=item_2, Domain=clx_4.Params)

# ----
# rotation R
ln_3 = Line(StartPoint=pt, EndPoint=end.End)
len = Length(Curve=ln_3)

ln_4 = Line(StartPoint=end.Start, EndPoint=move_2.Geometry)

# ----
# pt: dash/gap lengths
c_script_8 = CSharpScript(dpi=dppi)  # -> out, dash, gap; inputs dpi: Double; same code as c_script_9
dash = DashPattern(Curve=merge_2, Pattern=flatten([c_script_8.dash, c_script_8.gap]))  # -> Dashes, Gaps

pln = Plane(end.End)

# ----
# rotation plane
rot3d = Rotate3D(Geometry=pln, Angle=expr("-x", num_2), Center=end.End, Axis=ln_2)  # -> Geometry, Transform

# ----
# rotation arc
arc_2 = Arc(Plane=rot3d.Geometry, Radius=len, Angle=Domain(0, 1.570796327))  # -> Arc, Length

len_2 = Length(Curve=ln_4)

# ----
# rotation sphere
sph = Sphere(Base=pln, Radius=len)

# ----
# offset cyl
cyl = Cylinder(Base=PlaneXY(0, 0, 0), Radius=inner_r, Length=len)

group = Group(Objects=[dash.Dashes, merge])
ak = Number(num)

# ----
# trace of A’
bbx = BrepBrep(BrepA=cyl, BrepB=sph)  # -> Curves, Points

# ----
# point A’
ccx = CurveCurve(CurveA=bbx.Curves, CurveB=arc_2.Arc)  # -> Points, ParamsA, ParamsB

pl_3pt = Plane3Pt(PointA=end.Start, PointB=end.End, PointC=ccx.Points)
arrpolar_4 = PolarArray(Geometry=ccx.Points, Plane=PlaneXY(0, 0, 0), Count=num_3, Angle=6.283185307)  # -> Geometry, Transform
cir_3 = Circle(Plane=pl_3pt, Radius=len_2)
pln_2 = Plane(ccx.Points)

# ----
# point B’’
item_3 = ListItem(List=arrpolar_4.Geometry, Index=1, Wrap=True)

_2d_pattern = ClusterOutput(group)
sph_2 = Sphere(Base=pln_2, Radius=ak)

# ----
# point K’
bcx = BrepCurve(Brep=sph_2, Curve=cir_3)  # -> Curves, Points
item_4 = ListItem(List=bcx.Points, Index=1, Wrap=True)

pointb = Point(rotate.Geometry)

# ----
# B/K/A
# Rotate_arc BK
pl_3pt_2 = Plane3Pt(PointA=move_2.Geometry, PointB=pointb, PointC=pt)
pl_3pt_3 = Plane3Pt(PointA=item_4, PointB=item_3, PointC=ccx.Points)
orient = Orient(Geometry=subcrv_2, Source=pl_3pt_2, Target=pl_3pt_3)  # -> Geometry, Transform

# ----
# reset the control points of arc BK
cp = ControlPoints(Curve=orient.Geometry)  # -> Points, Weights, Knots
item_5 = ListItem(List=cp.Points, Index=0, Wrap=True)
item_6 = ListItem(List=cp.Points, Index=[1, 2], Wrap=True)
vec2pt = Vector2Pt(PointA=item_5, PointB=item_3, Unitize=False)  # -> Vector, Length
move_3 = Move(Geometry=item_5, Motion=vec2pt.Vector)  # -> Geometry, Transform
nurbs = NurbsCurve(Vertices=[move_3.Geometry, item_6], Degree=2, Periodic=False)  # -> Curve, Length, Domain

pl_3pt_4 = Plane3Pt(PointA=end.End, PointB=pt, PointC=move_2.Geometry)
pl_3pt_5 = Plane3Pt(PointA=end.End, PointB=ccx.Points, PointC=item_4)
pl_3pt_6 = Plane3Pt(PointA=end.Start, PointB=move_2.Geometry, PointC=pt)
pl_3pt_7 = Plane3Pt(PointA=end.Start, PointB=item_4, PointC=ccx.Points)

# ----
# upper arm
ln_5 = Line(StartPoint=ccx.Points, EndPoint=item_4)
rulesrf = RuledSurface(CurveA=nurbs.Curve, CurveB=ln_5)

# ----
# Rotate_arc AF
orient_2 = Orient(Geometry=subcrv_4, Source=pl_3pt_4, Target=pl_3pt_5)  # -> Geometry, Transform

# ----
# F/A/K
# lower arm
# F/A/K’
# Rotate_arc KE
orient_3 = Orient(Geometry=subcrv, Source=pl_3pt_6, Target=pl_3pt_7)  # -> Geometry, Transform
arc_3 = CircularArc(orient_3.Geometry)
arc_4 = CircularArc(orient_2.Geometry)
rulesrf_2 = RuledSurface(CurveA=arc_4, CurveB=arc_3)

# ----
# bottom surfaces
arrpolar_5 = PolarArray(Geometry=[subcrv_3, ln_2], Plane=PlaneXY(0, 0, 0), Count=num_3, Angle=6.283185307)  # -> Geometry, Transform
offset_circle = Circle(offset)
join = JoinCurves(Curves=flatten(arrpolar_5.Geometry), Preserve=False)
boundary = BoundarySurfaces(Edges=flatten([join, offset_circle]))

# ----
# arms
brep = Brep([rulesrf, rulesrf_2])
arrpolar_6 = PolarArray(Geometry=brep, Plane=PlaneXY(0, 0, 0), Count=num_3, Angle=6.283185307)  # -> Geometry, Transform

# ----
# central polygon
pline_2 = PolyLine(Vertices=arrpolar_4.Geometry, Closed=True)
boundary_2 = BoundarySurfaces(Edges=pline_2)

grp = Group([arrpolar_6.Geometry, boundary, boundary_2])
grp_2 = ClusterOutput(grp)

# ==== cluster Cluster_4

res_radius_offset = ClusterInput()
res_beta = ClusterInput()
res_arms = ClusterInput()

wb_diameter = ClusterInput()
wb_outer_circle_offset = ClusterInput()
wb_b = ClusterInput()
force = ClusterInput()

fold_percent = ClusterInput()

# ----
# display-model
list = ValueList({"Model": 0, "Drawings": 1}, selected="Model")
model = Number(list)

# ----
# maximum force
force_max = Number(force)

# ----
# constant: b
b = Number(wb_b)
# diameter
diameter = Number(wb_diameter)

# ----
# calculate x: (R/X=15/2
c_script = CSharpScript(D=diameter)  # -> out, H; inputs D: Double; same code as c_script

X = Number(c_script.H)
dppi = Slider(399, range=92..399)

# ----
# n: 4 —> 10
theta0 = Number(70)
series = Series(Start=4, Step=1, Count=7)

# ----
# radius
innerr = Number(expr("x/2", diameter))

# ----
# constant value: b
rad = Radians(Degrees=b)

rad_2 = Radians(Degrees=theta0)

# ----
# calculate maximum force
c_script_2 = CSharpScript(N=series, theta0=rad_2, b=rad, r=innerr)  # -> out, Alpha, GammaV, Force, Theta; inputs N: Double, theta0: Double, b: Double, r: Double; same code as c_script_2
deg = Degrees(Radians=c_script_2.Theta)
panel = Panel(deg)

# ----
# inner circle
cir = Circle(Plane=PlaneXY(0, 0, 0), Radius=innerr)

end = EndPoints(Curve=cir)  # -> Start, End

# ----
# constant value: b/2
division = Division(A=rad, B=2)

# ----
# calculate proper N & Dppi
c_script_3 = CSharpScript(F=force_max, Force=c_script_2.Force)  # -> out, N, resultF, Dppi; inputs F: Double, Force: list of Double
# ---------- c_script_3: C# ----------
int indx =0;
double properF= 0;

for (int i = 0;i < Force.Count;i++)
{
    if(Math.Abs(F -properF) > Math.Abs(Force[i] -properF)){
        indx = 4+i;
        properF = Force[i];
        
    }
}

N = indx;
resultF= properF;
# ---------- end c_script_3 ----------
N = Number(c_script_3.N)

dppi_2 = Number(dppi)
rotate = Rotate(Geometry=end.Start, Angle=expr("-x", division), Plane=PlaneXY(0, 0, 0))  # -> Geometry, Transform
rotate_2 = Rotate(Geometry=end.Start, Angle=division, Plane=PlaneXY(0, 0, 0))  # -> Geometry, Transform
avr = Average(Input=[rotate_2.Geometry, rotate.Geometry])
pdecon = Deconstruct(Point=avr)  # -> XComponent, YComponent, ZComponent

# ----
# outer circle
# circle: 15/19
# fixed d
# fixed x
eval = Evaluate(F="D/2*(19/15)", D=diameter)
cir_2 = Circle(Plane=PlaneXY(0, 0, 0), Radius=eval)

eval_2 = Evaluate(F="D*sin(b)*1.5", D=diameter, b=division)
pt = ConstructPoint(XCoordinate=pdecon.XComponent, YCoordinate=expr("-x", eval_2), ZCoordinate=pdecon.ZComponent)
pt_2 = ConstructPoint(XCoordinate=pdecon.XComponent, YCoordinate=eval_2, ZCoordinate=pdecon.ZComponent)
X_2 = UnitX(Factor=1)

ln = Line(StartPoint=pt, EndPoint=pt_2)
len = Length(Curve=ln)
line = LineSDL(Start=pt_2, Direction=X_2, Length=len)
line_2 = LineSDL(Start=pt, Direction=X_2, Length=len)
ccx = CurveCurve(CurveA=cir_2, CurveB=line_2)  # -> Points, ParamsA, ParamsB
seam = Seam(Curve=cir_2, Seam=ccx.ParamsA)
ccx_2 = CurveCurve(CurveA=seam, CurveB=line)  # -> Points, ParamsA, ParamsB

remap = RemapNumbers(Value=fold_percent, Source=Domain(0, 2), Target=Domain(0, 1))  # -> Mapped, Clipped
ln_2 = Line(StartPoint=rotate_2.Geometry, EndPoint=rotate.Geometry)
X_3 = UnitX(Factor=X)

# ----
# calculate current theta
# folding range: 70-110
c_script_4 = CSharpScript(foldPer=remap.Mapped, D=diameter)  # -> out, curTheta, curHeight, curSideRotation; inputs foldPer: Double, D: Double; same code as c_script_4

ln_3 = Line(StartPoint=pt, EndPoint=rotate.Geometry)
ln_4 = Line(StartPoint=rotate_2.Geometry, EndPoint=pt_2)
subcrv = SubCurve(BaseCurve=seam, Domain=ccx_2.ParamsA)
ln_5 = Line(StartPoint=pt, EndPoint=ccx.Points)
ln_6 = Line(StartPoint=ccx_2.Points, EndPoint=pt_2)

# ----
# buttom surface
eval_3 = Evaluate(F="2*PI/N-b", N=N, b=division)
dom = ConstructDomain(DomainStart=division, DomainEnd=eval_3)
arc = Arc(Plane=PlaneXY(0, 0, 0), Radius=innerr, Angle=dom)  # -> Arc, Length
addition = Addition(A=eval, B=wb_outer_circle_offset)
merge = Merge(Data1=arc.Arc, Data2=ln_4, Data3=ln_3, Data4=subcrv, Data5=ln_5, Data6=ln_6)  # -> flatten(Result)
arrpolar = PolarArray(Geometry=merge, Plane=PlaneXY(0, 0, 0), Count=N, Angle=6.283185307)  # -> Geometry, Transform
join = JoinCurves(Curves=flatten(arrpolar.Geometry), Preserve=False)
cir_3 = Circle(Plane=PlaneXY(0, 0, 0), Radius=addition)

move = Move(Geometry=ln_2, Motion=X_3)  # -> Geometry, Transform
line_3 = LineSDL(Start=rotate_2.Geometry, Direction=X_2, Length=X_3)
line_4 = LineSDL(Start=rotate.Geometry, Direction=X_2, Length=X_3)

# ----
# R_wb/D_res=15/14
multiplication = Multiplication(A=innerr, B=0.9333333333)

rad_3 = Radians(Degrees=res_beta)

# ----
# side_fixed
boundary = BoundarySurfaces(Edges=flatten([line_3, line_4, move.Geometry, ln_3, ln_4, ln_6, ln_5, subcrv]))

# ----
# remain dis_X
c_script_5 = CSharpScript(D=diameter, theta=c_script_4.curTheta)  # -> out, foldR, remainX, foldH; inputs D: Double, theta: Double; same code as c_script_5

# ----
# curGammaV
c_script_6 = CSharpScript(N=N, theta=c_script_4.curTheta, b=rad)  # -> out, Alpha, GammaV; inputs N: Double, theta: Double, b: Double; same code as c_script_6

diameter_2 = Number(multiplication)
alpha = Alpha(1.047197551)

# ----
# calculate H
c_script_7 = CSharpScript(D=diameter_2, Beta=rad_3, alpha=alpha)  # -> out, H; inputs D: Double, Beta: Double, alpha: Double
# ---------- c_script_7: C# ----------
//calculate the value of beta based on Height
//according to equation (1) in paper
H = (D * Math.Sin(alpha/2) * Math.Sin(Beta)) / (1- Math.Cos(Beta));
# ---------- end c_script_7 ----------

# ----
# Outter circle
cir_4 = Circle(Plane=PlaneXY(0, 0, 0), Radius=expr("x/2", diameter_2))

offset = OffsetCurve(Curve=cir_4, Distance=res_radius_offset, Plane=PlaneXY(0, 0, 0), Corners=1)

# ----
# Inner R
multiplication_2 = Multiplication(A=diameter_2, B=0.31)

X_4 = UnitX(Factor=expr("-x", c_script_5.remainX))

move_2 = Move(Geometry=ln_2, Motion=X_4)  # -> Geometry, Transform
move_3 = Move(Geometry=move.Geometry, Motion=X_4)  # -> Geometry, Transform
rotax = RotateAxis(Geometry=move_3.Geometry, Angle=c_script_4.curSideRotation, Axis=move_2.Geometry)  # -> Geometry, Transform
end_2 = EndPoints(Curve=rotax.Geometry)  # -> Start, End
pdecon_2 = Deconstruct(Point=end_2.Start)  # -> XComponent, YComponent, ZComponent

cyl = Cylinder(Base=ln_2, Radius=line_3, Length=move.Geometry)
yz = YZPlane(Origin=end_2.Start)
sec = BrepPlane(Brep=cyl, Plane=yz)  # -> Curves, Points
item = ListItem(List=sec.Curves, Index=1, Wrap=True)
end_3 = EndPoints(Curve=item)  # -> Start, End
pdecon_3 = Deconstruct(Point=end_3.Start)  # -> XComponent, YComponent, ZComponent

# ----
# Inner circle
cir_5 = Circle(Plane=PlaneXY(0, 0, 0), Radius=multiplication_2)

# ----
# calculate position of point A & D
c_script_8 = CSharpScript(D=diameter_2, alpha=alpha, beta=rad_3)  # -> out, pointA, pointD; inputs D: Double, alpha: Double, beta: Double; same code as c_script_5

# ----
# G: generate point B
rotate_3 = Rotate(Geometry=c_script_8.pointA, Angle=expr("2*pi/x", res_arms), Plane=PlaneXY(0, 0, 0))  # -> Geometry, Transform

subtraction = Subtraction(A=pdecon_3.ZComponent, B=pdecon_2.ZComponent)
c_script_9 = CSharpScript(theta=c_script_4.curTheta, Z=pdecon_2.ZComponent)  # -> out, h; inputs theta: Double, Z: Double; same code as c_script_7
num = Number(subtraction)

# ----
# Vect_y with length of point D
Y = UnitY(Factor=c_script_8.pointD)

addition_2 = Addition(A=c_script_4.curHeight, B=num)

# ----
# point B rotates -alpha
# G: generate point B’’
# Vect_z with length of Height
rotate_4 = Rotate(Geometry=rotate_3.Geometry, Angle=expr("-x", alpha), Plane=PlaneXY(0, 0, 0))  # -> Geometry, Transform
Z = UnitZ(Factor=c_script_7.H)
move_4 = Move(Geometry=rotate_4.Geometry, Motion=Z)  # -> Geometry, Transform

Z_2 = UnitZ(Factor=addition_2)

# ----
# 1-mm segment on line a
line_5 = LineSDL(Start=c_script_8.pointD, Direction=Y, Length=1)

Z_3 = UnitZ(Factor=num)
move_5 = Move(Geometry=rotate.Geometry, Motion=X_4)  # -> Geometry, Transform
move_6 = Move(Geometry=rotate_2.Geometry, Motion=X_4)  # -> Geometry, Transform

# ----
# point B’
rotax_2 = RotateAxis(Geometry=rotate_3.Geometry, Angle=expr("-x", rad_3), Axis=line_5)  # -> Geometry, Transform

# ----
# intersection points: point E & E’
# point E
clx = CurveLine(Curve=cir_4, Line=line_5)  # -> Points, Params, Count
item_2 = ListItem(List=clx.Points, Index=1, Wrap=True)

alpha_2 = Number(c_script_6.Alpha)
move_7 = Move(Geometry=move_5.Geometry, Motion=Z_3)  # -> Geometry, Transform
move_8 = Move(Geometry=move_6.Geometry, Motion=Z_3)  # -> Geometry, Transform
# b_fixed
gammav = Number(c_script_6.GammaV)
move_9 = Move(Geometry=rotax.Geometry, Motion=Z_3)  # -> Geometry, Transform
# N
c_script_10 = CSharpScript(N=N, b=rad)  # -> out, angle; inputs N: Int32, b: Double; same code as c_script_8

# ----
# middle point of B’ B’’
avr_2 = Average(Input=[rotax_2.Geometry, move_4.Geometry])

ln_7 = Line(StartPoint=move_8.Geometry, EndPoint=move_7.Geometry)

# ----
# vector B’’B’
subtraction_2 = Subtraction(A=rotax_2.Geometry, B=move_4.Geometry)

rotate_5 = Rotate(Geometry=move_8.Geometry, Angle=c_script_10.angle, Plane=PlaneXY(0, 0, 0))  # -> Geometry, Transform

# ----
# plane o
lnpt = LinePt(Line=line_5, Point=rotax_2.Geometry)

# ----
# plane j
pl = PlaneNormal(Origin=avr_2, ZAxis=subtraction_2)

xz = XZPlane(Origin=Point(0, 0, 0))
addition_3 = Addition(A=alpha_2, B=rad)
lnpt_2 = LinePt(Line=item, Point=pt_2)
lnpt_3 = LinePt(Line=move.Geometry, Point=pt_2)

# ----
# line q1
ppx = PlanePlane(PlaneA=lnpt, PlaneB=pl)

rotate_6 = Rotate(Geometry=xz, Angle=addition_3, Plane=PlaneXY(0, 0, 0))  # -> Geometry, Transform

# ----
# side_folded
rulesrf = RuledSurface(CurveA=ln_7, CurveB=item)
orient = Orient(Geometry=boundary, Source=lnpt_3, Target=lnpt_2)  # -> Geometry, Transform

# ----
# line q’
rotax_3 = RotateAxis(Geometry=ppx, Angle=rad_3, Axis=line_5)  # -> Geometry, Transform

vec = Vector(rotax_3.Geometry)

# ----
# point A
pt_3 = Point(c_script_8.pointA)

# ----
# calculate v and |AK|
c_script_11 = CSharpScript(outerD=diameter_2, n=res_arms, vec_q=vec, pointA=pt_3, pointB=rotate_3.Geometry, pointE=item_2)  # -> out, AK, pQ, pQ_2, value_v, delta; inputs outerD: Double, n: Double, vec_q: Vector3d, pointA: Point3d, pointB: Point3d, pointE: Point3d
# ---------- c_script_11: C# ----------
double deltaR = outerD/2*(1-0.62);
double theta = 2*Math.PI/n;
//normalize the vector q'; direction is left&up
//Vector3d k_q = vec_q/ Math.Sqrt( Math.Pow(vec_q.X,2) + Math.Pow(vec_q.Y,2) +Math.Pow(vec_q.Z,2))*(-1);
//xielv of line q_
double k_q = vec_q.Y/vec_q.X;
// middile point T of point E & B
Point3d pointT = new Point3d(pointB.X+pointE.X , pointB.Y+pointE.Y, pointB.Z+pointE.Z)/2;
//Vector EB
Vector3d vecEB = new Vector3d(pointB.X-pointE.X , pointB.Y-pointE.Y, pointB.Z-pointE.Z)/2;
// intersecting point of line f2 and x-axis
Point3d pointN = new Point3d(vecEB.Y/vecEB.X*pointT.Y + pointT.X, 0, 0);
// intersecting point of line f2 and line a'
Point3d pointS = new Point3d(pointE.X, (pointT.X-pointE.X)*vecEB.X/vecEB.Y+pointT.Y, 0);

double min_delta =1000; //set a upper limit
double min_AK =0;
// range of v : 0~1
double min_v=0.5;

for(double v=0; v<=50; v+=0.01){
    //point Q: the center of circle
    Point3d pointQ = pointN + v*(pointS-pointN);
    Point3d pointQ_ = new Point3d(Math.Cos(theta)*pointQ.X+Math.Sin(theta)*pointQ.Y, -Math.Sin(theta)*pointQ.X+Math.Cos(theta)*pointQ.Y, 0);
    double Q_r = Math.Sqrt(Math.Pow(pointQ.X - pointB.X, 2)+ Math.Pow(pointQ.Y- pointB.Y,2));

    Vector3d vecQA = new Vector3d(pointA.X - pointQ.X, pointA.Y-pointQ.Y, 0);
    double a = 1+Math.Pow(k_q, 2);
    double b = 2* (vecQA.X+ k_q*vecQA.Y);
    double c = Math.Pow(vecQA.X, 2) + Math.Pow(vecQA.Y, 2)- Math.Pow(Q_r,2);
    double KA_X = (-1*b + Math.Sqrt(Math.Pow(b, 2)-4*a*c))/(2*a);

    double F_y = -Math.Sqrt(Math.Pow(Q_r, 2)- Math.Pow(pointE.X-pointQ_.X, 2))+ pointQ_.Y;

    double dis_AK = Math.Sqrt((Math.Pow(k_q, 2)+1)*Math.Pow(KA_X,2));
    double dis_EF = Math.Sqrt(Math.Pow(F_y-pointE.Y, 2));

    if(min_delta >Math.Abs(dis_AK - dis_EF) ){ //the minimum v
        min_delta = Math.Abs(dis_AK - dis_EF);
        min_v = v;
        min_AK = dis_AK;
    }
}

value_v = min_v;
AK = min_AK;
delta = min_delta;
# ---------- end c_script_11 ----------
panel_2 = Panel(c_script_11.AK)
panel_3 = Panel(c_script_11.value_v)

boundary_2 = BoundarySurfaces(Edges=flatten([join, cir_3]))
num_2 = Number(c_script_11.AK)

# ----
# list of A points
arrpolar_2 = PolarArray(Geometry=pt_3, Plane=PlaneXY(0, 0, 0), Count=res_arms, Angle=6.283185307)  # -> Geometry, Transform

amp = Amplitude(Vector=rotax_3.Geometry, Amplitude=expr("-x", num_2))
inner_r = Number(multiplication_2)
cyl_2 = Cylinder(Base=PlaneXY(0, 0, 0), Radius=inner_r, Length=innerr)

# ----
# number of arms
num_3 = Number(res_arms)

# ----
# polygon generated by A points
pline = PolyLine(Vertices=arrpolar_2.Geometry, Closed=True)

dppi_3 = Number(c_script_3.Dppi)

# ----
# point K
move_10 = Move(Geometry=pt_3, Motion=amp)  # -> Geometry, Transform

# ----
# segment AK on line q’
ln_8 = Line(StartPoint=pt_3, EndPoint=move_10.Geometry)

# ----
# arc going through B&K&E
arc_2 = Arc3Pt(PointA=rotate_3.Geometry, PointB=move_10.Geometry, PointC=item_2)  # -> Arc, Plane, Radius

# ----
# arc BKE
crv = Curve(arc_2.Arc)

# ----
# segment AK
line_6 = Line(ln_8)

# ----
# list of arcs BEK
arrpolar_3 = PolarArray(Geometry=arc_2.Arc, Plane=PlaneXY(0, 0, 0), Count=res_arms, Angle=6.283185307)  # -> Geometry, Transform

# ----
# arc AF
item_3 = ListItem(List=arrpolar_3.Geometry, Index=-1, Wrap=True)

# ----
# point F
line_7 = LineSDL(Start=item_2, Direction=line_5, Length=num_2)
clx_2 = CurveLine(Curve=item_3, Line=line_7)  # -> Points, Params, Count

# ----
# segment EF on line a
ln_9 = Line(StartPoint=item_2, EndPoint=clx_2.Points)

# ----
# sub curve BK
# sub curve KE
clx_3 = CurveLine(Curve=crv, Line=line_6)  # -> Points, Params, Count
dedomain = DeconstructDomain(Domain=crv)  # -> Start, End
dom_2 = ConstructDomain(DomainStart=clx_3.Params, DomainEnd=dedomain.End)
subcrv_2 = SubCurve(BaseCurve=crv, Domain=dom_2)
subcrv_3 = SubCurve(BaseCurve=crv, Domain=clx_3.Params)

# ----
# sub curve AF
clx_4 = CurveLine(Curve=item_3, Line=line_7)  # -> Points, Params, Count
dom_3 = ConstructDomain(DomainStart=clx_4.Params, DomainEnd=dedomain.End)
subcrv_4 = SubCurve(BaseCurve=item_3, Domain=dom_3)

# ----
# point E/F
end_4 = EndPoints(Curve=ln_9)  # -> Start, End

subcrv_5 = SubCurve(BaseCurve=item_3, Domain=clx_4.Params)

# ----
# rotation R
ln_10 = Line(StartPoint=pt_3, EndPoint=end_4.End)
len_2 = Length(Curve=ln_10)

ln_11 = Line(StartPoint=end_4.Start, EndPoint=move_10.Geometry)
pln = Plane(end_4.End)
len_3 = Length(Curve=ln_11)

# ----
# rotation sphere
sph = Sphere(Base=pln, Radius=len_2)

# ----
# offset cyl
cyl_3 = Cylinder(Base=PlaneXY(0, 0, 0), Radius=inner_r, Length=len_2)

ak = Number(num_2)

# ----
# trace of A’
bbx = BrepBrep(BrepA=cyl_3, BrepB=sph)  # -> Curves, Points

pointb = Point(rotate_3.Geometry)

# ----
# bottom surfaces
arrpolar_4 = PolarArray(Geometry=[subcrv_4, ln_9], Plane=PlaneXY(0, 0, 0), Count=num_3, Angle=6.283185307)  # -> Geometry, Transform
offset_circle = Circle(offset)
join_2 = JoinCurves(Curves=flatten(arrpolar_4.Geometry), Preserve=False)
boundary_3 = BoundarySurfaces(Edges=flatten([join_2, offset_circle]))

xy = XYPlane(Origin=Point(0, 0, 0))
ln_12 = Line(StartPoint=rotate_2.Geometry, EndPoint=xy)
ln_13 = Line(StartPoint=rotate.Geometry, EndPoint=xy)

# ---- group: valleyFold
merge_2 = Merge(Data1=ln_13, Data2=ln_12)

# ----
boundary_4 = BoundarySurfaces(Edges=[merge_2, ln_2])

move_11 = Move(Geometry=xy, Motion=Z_2)  # -> Geometry, Transform
ln_14 = Line(StartPoint=move_7.Geometry, EndPoint=move_11.Geometry)
ln_15 = Line(StartPoint=move_8.Geometry, EndPoint=move_11.Geometry)
boundary_5 = BoundarySurfaces(Edges=flatten([ln_7, ln_14, ln_15]))
bbx_2 = BrepBrep(BrepA=boundary_5, BrepB=cyl_2)  # -> Curves, Points
end_5 = EndPoints(Curve=bbx_2.Curves)  # -> Start, End
devec = DeconstructVector(Vector=end_5.Start)  # -> XComponent, YComponent, ZComponent
pl_3pt = Plane3Pt(PointA=move_11.Geometry, PointB=move_8.Geometry, PointC=rotate_5.Geometry)

# ----
# calculate cur Beta
c_script_12 = CSharpScript(D=diameter_2, H=devec.ZComponent, AK=c_script_11.AK, iniH=c_script_7.H, iniBeta=rad_3, alpha=alpha)  # -> out, curBeta; inputs D: Double, H: Double, AK: Double, iniH: Double, iniBeta: Double, alpha: Double
# ---------- c_script_12: C# ----------
//calculate the value of beta based on Height
//according to equation (1) in paper

double beta = 2 * Math.Atan(D*0.62 * 0.5 / H);

if (beta < iniBeta){
    beta = iniBeta;
}else if (beta > Math.PI){
    beta = Math.PI;
}

double foldPer = beta/Math.PI;
double offset = AK*Math.Sin(Math.PI*foldPer)*Math.Cos(-alpha/2);


/*
double b = Math.PI*foldPer;
double a = alpha*foldPer;

double phi = Math.Atan(Math.Sin(a)/Math.Tan(Math.PI/2- b));
double offset = AK*Math.Sin(phi);
*/

if (offset<0)
    offset =0;
H = H - offset;

if(H < 0){
    H=0;
}
//new beta
beta = 2 * Math.Atan(D*0.62 * 0.5 / H);

if (beta < iniBeta){
    curBeta = iniBeta;
}else{
    curBeta = beta;
}
# ---------- end c_script_12 ----------

arc_3 = Arc(Plane=pl_3pt, Radius=innerr, Angle=c_script_10.angle)  # -> Arc, Length
end_6 = EndPoints(Curve=arc_3.Arc)  # -> Start, End
ln_16 = Line(StartPoint=move_11.Geometry, EndPoint=end_6.End)
rotax_4 = RotateAxis(Geometry=end_6.End, Angle=expr("-x", gammav), Axis=ln_15)  # -> Geometry, Transform
mirror = Mirror(Geometry=rotax_4.Geometry, Plane=rotate_6.Geometry)  # -> Geometry, Transform
rotax_5 = RotateAxis(Geometry=arc_3.Arc, Angle=expr("-x", gammav), Axis=ln_15)  # -> Geometry, Transform
rotax_6 = RotateAxis(Geometry=ln_16, Angle=expr("-x", gammav), Axis=ln_15)  # -> Geometry, Transform
vec2pt = Vector2Pt(PointA=move_11.Geometry, PointB=rotax_4.Geometry, Unitize=False)  # -> Vector, Length
vec2pt_2 = Vector2Pt(PointA=move_11.Geometry, PointB=mirror.Geometry, Unitize=False)  # -> Vector, Length
mirror_2 = Mirror(Geometry=rotax_6.Geometry, Plane=rotate_6.Geometry)  # -> Geometry, Transform
pl_3pt_2 = Plane3Pt(PointA=move_11.Geometry, PointB=rotax_4.Geometry, PointC=mirror.Geometry)
angle = Angle(VectorA=vec2pt.Vector, VectorB=vec2pt_2.Vector)  # -> Angle, Reflex
arc_4 = Arc(Plane=pl_3pt_2, Radius=innerr, Angle=angle.Angle)  # -> Arc, Length

boundary_6 = BoundarySurfaces(Edges=flatten([rotax_5.Geometry, rotax_6.Geometry, ln_15]))
boundary_7 = BoundarySurfaces(Edges=flatten([rotax_6.Geometry, arc_4.Arc, mirror_2.Geometry]))
mirror_3 = Mirror(Geometry=boundary_6, Plane=rotate_6.Geometry)  # -> Geometry, Transform

group = Group(Objects=[boundary_6, mirror_3.Geometry, boundary_5, rulesrf, orient.Geometry, boundary_7])
arrpolar_5 = PolarArray(Geometry=group, Plane=PlaneXY(0, 0, 0), Count=N, Angle=6.283185307)  # -> Geometry, Transform
group_2 = Group(Objects=flatten([arrpolar_5.Geometry, boundary_2]))

# ----
# A: beta/ B: upDown percent
num_4 = Number(c_script_12.curBeta)

filter = StreamFilter(Gate=model, Stream0=group_2)

# ----
# rotation plane
rot3d = Rotate3D(Geometry=pln, Angle=expr("-x", num_4), Center=end_4.End, Axis=ln_9)  # -> Geometry, Transform

# ----
# rotation arc
arc_5 = Arc(Plane=rot3d.Geometry, Radius=len_2, Angle=Domain(0, 1.570796327))  # -> Arc, Length

# ----
# point A’
ccx_3 = CurveCurve(CurveA=bbx.Curves, CurveB=arc_5.Arc)  # -> Points, ParamsA, ParamsB

pl_3pt_3 = Plane3Pt(PointA=end_4.Start, PointB=end_4.End, PointC=ccx_3.Points)
arrpolar_6 = PolarArray(Geometry=ccx_3.Points, Plane=PlaneXY(0, 0, 0), Count=num_3, Angle=6.283185307)  # -> Geometry, Transform
cir_6 = Circle(Plane=pl_3pt_3, Radius=len_3)
pln_2 = Plane(ccx_3.Points)

# ----
# point B’’
item_4 = ListItem(List=arrpolar_6.Geometry, Index=1, Wrap=True)

sph_2 = Sphere(Base=pln_2, Radius=ak)

# ----
# point K’
bcx = BrepCurve(Brep=sph_2, Curve=cir_6)  # -> Curves, Points
item_5 = ListItem(List=bcx.Points, Index=1, Wrap=True)

pdecon_4 = Deconstruct(Point=item_5)  # -> XComponent, YComponent, ZComponent
c_script_13 = CSharpScript(x=pdecon_4.XComponent, y=pdecon_4.YComponent)  # -> out, A; inputs x: Double, y: Double
# ---------- c_script_13: C# ----------
A = Math.Sqrt(x*x + y*y);
# ---------- end c_script_13 ----------
cyl_4 = Cylinder(Base=PlaneXY(0, 0, 0), Radius=c_script_13.A, Length=1)

# ----
# B/K/A
# Rotate_arc BK
pl_3pt_4 = Plane3Pt(PointA=move_10.Geometry, PointB=pointb, PointC=pt_3)
pl_3pt_5 = Plane3Pt(PointA=item_5, PointB=item_4, PointC=ccx_3.Points)
orient_2 = Orient(Geometry=subcrv_3, Source=pl_3pt_4, Target=pl_3pt_5)  # -> Geometry, Transform

# ----
# reset the control points of arc BK
cp = ControlPoints(Curve=orient_2.Geometry)  # -> Points, Weights, Knots
item_6 = ListItem(List=cp.Points, Index=0, Wrap=True)
item_7 = ListItem(List=cp.Points, Index=[1, 2], Wrap=True)
vec2pt_3 = Vector2Pt(PointA=item_6, PointB=item_4, Unitize=False)  # -> Vector, Length
move_12 = Move(Geometry=item_6, Motion=vec2pt_3.Vector)  # -> Geometry, Transform
nurbs = NurbsCurve(Vertices=[move_12.Geometry, item_7], Degree=2, Periodic=False)  # -> Curve, Length, Domain

pl_3pt_6 = Plane3Pt(PointA=end_4.End, PointB=pt_3, PointC=move_10.Geometry)
pl_3pt_7 = Plane3Pt(PointA=end_4.End, PointB=ccx_3.Points, PointC=item_5)
pl_3pt_8 = Plane3Pt(PointA=end_4.Start, PointB=move_10.Geometry, PointC=pt_3)
pl_3pt_9 = Plane3Pt(PointA=end_4.Start, PointB=item_5, PointC=ccx_3.Points)

# ----
# upper arm
ln_17 = Line(StartPoint=ccx_3.Points, EndPoint=item_5)
rulesrf_2 = RuledSurface(CurveA=nurbs.Curve, CurveB=ln_17)

# ----
# Rotate_arc AF
orient_3 = Orient(Geometry=subcrv_5, Source=pl_3pt_6, Target=pl_3pt_7)  # -> Geometry, Transform

# ----
# F/A/K
# lower arm
# F/A/K’
# Rotate_arc KE
orient_4 = Orient(Geometry=subcrv_2, Source=pl_3pt_8, Target=pl_3pt_9)  # -> Geometry, Transform
arc_6 = CircularArc(orient_4.Geometry)
arc_7 = CircularArc(orient_3.Geometry)
rulesrf_3 = RuledSurface(CurveA=arc_7, CurveB=arc_6)

# ----
# arms
brep = Brep([rulesrf_2, rulesrf_3])
arrpolar_7 = PolarArray(Geometry=brep, Plane=PlaneXY(0, 0, 0), Count=num_3, Angle=6.283185307)  # -> Geometry, Transform

# ----
# central polygon
pline_2 = PolyLine(Vertices=arrpolar_6.Geometry, Closed=True)
boundary_8 = BoundarySurfaces(Edges=pline_2)

_2d_water_bomb = ClusterOutput(group_2)
_3d_water_bomb = ClusterOutput(filter)
grp = Group([arrpolar_7.Geometry, boundary_3, boundary_8])
_3d_res = ClusterOutput(grp)
_2d_res = ClusterOutput(boundary_8)
