# Grasshopper definition PatternGenerator_for_ShapeDiver.gh (Grasshopper 1.0.7)
# plug-ins: ShapeDiver

# res
maximum_reaction_force = Slider(2.808, range=2.36..7.52)
diameter = Slider(14, range=14..26)
height_under_stable_status = Slider(2.777, range=1.16..4.653)
stiffness_coefficient = Slider(1, range=0.5..2)
display_mode = ValueList({"3D Simulation": 0, "2D Pattern": 1, "None": 2}, selected="3D Simulation")
display_mode_2 = ValueList({"3D Simulation": 0, "2D Pattern": 1}, selected="3D Simulation")  # disabled

buttom_offset = Slider(5, range=0..10)
fold_percent = Slider(1, range=0..1)
transiton = Slider(0, range=0..1)

download_format = ValueList({"3DM": 0, "DXF": 1, "DWG": 2, "PNG": 3, "JPG": 4}, selected="3DM")
maximum_reaction_force_2 = Slider(33.583, range=0.2..50)
diameter_2 = Slider(31, range=20..60)
bottom_offset = Slider(16, range=1..50)
transition = Slider(0, range=0..1)
display_mode_3 = ValueList({"3D Simulation": 0, "2D Pattern": 1, "None": 2}, selected="3D Simulation")
res_buttom_offset = Slider(3, range=0..10)

maximum_reaction_force_3 = Slider(13.696, range=0.2..50)
diameter_3 = Slider(39, range=20..60)

res_arms = Slider(5, range=3..9)
res_beta = Slider(120, range=120..150)
display_mode_4 = ValueList({"3D Simulation": 0, "2D Pattern": 1, "None": 2}, selected="3D Simulation")
sfwb_buttom_offset = Slider(16, range=1..50)
transition_2 = Slider(0, range=0..1)
stiffness_coefficient_2 = Slider(1, range=0.5..2)
res_dppi = Slider(92, range=92..399)
stiffness_coefficient_3 = Slider(1, range=0.5..2)
download_format_2 = ValueList({"3DM": 0, "DXF": 1, "DWG": 2, "PNG": 3, "JPG": 4}, selected="3DM")
download_format_3 = ValueList({"3DM": 0, "DXF": 1, "DWG": 2, "PNG": 3, "JPG": 4}, selected="DXF")
units_n_umber = Slider(2, range=1..8)
transition_3 = Slider(0, range=0..1)
material_stiffness = Slider(0.001, range=0.001..0.03)
maximum_reaction_force_4 = Slider(0.5, range=0.5..100)
diameter_4 = Slider(30, range=30..50)
display_mode_5 = ValueList({"3D Simulation": 0, "2D Pattern": 1, "None": 2}, selected="3D Simulation")
download_format_4 = ValueList({"3DM": 0, "DXF": 1, "DWG": 2, "PNG": 3, "JPG": 4}, selected="3DM")
cluster = Cluster(
    max_force=maximum_reaction_force,
    diameter=diameter,
    height=height_under_stable_status,
    stiffness_coe=stiffness_coefficient,
    buttom_offset=buttom_offset,
    fold_percent=fold_percent,
    transition=transiton)  # -> _3d_geometry, cuts, folds, withintreshold_2
cluster_2 = Cluster_3(
    max_force=maximum_reaction_force_3,
    diameter=diameter_3,
    stiffness_coe=stiffness_coefficient_2,
    buttttom_offset=sfwb_buttom_offset,
    res_buttom_offset=res_buttom_offset,
    res_arms=res_arms,
    res_beta=res_beta,
    res_dppi=res_dppi,
    transition=transition_2)  # -> sfwb_3d, res_3d, sfwb_cuts, sfwb_folds, res_cuts, res_folds, withinthreshold
cluster_3 = Cluster_4(
    max_force=maximum_reaction_force_4,
    diameter=diameter_4,
    stiffness=material_stiffness,
    units=units_n_umber,
    transition=transition_3)  # -> _3d_top_buttom, _3d_sides, cuts, folds, withinthreshold
cluster_4 = Cluster_2(
    force=maximum_reaction_force_2,
    diameter=diameter_2,
    stiffness_coe=stiffness_coefficient_3,
    offset=bottom_offset,
    transition=transition)  # -> _3d_geometry, cuts, folds, withinthreshold

folds = ColourSwatch(SwatchColor=RGB(109, 110, 113))
cuts = ColourSwatch(SwatchColor=RGB(209, 93, 98))
cuts_2 = ColourSwatch(SwatchColor=RGB(57, 118, 230))
folds_2 = ColourSwatch(SwatchColor=RGB(0, 0, 0))
_3d_simulation = ColourSwatch(SwatchColor=RGB(57, 118, 230))
_3d_simulation_2 = ColourSwatch(SwatchColor=RGB(109, 110, 113))
merge = Merge(Data1=cuts, Data2=folds)
merge_2 = Merge(Data1=cuts_2, Data2=folds_2)
filter = StreamFilter(Gate=cluster.withintreshold_2, Stream0=_3d_simulation, Stream1=_3d_simulation_2)
filter_2 = StreamFilter(Gate=cluster.withintreshold_2, Stream0=merge_2, Stream1=merge)

folds_3 = ColourSwatch(SwatchColor=RGB(109, 110, 113))
cuts_3 = ColourSwatch(SwatchColor=RGB(209, 93, 98))
cuts_4 = ColourSwatch(SwatchColor=RGB(57, 118, 230))
folds_4 = ColourSwatch(SwatchColor=RGB(0, 0, 0))
_3d_simulation_3 = ColourSwatch(SwatchColor=RGB(57, 118, 230))
_3d_simulation_4 = ColourSwatch(SwatchColor=RGB(109, 110, 113))
merge_3 = Merge(Data1=cuts_3, Data2=folds_3)
merge_4 = Merge(Data1=cuts_4, Data2=folds_4)
filter_3 = StreamFilter(Gate=cluster_4.withinthreshold, Stream0=_3d_simulation_3, Stream1=_3d_simulation_4)
filter_4 = StreamFilter(Gate=cluster_4.withinthreshold, Stream0=merge_4, Stream1=merge_3)

model = Integer(display_mode)
entwine = Entwine(Branch00=cluster.cuts, Branch01=cluster.folds, FlattenInputs=True)
filter_5 = StreamFilter(Gate=model, Stream0=cluster._3d_geometry, Stream1=entwine)
filter_6 = StreamFilter(Gate=model, Stream0=filter, Stream1=filter_2)
sddisplaygeometry = ShapeDiverDisplayGeometry(Geometry=filter_5, ShapeDiverMaterial=filter_6)

sfwb_3d = ColourSwatch(SwatchColor=RGB(156, 157, 163))
res_3d = ColourSwatch(SwatchColor=RGB(109, 110, 113))
folds_5 = ColourSwatch(SwatchColor=RGB(109, 110, 113))
cuts_5 = ColourSwatch(SwatchColor=RGB(209, 93, 98))
_3d_top = ColourSwatch(SwatchColor=RGB(142, 171, 230))
_3d_sides = ColourSwatch(SwatchColor=RGB(57, 118, 230))
cuts_6 = ColourSwatch(SwatchColor=RGB(57, 118, 230))
folds_6 = ColourSwatch(SwatchColor=RGB(0, 0, 0))
merge_5 = Merge(Data1=cuts_5, Data2=folds_5)
merge_6 = Merge(Data1=cuts_6, Data2=folds_6)
merge_7 = Merge(Data1=_3d_top, Data2=_3d_sides)
merge_8 = Merge(Data1=sfwb_3d, Data2=res_3d)
filter_7 = StreamFilter(Gate=cluster_3.withinthreshold, Stream0=merge_6, Stream1=merge_5)
filter_8 = StreamFilter(Gate=cluster_3.withinthreshold, Stream0=merge_7, Stream1=merge_8)

model_2 = Integer(display_mode_5)
filter_9 = StreamFilter(Gate=download_format, Stream0="3dm", Stream1="dxf", Stream2="dwg", Stream3="png", Stream4="jpg")

model_3 = Integer(display_mode_3)
entwine_2 = Entwine(Branch00=cluster_4.cuts, Branch01=cluster_4.folds, FlattenInputs=True)
filter_10 = StreamFilter(Gate=model_3, Stream0=cluster_4._3d_geometry, Stream1=entwine_2)
filter_11 = StreamFilter(Gate=model_3, Stream0=filter_3, Stream1=filter_4)
sddisplaygeometry_2 = ShapeDiverDisplayGeometry(Geometry=filter_10, ShapeDiverMaterial=filter_11)

filter_12 = StreamFilter(Gate=model, Stream0="SFWB_RES_3D_Model", Stream1="SFWB_RES_2D_Pattern")
# cylinder
panel = Panel("jpg")

sfwb_3d_2 = ColourSwatch(SwatchColor=RGBA(109, 110, 113, 150))
res_3d_2 = ColourSwatch(SwatchColor=RGB(109, 110, 113))
sfwb_3d_3 = ColourSwatch(SwatchColor=RGBA(57, 118, 230, 150))
res_3d_3 = ColourSwatch(SwatchColor=RGB(57, 118, 230))
folds_7 = ColourSwatch(SwatchColor=RGB(109, 110, 113))
cuts_7 = ColourSwatch(SwatchColor=RGB(209, 93, 98))
cuts_8 = ColourSwatch(SwatchColor=RGB(57, 118, 230))
folds_8 = ColourSwatch(SwatchColor=RGB(0, 0, 0))
merge_9 = Merge(Data1=cuts_7, Data2=folds_7)
merge_10 = Merge(Data1=cuts_8, Data2=folds_8)
merge_11 = Merge(Data1=sfwb_3d_2, Data2=res_3d_2)
merge_12 = Merge(Data1=sfwb_3d_3, Data2=res_3d_3)
filter_13 = StreamFilter(Gate=cluster_2.withinthreshold, Stream0=merge_10, Stream1=merge_9)
filter_14 = StreamFilter(Gate=cluster_2.withinthreshold, Stream0=merge_12, Stream1=merge_11)

entwine_3 = Entwine(Branch00=cluster_3.cuts, Branch01=cluster_3.folds, FlattenInputs=True)
entwine_4 = Entwine(Branch00=cluster_3._3d_top_buttom, Branch01=cluster_3._3d_sides, FlattenInputs=True)
filter_15 = StreamFilter(Gate=model_2, Stream0=filter_8, Stream1=filter_7)
filter_16 = StreamFilter(Gate=model_2, Stream0=entwine_4, Stream1=entwine_3)
sddisplaygeometry_3 = ShapeDiverDisplayGeometry(Geometry=filter_16, ShapeDiverMaterial=filter_15)

filter_17 = StreamFilter(Gate=download_format_4, Stream0="3dm", Stream1="dxf", Stream2="dwg", Stream3="png", Stream4=panel)
sdexportdownload = ShapeDiverExportDownload(Geometry=filter_5, Format=filter_9, Name=filter_12)
filter_18 = StreamFilter(Gate=model_3, Stream0="SFWB_RES_3D_Model", Stream1="SFWB_RES_2D_Pattern")
filter_19 = StreamFilter(Gate=download_format_2, Stream0="3dm", Stream1="dxf", Stream2="dwg", Stream3="png", Stream4="jpg")
# inner circle
# radius
# diameter
# constant value: b/2
# constant value: b
# calculate maximum force
# calculate x: (R/X=15/2
panel_2 = Panel("SFWB_RES_2D_Pattern")
filter_20 = StreamFilter(Gate=model_2, Stream0="SFWB_RES_3D_Model", Stream1=panel_2)
mode = Number(display_mode_4)
sdexportdownload_2 = ShapeDiverExportDownload(Geometry=filter_10, Format=filter_19, Name=filter_18)

entwine_5 = Entwine(Branch00=cluster_2.sfwb_3d, Branch01=cluster_2.res_3d, FlattenInputs=True)
entwine_6 = Entwine(
    Branch00=[cluster_2.sfwb_cuts, cluster_2.res_cuts],
    Branch01=[cluster_2.sfwb_folds, cluster_2.res_folds],
    FlattenInputs=True)
filter_21 = StreamFilter(Gate=mode, Stream0=entwine_5, Stream1=entwine_6)
filter_22 = StreamFilter(Gate=mode, Stream0=filter_14, Stream1=filter_13)
# cutting lines
# folding lines
# list of AK & EF
sddisplaygeometry_4 = ShapeDiverDisplayGeometry(Geometry=filter_21, ShapeDiverMaterial=filter_22)

filter_23 = StreamFilter(Gate=download_format_3, Stream0="3dm", Stream1="dxf", Stream2="dwg", Stream3="png", Stream4="jpg")
filter_24 = StreamFilter(Gate=mode, Stream0="SFWB_RES_3D_Model", Stream1="SFWB_RES_2D_Pattern")
# remain dis_X
# calculate current theta
# folding range: 70-110
# curGammaV
# side_folded
# constant: b
# outer circle
# circle: 15/19
# side_fixed
# fixed d
# N
# b_fixed
# fixed x
# calculate cur Beta
# R_wb/D_res=15/14
# point A
# intersection points: point E & E’
# point E
# Outter circle
# polygon generated by A points
# list of A points
# 1-mm segment on line a
# Inner circle
# Inner R
# segment AK on line q’
# plane o
# calculate H
# list of arcs BEK
# point B’
# Vect_y with length of point D
# calculate position of point A & D
# arc going through B&K&E
# middle point of B’ B’’
# G: generate point B
# line q1
# line q’
# point K
# plane j
# vector B’’B’
# point B rotates -alpha
# G: generate point B’’
# calculate v and |AK|
# Vect_z with length of Height
# point F
# arc AF
# arc BKE
# segment AK
# A: beta/ B: upDown percent
# number of arms
sdexportdownload_3 = ShapeDiverExportDownload(Geometry=filter_16, Format=filter_17, Name=filter_20)
sdexportdownload_4 = ShapeDiverExportDownload(Geometry=filter_21, Format=filter_23, Name=filter_24)

# ==== cluster Cluster
fold_percent = ClusterInput()
stiffness_coe = ClusterInput()
buttom_offset = ClusterInput()
diameter = ClusterInput()
transition = ClusterInput()
max_force = ClusterInput()
height = ClusterInput()

# ---- group: range of part inputs
max_beta = Number(150)
min_dppi = Integer(92)
min_beta = Number(120)
min_d = Integer(14)
max_dppi = Integer(399)
max_n = Integer(9)
max_d = Integer(26)
min_n = Integer(3)

# ----
alpha = Alpha(1.047197551)

# ---- group: range of force
c_script = CSharpScript(
    maxN=max_n,
    minN=min_n,
    maxD=max_d,
    minD=min_d,
    maxDppi=max_dppi,
    minDppi=min_dppi,
    maxBeta=max_beta,
    minBeta=min_beta,
    TooltipTextOverride="range of force")  # -> out, maxForce, minForce; inputs maxN: Int32, minN: Int32, maxD: Int32, minD: Int32, maxDppi: Int32, minDppi: Int32, maxBeta: Double, minBeta: Double
# ---------- c_script: C# ----------
//F = 0.37460448 * N + 0.07150102 * D + 0.01259251 * Beta - 0.005434 * PPI + 0.90218455

maxForce = 0.37460448 * maxN + 0.07150102 * maxD + 0.01259251 * maxBeta - 0.005434 * minDppi + 0.90218455;
minForce = 0.37460448 * minN + 0.07150102 * minD + 0.01259251 * minBeta - 0.005434 * maxDppi + 0.90218455;
# ---------- end c_script ----------
panel = Panel(c_script.maxForce)
panel_2 = Panel(c_script.minForce)

# ----
c_script_2 = CSharpScript(
    Force=max_force,
    maxN=max_n,
    minN=min_n,
    maxD=max_d,
    minD=min_d,
    maxDppi=max_dppi,
    minDppi=min_dppi,
    maxBeta=max_beta,
    minBeta=min_beta,
    TooltipTextOverride="range of force")  # -> out, A, B; inputs Force: Double, maxN: Int32, minN: Int32, maxD: Int32, minD: Int32, maxDppi: Int32, minDppi: Int32, maxBeta: Double, minBeta: Double
# ---------- c_script_2: C# ----------
//D = F - (0.37460448 * N + 0.01259251 * Beta - 0.005434 * PPI + 0.90218455) /0.07150102

double a = ((Force - (0.37460448 * maxN + 0.01259251 * maxBeta - 0.005434 * minDppi + 0.90218455)) /0.07150102);
double b = ((Force - (0.37460448 * minN + 0.01259251 * minBeta - 0.005434 * maxDppi + 0.90218455)) /0.07150102);

if (a < minD){
    a = minD;
}else if (a > maxD){
    a = maxD;
}

if (b > maxD){
    b = maxD;
}else if(b<minD){
    b = minD;
}

A = a;
B = b;
# ---------- end c_script_2 ----------
d_dom = ConstructDomain(DomainStart=c_script_2.A, DomainEnd=c_script_2.B)
panel_3 = Panel(d_dom)
inc = Includes(Value=diameter, Domain=d_dom)  # -> Includes, Deviation
panel_4 = Panel(inc.Deviation)

# ---- group: calculate the range of Height
c_script_3 = CSharpScript(alpha=alpha, maxD=max_d, minD=min_d, maxBeta=max_beta, minBeta=min_beta)  # -> out, maxH, minH; inputs alpha: Double, maxD: Int32, minD: Int32, maxBeta: Double, minBeta: Double
# ---------- c_script_3: C# ----------
maxBeta = maxBeta/180*Math.PI;
minBeta = minBeta/180*Math.PI;

minH = minD* 0.62 * Math.Sin(alpha/2)*Math.Sin(maxBeta)/(1-Math.Cos(maxBeta));
maxH = maxD* 0.62 * Math.Sin(alpha/2)*Math.Sin(minBeta)/(1-Math.Cos(minBeta));
# ---------- end c_script_3 ----------
panel_5 = Panel(c_script_3.maxH)
panel_6 = Panel(c_script_3.minH)

# ----
c_script_4 = CSharpScript(
    alpha=alpha,
    Force=max_force,
    D=diameter,
    maxN=max_n,
    minN=min_n,
    maxDppi=max_dppi,
    minDppi=min_dppi,
    maxBeta=max_beta,
    minBeta=min_beta,
    TooltipTextOverride="range of force")  # -> out, A, B; inputs alpha: Double, Force: Double, D: Double, maxN: Int32, minN: Int32, maxDppi: Int32, minDppi: Int32, maxBeta: Double, minBeta: Double
# ---------- c_script_4: C# ----------
//Force = 0.37460448 * N + 0.07150102 * D + 0.01259251 * Beta - 0.005434 * PPI + 0.90218455
//Beta = (Force - (0.37460448 * N + 0.07150102 * D - 0.005434 * PPI + 0.90218455))/0.01259251 ;
double a = (Force - (0.37460448 * maxN + 0.07150102 * D - 0.005434 * minDppi + 0.90218455))/0.01259251 ;
double b = (Force - (0.37460448 * minN + 0.07150102 * D - 0.005434 * maxDppi + 0.90218455))/0.01259251 ;

if (a < minBeta){
    a = minBeta;
}else if (a > maxBeta){
    a = maxBeta;
}

if (b > maxBeta){
    b = maxBeta;
}else if(b<minBeta){
    b = minBeta;
}

a = a/180*Math.PI;
b = b/180*Math.PI;

double Ha = D* 0.62 * Math.Sin(alpha/2)*Math.Sin(a)/(1-Math.Cos(a));
double Hb = D* 0.62 * Math.Sin(alpha/2)*Math.Sin(b)/(1-Math.Cos(b));

if (Ha> Hb){
    double temp = Ha;
    Ha =Hb;
    Hb =temp;
}

A = Ha;
B = Hb;
# ---------- end c_script_4 ----------
h_dom = ConstructDomain(DomainStart=c_script_4.A, DomainEnd=c_script_4.B)
inc_2 = Includes(Value=height, Domain=h_dom)  # -> Includes, Deviation
panel_7 = Panel(h_dom)
panel_8 = Panel(inc_2.Deviation)

c_script_5 = CSharpScript(DInDom=inc.Includes, HInDom=inc_2.Includes)  # -> out, OutOfRange; inputs DInDom: Boolean, HInDom: Boolean
# ---------- c_script_5: C# ----------
if (DInDom || HInDom)
    //OutOfRange = "Out of measured Range";
    OutOfRange = 1;
else
    //OutOfRange = "In measured Range";
    OutOfRange = 0;
# ---------- end c_script_5 ----------
withintreshold = Integer(c_script_5.OutOfRange)
force = Number(max_force)
D = Number(diameter)
H = Number(height)

# ---- group: sequence of dppi (92-399)
c_script_6 = CSharpScript(x=max_dppi, y=min_dppi)  # -> out, A; inputs x: Int32, y: Int32
# ---------- c_script_6: C# ----------
A = x-y+1; // number
# ---------- end c_script_6 ----------
series = Series(Start=min_dppi, Step=1, Count=c_script_6.A)

# ----
# calculate beta
c_script_7 = CSharpScript(H=H, D=D)  # -> out, beta, A, B; inputs H: Double, D: Double
# ---------- c_script_7: C# ----------
//calculate the value of beta based on Height
//according to equation (1) in paper
double b = 2 * Math.Atan(D*0.62 * 0.5 / H);

beta = b;

double min = 120/180*Math.PI;
double max = 150/180*Math.PI;

if (b < min){
    b = min;
}

A =b;

if (b > max){
    b = max;
}

B = b;
# ---------- end c_script_7 ----------

beta = Number(c_script_7.beta)

# ----
# calculate number of arms (N: 3~9)
c_script_8 = CSharpScript(F=force, Beta=beta, D=D, Dppi=series, stiffCoe=stiffness_coe)  # -> ppi, all_N, Dis; inputs F: Double, Beta: Double, D: Double, Dppi: list of Double, stiffCoe: Double
# ---------- c_script_8: C# ----------
// given: F D H & Dppi_list
// keep beta & ppi
double[] ppi_list = new double[7]; // 3~9
double[] min_dis = new double[7]{1,1,1,1,1,1,1};
List<double> n_list = new List<double>();
double max_n = -1000;

for(int i =0; i<Dppi.Count; i++){
    double dppi = Dppi[i];
    //F = 0.37460448 * N + 0.07150102 * D + 0.01259251 * Beta - 0.005434 * PPI + 0.90218455
    double n = (F -(0.07150102 * D + 0.01259251 * (Beta/Math.PI*180) - 0.005434 * dppi + 0.90218455))/0.37460448;
    if(max_n<n)
        max_n = n;

    n_list.Add(n);

    if(n>=3 && n<=9){ // range of n: 3-9
        double n_floor = Math.Floor(n+0.5); //3~9
        int indx = (int)n_floor-3;

        double dis = Math.Abs(n_floor-n);
        if(ppi_list[indx]== 0 || min_dis[indx]>dis){
            min_dis[indx]= dis;
            dppi = dppi * stiffCoe;
            if (dppi < 92)
                dppi =92;
            else if (dppi >399)
                dppi =399;
            ppi_list[indx]= dppi;

        }

    }
}

ppi = ppi_list;
//max_N = max_n;
all_N = n_list;
Dis = min_dis;
# ---------- end c_script_8 ----------
bnd = Bounds(Numbers=c_script_8.all_N)
dedomain = DeconstructDomain(Domain=bnd)  # -> Start, End
c_script_9 = CSharpScript(ppi_list=c_script_8.ppi, max_N=dedomain.End, min_N=dedomain.Start)  # -> out, ppi, n; inputs ppi_list: list of Double, max_N: Double, min_N: Double
# ---------- c_script_9: C# ----------
if(max_N<3){
    n= 3;
    ppi = 92;
}else if(min_N >9){
    n = 9;
    ppi = 399;
}else{
    for(int i =0; i<ppi_list.Count; i++){
        if(ppi_list[i]!=0){
            ppi = ppi_list[i];
            n = 3+i; // 0~7 + 3 = 3~9
            break;
        }
    }
}
# ---------- end c_script_9 ----------
N = Integer(c_script_9.n)
dppi = Number(c_script_9.ppi)

H_2 = Number(H)
beta_2 = Number(beta)
N_2 = Integer(N)
dppi_2 = Integer(dppi)
D_2 = Number(D)
alpha_2 = Alpha(alpha)
cir = Circle(Plane=PlaneXY(0, 0, 0), Radius=expr("x/2", D_2))
offset = OffsetCurve(Curve=cir, Distance=buttom_offset, Plane=PlaneXY(0, 0, 0), Corners=1)
multiplication = Multiplication(A=D_2, B=0.31)
cir_2 = Circle(Plane=PlaneXY(0, 0, 0), Radius=multiplication)
c_script_10 = CSharpScript(D=D_2, alpha=alpha_2, beta=beta_2)  # -> out, pointA, pointD; inputs D: Double, alpha: Double, beta: Double
# ---------- c_script_10: C# ----------
    double innerD = 0.62 * D; //inner diameter
    //calculate ther position of point A
    Point3d p = new Point3d();
    p.X = innerD / 2 * Math.Sin(alpha / 2);
    p.Y = -innerD / 2 * Math.Cos(alpha / 2);
    pointA = p;
    //calculate ther position of point D
    double L = innerD * Math.Sin(alpha / 2) / (1 - Math.Cos(beta));
    p.X = p.X - L;
    pointD = p;
# ---------- end c_script_10 ----------

# ----
# G: generate point B
rotate = Rotate(Geometry=c_script_10.pointA, Angle=expr("2*pi/x", N_2), Plane=PlaneXY(0, 0, 0))  # -> Geometry, Transform

# ----
# Vect_y with length of point D
Y = UnitY(Factor=c_script_10.pointD)

# ----
# point B rotates -alpha
# G: generate point B’’
# Vect_z with length of Height
rotate_2 = Rotate(Geometry=rotate.Geometry, Angle=expr("-x", alpha_2), Plane=PlaneXY(0, 0, 0))  # -> Geometry, Transform
Z = UnitZ(Factor=H_2)
move = Move(Geometry=rotate_2.Geometry, Motion=Z)  # -> Geometry, Transform

# ----
# 1-mm segment on line a
line = LineSDL(Start=c_script_10.pointD, Direction=Y, Length=1)

# ----
# point B’
rotax = RotateAxis(Geometry=rotate.Geometry, Angle=expr("-x", beta_2), Axis=line)  # -> Geometry, Transform

# ----
# intersection points: point E & E’
# point E
clx = CurveLine(Curve=cir, Line=line)  # -> Points, Params, Count
item = ListItem(List=clx.Points, Index=1, Wrap=True)

# ----
# middle point of B’ B’’
avr = Average(Input=[rotax.Geometry, move.Geometry])

# ----
# vector B’’B’
subtraction = Subtraction(A=rotax.Geometry, B=move.Geometry)

# ----
# plane o
lnpt = LinePt(Line=line, Point=rotax.Geometry)

# ----
# plane j
pl = PlaneNormal(Origin=avr, ZAxis=subtraction)

# ----
# line q1
ppx = PlanePlane(PlaneA=lnpt, PlaneB=pl)

# ----
# line q’
rotax_2 = RotateAxis(Geometry=ppx, Angle=beta_2, Axis=line)  # -> Geometry, Transform

vec = Vector(rotax_2.Geometry)
updownpercent = Number(fold_percent)

# ----
# point A
pt = Point(c_script_10.pointA)

# ----
# calculate v and |AK|
c_script_11 = CSharpScript(outerD=D_2, n=N_2, vec_q=vec, pointA=pt, pointB=rotate.Geometry, pointE=item)  # -> out, AK, Qr, value_v, delta; inputs outerD: Double, n: Double, vec_q: Vector3d, pointA: Point3d, pointB: Point3d, pointE: Point3d
# ---------- c_script_11: C# ----------
double deltaR = outerD/2*(1-0.62);
double theta = 2*Math.PI/n;
//normalize the vector q'; direction is left&up
//Vector3d k_q = vec_q/ Math.Sqrt( Math.Pow(vec_q.X,2) + Math.Pow(vec_q.Y,2) +Math.Pow(vec_q.Z,2))*(-1);
//xielv of line q_
double k_q = vec_q.Y/vec_q.X;
// middile point T of point E & B
Point3d pointT = new Point3d(pointB.X+pointE.X , pointB.Y+pointE.Y, pointB.Z+pointE.Z)/2;
//Vector EB
Vector3d vecEB = new Vector3d(pointB.X-pointE.X , pointB.Y-pointE.Y, pointB.Z-pointE.Z)/2;
// intersecting point of line f2 and x-axis
Point3d pointN = new Point3d(vecEB.Y/vecEB.X*pointT.Y + pointT.X, 0, 0);
// intersecting point of line f2 and line a'
Point3d pointS = new Point3d(pointE.X, (pointT.X-pointE.X)*vecEB.X/vecEB.Y+pointT.Y, 0);

double min_delta =1000; //set a upper limit

double min_AK =0;
// range of v : 0~1
double min_v=0.5;

double Q_r = 0;

for(double v=-5; v<=10; v+=0.01){
    //point Q: the center of circle
    Point3d pointQ = pointN + v*(pointS-pointN);
    Point3d pointQ_ = new Point3d(Math.Cos(theta)*pointQ.X+Math.Sin(theta)*pointQ.Y, -Math.Sin(theta)*pointQ.X+Math.Cos(theta)*pointQ.Y, 0);
    Q_r = Math.Sqrt(Math.Pow(pointQ.X - pointB.X, 2)+ Math.Pow(pointQ.Y- pointB.Y,2));

    Vector3d vecQA = new Vector3d(pointA.X - pointQ.X, pointA.Y-pointQ.Y, 0);
    double a = 1+Math.Pow(k_q, 2);
    double b = 2* (vecQA.X+ k_q*vecQA.Y);
    double c = Math.Pow(vecQA.X, 2) + Math.Pow(vecQA.Y, 2)- Math.Pow(Q_r,2);
    double KA_X = (-1*b + Math.Sqrt(Math.Pow(b, 2)-4*a*c))/(2*a);

    double F_y = -Math.Sqrt(Math.Pow(Q_r, 2)- Math.Pow(pointE.X-pointQ_.X, 2))+ pointQ_.Y;

    double dis_AK = Math.Sqrt((Math.Pow(k_q, 2)+1)*Math.Pow(KA_X,2));
    double dis_EF = Math.Sqrt(Math.Pow(F_y-pointE.Y, 2));

    if(min_delta >Math.Abs(dis_AK - dis_EF) ){ //the minimum v
        min_delta = Math.Abs(dis_AK - dis_EF);
        min_v = v;
        min_AK = dis_AK;
        if(min_delta <= 0.1){ //tolerance
            break;
        }
    }
}

value_v = min_v;
AK = min_AK;
delta = min_delta;
Qr = Q_r;
# ---------- end c_script_11 ----------
panel_9 = Panel(c_script_11.value_v)
panel_10 = Panel(c_script_11.AK)
panel_11 = Panel(c_script_11.delta)

num = Number(c_script_11.AK)

# ----
# list of A points
arrpolar = PolarArray(Geometry=pt, Plane=PlaneXY(0, 0, 0), Count=N_2, Angle=6.283185307)  # -> Geometry, Transform

# ----
# transform angles
number_slider = Slider(0, range=0..1)
rad = Radians(Degrees=transition)

# ----
# polygon generated by A points
pline = PolyLine(Vertices=arrpolar.Geometry, Closed=True)

# ----
# A: beta/ B: upDown percent
c_script_12 = CSharpScript(beta=beta_2, upPercent=updownpercent, foldPercent=transition)  # -> out, angle; inputs beta: Double, upPercent: Double, foldPercent: Double
# ---------- c_script_12: C# ----------
double a =0;

if(upPercent != 1){
    a = beta*upPercent;
}else{
    a = beta*upPercent + foldPercent *(Math.PI-beta);
}

if(a <0)
    angle =0;
else if(a>Math.PI)
    angle =Math.PI;
else
    angle =a;
# ---------- end c_script_12 ----------
multiplication_2 = Multiplication(A=beta_2, B=updownpercent)
num_2 = Number(c_script_12.angle)

amp = Amplitude(Vector=rotax_2.Geometry, Amplitude=expr("-x", num))
inner_r = Number(multiplication)

# ----
# number of arms
num_3 = Number(N_2)

# ----
# point K
move_2 = Move(Geometry=pt, Motion=amp)  # -> Geometry, Transform

# ----
# arc going through B&K&E
arc = Arc3Pt(PointA=rotate.Geometry, PointB=move_2.Geometry, PointC=item)  # -> Arc, Plane, Radius

# ----
# segment AK on line q’
ln = Line(StartPoint=pt, EndPoint=move_2.Geometry)

# ----
# arc BKE
crv = Curve(arc.Arc)

# ----
# segment AK
line_2 = Line(ln)

# ----
# list of arcs BEK
arrpolar_2 = PolarArray(Geometry=arc.Arc, Plane=PlaneXY(0, 0, 0), Count=N_2, Angle=6.283185307)  # -> Geometry, Transform

# ----
# arc AF
item_2 = ListItem(List=arrpolar_2.Geometry, Index=-1, Wrap=True)

# ----
# point F
line_3 = LineSDL(Start=item, Direction=line, Length=num)
clx_2 = CurveLine(Curve=item_2, Line=line_3)  # -> Points, Params, Count

# ----
# segment EF on line a
ln_2 = Line(StartPoint=item, EndPoint=clx_2.Points)

# ----
# sub curve BK
# sub curve KE
clx_3 = CurveLine(Curve=crv, Line=line_2)  # -> Points, Params, Count
dedomain_2 = DeconstructDomain(Domain=crv)  # -> Start, End
dom = ConstructDomain(DomainStart=clx_3.Params, DomainEnd=dedomain_2.End)
subcrv = SubCurve(BaseCurve=crv, Domain=dom)
subcrv_2 = SubCurve(BaseCurve=crv, Domain=clx_3.Params)

# ----
# sub curve AF
clx_4 = CurveLine(Curve=item_2, Line=line_3)  # -> Points, Params, Count
dom_2 = ConstructDomain(DomainStart=clx_4.Params, DomainEnd=dedomain_2.End)
subcrv_3 = SubCurve(BaseCurve=item_2, Domain=dom_2)

arrpolar_3 = PolarArray(Geometry=[ln, ln_2], Plane=PlaneXY(0, 0, 0), Count=N_2, Angle=6.283185307)  # -> Geometry, Transform

# ----
# point E/F
end = EndPoints(Curve=ln_2)  # -> Start, End

# ----
# cutting lines
# folding lines
merge = Merge(Data1=offset, Data2=arrpolar_2.Geometry)
merge_2 = Merge(Data1=pline, Data2=arrpolar_3.Geometry)

subcrv_4 = SubCurve(BaseCurve=item_2, Domain=clx_4.Params)

# ----
# rotation R
ln_3 = Line(StartPoint=pt, EndPoint=end.End)
len = Length(Curve=ln_3)

ln_4 = Line(StartPoint=end.Start, EndPoint=move_2.Geometry)

# ----
# pt: dash/gap lengths
c_script_13 = CSharpScript(dpi=dppi_2)  # -> out, dash, gap; inputs dpi: Double
# ---------- c_script_13: C# ----------
// 1 inch = 25.4 mm
double d = 0.025;
double ppi = 25.4/(dpi*d)-1;

dash = d;
gap = d*ppi;
# ---------- end c_script_13 ----------
dash = DashPattern(Curve=merge_2, Pattern=flatten([c_script_13.dash, c_script_13.gap]))  # -> Dashes, Gaps

pln = Plane(end.End)

# ----
# rotation plane
rot3d = Rotate3D(Geometry=pln, Angle=expr("-x", num_2), Center=end.End, Axis=ln_2)  # -> Geometry, Transform

# ----
# rotation arc
arc_2 = Arc(Plane=rot3d.Geometry, Radius=len, Angle=Domain(0, 1.570796327))  # -> Arc, Length

len_2 = Length(Curve=ln_4)

# ----
# rotation sphere
sph = Sphere(Base=pln, Radius=len)

# ----
# offset cyl
cyl = Cylinder(Base=PlaneXY(0, 0, 0), Radius=inner_r, Length=len)

ak = Number(num)
merge_3 = Merge(Data1=merge, Data2=dash.Dashes)

# ----
# trace of A’
bbx = BrepBrep(BrepA=cyl, BrepB=sph)  # -> Curves, Points

# ----
# point A’
ccx = CurveCurve(CurveA=bbx.Curves, CurveB=arc_2.Arc)  # -> Points, ParamsA, ParamsB

pl_3pt = Plane3Pt(PointA=end.Start, PointB=end.End, PointC=ccx.Points)
arrpolar_4 = PolarArray(Geometry=ccx.Points, Plane=PlaneXY(0, 0, 0), Count=num_3, Angle=6.283185307)  # -> Geometry, Transform
pln_2 = Plane(ccx.Points)
arc_3 = Arc(Plane=pl_3pt, Radius=len_2, Angle=Domain(0, 3.141592654))  # -> Arc, Length

# ----
# point B’’
item_3 = ListItem(List=arrpolar_4.Geometry, Index=1, Wrap=True)

sph_2 = Sphere(Base=pln_2, Radius=ak)

# ----
# point K’
bcx = BrepCurve(Brep=sph_2, Curve=arc_3.Arc)  # -> Curves, Points
item_4 = ListItem(List=bcx.Points, Index=1, Wrap=True)

# ----
# central polygon
pline_2 = PolyLine(Vertices=arrpolar_4.Geometry, Closed=True)
boundary = BoundarySurfaces(Edges=pline_2)

# ---- group: upper arm
# reset the control points of arc BK
pl_3pt_2 = Plane3Pt(PointA=item_4, PointB=item_3, PointC=ccx.Points)
pl_3pt_3 = Plane3Pt(PointA=item_3, PointB=ccx.Points, PointC=item_4)
arc_4 = Arc(Plane=pl_3pt_2, Radius=c_script_11.Qr, Angle=Domain(0, 1.570796327))  # -> Arc, Length
arc_5 = Arc(Plane=pl_3pt_3, Radius=c_script_11.Qr, Angle=Domain(-1.570796327, 0))  # -> Arc, Length
ccx_2 = CurveCurve(CurveA=arc_5.Arc, CurveB=arc_4.Arc)  # -> Points, ParamsA, ParamsB
ln_5 = Line(StartPoint=item_3, EndPoint=ccx.Points)
pl_3pt_4 = Plane3Pt(PointA=ccx_2.Points, PointB=item_3, PointC=ccx.Points)
ln_6 = Line(StartPoint=item_3, EndPoint=item_4)
arc_6 = Arc(Plane=pl_3pt_4, Radius=c_script_11.Qr, Angle=Domain(0, 6.283185307))  # -> Arc, Length
clx_5 = CurveLine(Curve=arc_6.Arc, Line=ln_6)  # -> Points, Params, Count
item_5 = ListItem(List=clx_5.Params, Index=0, Wrap=True)
item_6 = ListItem(List=clx_5.Params, Index=1, Wrap=True)
dom_3 = ConstructDomain(DomainStart=item_5, DomainEnd=item_6)
subcrv_5 = SubCurve(BaseCurve=arc_6.Arc, Domain=dom_3)
rulesrf = RuledSurface(CurveA=subcrv_5, CurveB=ln_5)

# ---- group: lower arm
pl_3pt_5 = Plane3Pt(PointA=end.End, PointB=pt, PointC=move_2.Geometry)
pl_3pt_6 = Plane3Pt(PointA=end.End, PointB=ccx.Points, PointC=item_4)
pl_3pt_7 = Plane3Pt(PointA=end.Start, PointB=move_2.Geometry, PointC=pt)
pl_3pt_8 = Plane3Pt(PointA=end.Start, PointB=item_4, PointC=ccx.Points)

# ----
# bottom surfaces
arrpolar_5 = PolarArray(Geometry=[subcrv_3, ln_2], Plane=PlaneXY(0, 0, 0), Count=num_3, Angle=6.283185307)  # -> Geometry, Transform
offset_circle = Circle(offset)
join = JoinCurves(Curves=flatten(arrpolar_5.Geometry), Preserve=False)
boundary_2 = BoundarySurfaces(Edges=flatten([join, offset_circle]))

# ---- group: lower arm
# Rotate_arc AF
orient = Orient(Geometry=subcrv_4, Source=pl_3pt_5, Target=pl_3pt_6)  # -> Geometry, Transform

# F/A/K
# F/A/K’
# Rotate_arc KE
orient_2 = Orient(Geometry=subcrv, Source=pl_3pt_7, Target=pl_3pt_8)  # -> Geometry, Transform
arc_7 = CircularArc(orient_2.Geometry)
arc_8 = CircularArc(orient.Geometry)
rulesrf_2 = RuledSurface(CurveA=arc_8, CurveB=arc_7)

# ----
# arms
brep = Brep([rulesrf, rulesrf_2])
arrpolar_6 = PolarArray(Geometry=brep, Plane=PlaneXY(0, 0, 0), Count=num_3, Angle=6.283185307)  # -> Geometry, Transform

merge_4 = Merge(Data1=arrpolar_6.Geometry, Data2=boundary, Data3=boundary_2)
cuts = ClusterOutput(merge)
folds = ClusterOutput(dash.Dashes)
_3d_geometry = ClusterOutput(merge_4)
withintreshold_2 = ClusterOutput(withintreshold)

# ==== cluster Cluster_2
stiffness_coe = ClusterInput()
offset = ClusterInput()
transition = ClusterInput()
force = ClusterInput()
diameter = ClusterInput()
diameter_2 = Number(diameter)

# ---- group: range of Dppi
min_dppi = Integer(50)
max_dppi = Integer(150)

# ---- group: constants
series = Series(Start=3, Step=1, Count=8)
theta0 = Number(70)
b = Number(10)
rad = Radians(Degrees=b)
rad_2 = Radians(Degrees=theta0)

# ----
# calculate maximum force
innerr = Number(expr("x/2", diameter_2))
c_script = CSharpScript(N=series, theta0=rad_2, b=rad, r=innerr)  # -> out, Alpha, GammaV, Force, Theta; inputs N: Double, theta0: Double, b: Double, r: Double
# ---------- c_script: C# ----------
double n = N;
//double pi = Math.PI;

double B = 2 * Math.PI / N;
double alpha = (Math.PI - N * b) / N;

double d0 = Math.Acos(//ok
  Math.Cos(theta0) * Math.Cos(theta0) +
  Math.Sin(theta0) * Math.Sin(theta0) * Math.Cos(B));


double lastF =0;
double F = 0;
double theta = Math.PI/2; //find the maximum force

do{
    theta = theta-0.1/180*Math.PI;
    lastF = F;

    double d = Math.Acos(//ok
      Math.Cos(theta) * Math.Cos(theta) +
      Math.Sin(theta) * Math.Sin(theta) * Math.Cos(B));

    double epsilon0 = Math.Acos(Math.Tan(d / 2) / Math.Tan(theta0));//ok
    double epsilon = Math.Acos(Math.Tan(d / 2) / Math.Tan(theta));//ok


    double f = Math.Acos(//ok
      Math.Cos(b / 2) * Math.Cos(b / 2) * Math.Cos(d) +
      Math.Sin(b) * Math.Sin(d) * Math.Sin(epsilon) +
      Math.Sin(b / 2) * Math.Sin(b / 2) *
      (Math.Cos(epsilon) * Math.Cos(epsilon) - Math.Cos(d) * Math.Sin(epsilon) * Math.Sin(epsilon))
      );
    double f0 = Math.Acos(//ok
      Math.Cos(b / 2) * Math.Cos(b / 2) * Math.Cos(d) +
      Math.Sin(b) * Math.Sin(d) * Math.Sin(epsilon) +
      Math.Sin(b / 2) * Math.Sin(b / 2) *
      (Math.Cos(epsilon0) * Math.Cos(epsilon0) - Math.Cos(d) * Math.Sin(epsilon0) * Math.Sin(epsilon0))
      );



    double d_theta = (-Math.Sin(2 * theta) * (Math.Cos(B) - 1)) / Math.Sin(d);//ok
    double d_theta0 = (-Math.Sin(2 * theta0) * (Math.Cos(B) - 1)) / Math.Sin(d);//ok
    double A =
      1 -
      Math.Pow(
      Math.Cos(b / 2) * Math.Cos(b / 2) * Math.Cos(d) +
      Math.Sin(b) * Math.Sin(d) * Math.Sin(epsilon) +
      Math.Sin(b / 2) * Math.Sin(b / 2) * (
      Math.Cos(epsilon) * Math.Cos(epsilon) - Math.Cos(d) * Math.Sin(epsilon) * Math.Sin(epsilon)
      )
      , 2);
    A = Math.Sqrt(A);//ok
    double eps_theta = (1 - 2 * Math.Cos(2 * d) + Math.Cos(B) + 2 * Math.Cos(4 * theta) * Math.Sin(B / 2) * Math.Sin(B / 2)) * Math.Tan(d / 2)
      / (4 * Math.Sin(d) * Math.Sin(d) * Math.Sin(theta) * Math.Sin(theta) * Math.Sin(epsilon));//ok
    double eps_theta0 = (1 - 2 * Math.Cos(2 * d) + Math.Cos(B) + 2 * Math.Cos(4 * theta0) * Math.Sin(B / 2) * Math.Sin(B / 2)) * Math.Tan(d / 2)
      / (4 * Math.Sin(d) * Math.Sin(d) * Math.Sin(theta0) * Math.Sin(theta0) * Math.Sin(epsilon0));//ok
    double f_theta = fTheta(A, b, d, d_theta, eps_theta, epsilon);//ok
    double f_theta0 = fTheta(A, b, d0, d_theta0, eps_theta0, epsilon0);//ok

    double eta=0,phi = 0;
    double eta0=0,phi0 = 0;
    double eta_theta = 0;
    eta_phi(alpha, d, f, b, epsilon, theta, d_theta, 1.166099, eps_theta, ref eta, ref phi, ref eta_theta);
    //eta_phi(alpha, d, f0, b, epsilon0, theta0, d_theta0, f_theta0, eps_theta0, ref eta0, ref phi0, ref eta_theta0);

    double gammaM_theta = gamma(theta, n, b);
    //double gammaM0_theta = gamma(theta0, n, b);

    double gammaV = phi - eta;
    if(theta > Math.PI / 2)
      gammaV = phi + eta;
    double gammaV0 = phi0 - eta0;

    GammaV = gammaV;
    Alpha = alpha;

    double gammaM = -Math.Acos(1 / Math.Sin(alpha) / Math.Cos(b / 2) * Math.Sin(f / 2) - 1 / Math.Tan(alpha) * Math.Tan(b / 2));
    double gammaM0 = -Math.Acos(1 / Math.Sin(alpha) / Math.Cos(b / 2) * Math.Sin(f0 / 2) - 1 / Math.Tan(alpha) * Math.Tan(b / 2));

    double phi_theta = 1 / Math.Cos(f / 2) *
      (1 / Math.Sin(alpha) * Math.Sin(b / 2) * Math.Tan(f / 2) - 1 / Math.Tan(alpha) / Math.Cos(f / 2)) * f_theta /
      (2 * Math.Sqrt(1 - Math.Pow(1 / Math.Sin(alpha) / Math.Cos(f / 2) * Math.Sin(b / 2) - 1 / Math.Tan(alpha) * Math.Tan(f / 2), 2)));


    double gammaV_theta = phi_theta - eta_theta;
    if(theta > Math.PI / 2)
      gammaV_theta = phi_theta + eta_theta;


    //Print("eta_theta={0:0.00000}", eta_theta);
    //Print("phi_theta={0:0.00000}", phi_theta);
    //Print("f={0:0.00000}", f);
    //Print("gammaV_theta={0:0.00000}", gammaV_theta);

    F = N * ((gammaM - gammaM0) * gammaM_theta + (gammaV - gammaV0) * gammaV_theta) / (Math.Sin(theta) * r);

} while(lastF <F);
Force = lastF;
Theta = theta;
# ---------- c_script: C# additional code ----------
  double gamma(double theta, double n, double b)
  {
    double pi = Math.PI;
    return
      -(((((2 * Math.Cos(2 * (pi / n)) - 2) * Math.Cos(theta) * Math.Sin(theta) / (2 *
      (Math.Cos(Math.Acos(Math.Cos(2 * (pi / n)) * Math.Sin(theta) * Math.Sin(theta) + Math.Cos(theta) * Math.Cos(theta)) / 2) * Math.Cos(Math.Acos(Math.Cos(2 * (pi / n)) * Math.Sin(theta) * Math.Sin(theta) + Math.Cos(theta) * Math.Cos(theta)) / 2) *
      Math.Sqrt(1 - Math.Pow((Math.Cos(2 * (pi / n)) * Math.Sin(theta) * Math.Sin(theta) + Math.Cos(theta) * Math.Cos(theta)), 2)))) +
      Math.Tan(Math.Acos(Math.Cos(2 * (pi / n)) * Math.Sin(theta) * Math.Sin(theta) + Math.Cos(theta) * Math.Cos(theta)) / 2) / (Math.Cos(theta) * Math.Cos(theta) *
      Math.Tan(theta))) * Math.Cos(Math.Acos(Math.Tan(Math.Acos(Math.Cos(2 * (pi / n)) * Math.Sin(theta) * Math.Sin(theta) +
      Math.Cos(theta) * Math.Cos(theta)) / 2) / Math.Tan(theta))) * Math.Sin(Math.Acos(Math.Cos(2 * (pi / n)) *
      Math.Sin(theta) * Math.Sin(theta) + Math.Cos(theta) * Math.Cos(theta))) / (Math.Sqrt(1 - Math.Pow((Math.Tan(Math.Acos(Math.Cos(2 *
      (pi / n)) * Math.Sin(theta) * Math.Sin(theta) + Math.Cos(theta) * Math.Cos(theta)) / 2) / Math.Tan(theta)), 2)) *
      Math.Tan(theta)) - (2 * Math.Cos(2 * (pi / n)) - 2) * Math.Cos(Math.Acos(Math.Cos(2 *
      (pi / n)) * Math.Sin(theta) * Math.Sin(theta) + Math.Cos(theta) * Math.Cos(theta))) * Math.Cos(theta) * Math.Sin(Math.Acos(Math.Tan(Math.Acos(Math.Cos(2 *
      (pi / n)) * Math.Sin(theta) * Math.Sin(theta) + Math.Cos(theta) * Math.Cos(theta)) / 2) / Math.Tan(theta))) *
      Math.Sin(theta) / Math.Sqrt(1 - Math.Pow((Math.Cos(2 * (pi / n)) * Math.Sin(theta) * Math.Sin(theta) + Math.Cos(theta) * Math.Cos(theta)), 2))) *
      Math.Sin(b) + (2 * Math.Cos(2 * (pi / n)) - 2) * Math.Pow(Math.Cos(b / 2), 2) * Math.Cos(theta) *
      Math.Sin(Math.Acos(Math.Cos(2 * (pi / n)) * Math.Sin(theta) * Math.Sin(theta) + Math.Cos(theta) * Math.Cos(theta))) *
      Math.Sin(theta) / Math.Sqrt(1 - Math.Pow((Math.Cos(2 * (pi / n)) * Math.Sin(theta) * Math.Sin(theta) + Math.Cos(theta) * Math.Cos(theta)), 2)) -
      (((2 * Math.Cos(2 * (pi / n)) - 2) * Math.Cos(theta) * Math.Sin(theta) / (2 *
      (Math.Cos(Math.Acos(Math.Cos(2 * (pi / n)) * Math.Sin(theta) * Math.Sin(theta) + Math.Cos(theta) * Math.Cos(theta)) / 2) * Math.Cos(Math.Acos(Math.Cos(2 * (pi / n)) * Math.Sin(theta) * Math.Sin(theta) + Math.Cos(theta) * Math.Cos(theta)) / 2) *
      Math.Sqrt(1 - Math.Pow((Math.Cos(2 * (pi / n)) * Math.Sin(theta) * Math.Sin(theta) + Math.Cos(theta) * Math.Cos(theta)), 2)))) +
      Math.Tan(Math.Acos(Math.Cos(2 * (pi / n)) * Math.Sin(theta) * Math.Sin(theta) + Math.Cos(theta) * Math.Cos(theta)) / 2) / (Math.Cos(theta) * Math.Cos(theta) *
      Math.Tan(theta))) * (2 + 2 * Math.Cos(Math.Acos(Math.Cos(2 * (pi / n)) *
      Math.Sin(theta) * Math.Sin(theta) + Math.Cos(theta) * Math.Cos(theta)))) * Math.Cos(Math.Acos(Math.Tan(Math.Acos(Math.Cos(2 *
      (pi / n)) * Math.Sin(theta) * Math.Sin(theta) + Math.Cos(theta) * Math.Cos(theta)) / 2) / Math.Tan(theta))) / (Math.Sqrt(1 -
      Math.Pow((Math.Tan(Math.Acos(Math.Cos(2 * (pi / n)) * Math.Sin(theta) * Math.Sin(theta) + Math.Cos(theta) * Math.Cos(theta)) / 2) / Math.Tan(theta)), 2)) *
      Math.Tan(theta)) + (2 * Math.Cos(2 * (pi / n)) - 2) * Math.Cos(theta) *
      Math.Sin(Math.Acos(Math.Cos(2 * (pi / n)) * Math.Sin(theta) * Math.Sin(theta) + Math.Cos(theta) * Math.Cos(theta))) *
      Math.Sin(Math.Acos(Math.Tan(Math.Acos(Math.Cos(2 * (pi / n)) * Math.Sin(theta) * Math.Sin(theta) + Math.Cos(theta) * Math.Cos(theta)) / 2) / Math.Tan(theta))) *
      Math.Sin(theta) / Math.Sqrt(1 - Math.Pow((Math.Cos(2 * (pi / n)) * Math.Sin(theta) * Math.Sin(theta) +
      Math.Cos(theta) * Math.Cos(theta)), 2))) * Math.Sin(Math.Acos(Math.Tan(Math.Acos(Math.Cos(2 * (pi / n)) *
      Math.Sin(theta) * Math.Sin(theta) + Math.Cos(theta) * Math.Cos(theta)) / 2) / Math.Tan(theta))) * Math.Pow(Math.Sin(b / 2), 2)) *
      Math.Cos(Math.Acos((Math.Pow(Math.Cos(Math.Acos(Math.Tan(Math.Acos(Math.Cos(2 * (pi / n)) * Math.Sin(theta) * Math.Sin(theta) +
      Math.Cos(theta) * Math.Cos(theta)) / 2) / Math.Tan(theta))), 2) - Math.Cos(Math.Acos(Math.Cos(2 * (pi / n)) *
      Math.Sin(theta) * Math.Sin(theta) + Math.Cos(theta) * Math.Cos(theta))) * Math.Pow(Math.Sin(Math.Acos(Math.Tan(Math.Acos(Math.Cos(2 *
      (pi / n)) * Math.Sin(theta) * Math.Sin(theta) + Math.Cos(theta) * Math.Cos(theta)) / 2) / Math.Tan(theta))), 2)) *
      Math.Pow(Math.Sin(b / 2), 2) + Math.Cos(Math.Acos(Math.Cos(2 * (pi / n)) * Math.Sin(theta) * Math.Sin(theta) +
      Math.Cos(theta) * Math.Cos(theta))) * Math.Pow(Math.Cos(b / 2), 2) + Math.Sin(Math.Acos(Math.Cos(2 * (pi / n)) *
      Math.Sin(theta) * Math.Sin(theta) + Math.Cos(theta) * Math.Cos(theta))) * Math.Sin(Math.Acos(Math.Tan(Math.Acos(Math.Cos(2 *
      (pi / n)) * Math.Sin(theta) * Math.Sin(theta) + Math.Cos(theta) * Math.Cos(theta)) / 2) / Math.Tan(theta))) *
      Math.Sin(b)) / 2) / (2 * (Math.Cos(b / 2) * Math.Sin((pi - b * n) / n) * Math.Sqrt(1 -
      Math.Pow(((Math.Pow(Math.Cos(Math.Acos(Math.Tan(Math.Acos(Math.Cos(2 * (pi / n)) * Math.Sin(theta) * Math.Sin(theta) + Math.Cos(theta) * Math.Cos(theta)) / 2) / Math.Tan(theta))), 2) -
      Math.Cos(Math.Acos(Math.Cos(2 * (pi / n)) * Math.Sin(theta) * Math.Sin(theta) + Math.Cos(theta) * Math.Cos(theta))) *
      Math.Pow(Math.Sin(Math.Acos(Math.Tan(Math.Acos(Math.Cos(2 * (pi / n)) * Math.Sin(theta) * Math.Sin(theta) +
      Math.Cos(theta) * Math.Cos(theta)) / 2) / Math.Tan(theta))), 2)) * Math.Pow(Math.Sin(b / 2), 2) +
      Math.Cos(Math.Acos(Math.Cos(2 * (pi / n)) * Math.Sin(theta) * Math.Sin(theta) + Math.Cos(theta) * Math.Cos(theta))) *
      Math.Pow(Math.Cos(b / 2), 2) + Math.Sin(Math.Acos(Math.Cos(2 * (pi / n)) * Math.Sin(theta) * Math.Sin(theta) +
      Math.Cos(theta) * Math.Cos(theta))) * Math.Sin(Math.Acos(Math.Tan(Math.Acos(Math.Cos(2 * (pi / n)) *
      Math.Sin(theta) * Math.Sin(theta) + Math.Cos(theta) * Math.Cos(theta)) / 2) / Math.Tan(theta))) * Math.Sin(b)), 2)) *
      Math.Sqrt(1 - Math.Pow((Math.Sin(Math.Acos((Math.Pow(Math.Cos(Math.Acos(Math.Tan(Math.Acos(Math.Cos(2 * (pi / n)) * Math.Sin(theta) * Math.Sin(theta) +
      Math.Cos(theta) * Math.Cos(theta)) / 2) / Math.Tan(theta))), 2) - Math.Cos(Math.Acos(Math.Cos(2 * (pi / n)) *
      Math.Sin(theta) * Math.Sin(theta) + Math.Cos(theta) * Math.Cos(theta))) * Math.Pow(Math.Sin(Math.Acos(Math.Tan(Math.Acos(Math.Cos(2 *
      (pi / n)) * Math.Sin(theta) * Math.Sin(theta) + Math.Cos(theta) * Math.Cos(theta)) / 2) / Math.Tan(theta))), 2)) *
      Math.Pow(Math.Sin(b / 2), 2) + Math.Cos(Math.Acos(Math.Cos(2 * (pi / n)) * Math.Sin(theta) * Math.Sin(theta) +
      Math.Cos(theta) * Math.Cos(theta))) * Math.Pow(Math.Cos(b / 2), 2) + Math.Sin(Math.Acos(Math.Cos(2 * (pi / n)) *
      Math.Sin(theta) * Math.Sin(theta) + Math.Cos(theta) * Math.Cos(theta))) * Math.Sin(Math.Acos(Math.Tan(Math.Acos(Math.Cos(2 *
      (pi / n)) * Math.Sin(theta) * Math.Sin(theta) + Math.Cos(theta) * Math.Cos(theta)) / 2) / Math.Tan(theta))) *
      Math.Sin(b)) / 2) / (Math.Cos(b / 2) * Math.Sin((pi - b * n) / n)) - Math.Tan(b / 2) / Math.Tan((pi -
      b * n) / n)), 2)))));
  }

  double fTheta(double A, double b, double d, double d_theta, double eps_theta, double epsilon)
  {
    double f_theta = 1 / A *
      (Math.Cos(b / 2) * Math.Cos(b / 2) * Math.Sin(d) * d_theta
      - Math.Sin(b) * ( Math.Sin(d) * Math.Cos(epsilon) * eps_theta + Math.Sin(epsilon) * Math.Cos(d) * d_theta)
      - Math.Sin(b / 2) * Math.Sin(b / 2) * Math.Sin(epsilon)
      * (-2 * (1 + Math.Cos(d)) * Math.Cos(epsilon) * eps_theta + Math.Sin(epsilon) * Math.Sin(d) * d_theta));
    return f_theta;
  }

  void eta_phi(double alpha, double d, double f, double b, double epsilon, double theta, double d_theta, double f_theta, double eps_theta, ref double eta, ref double phi, ref double eta_theta)
  {
    double k6 = Math.Sin(d) * Math.Sin(f);
    double k5 = Math.Sin(d) * Math.Sin(f) * Math.Cos(b / 2);
    double k4 = Math.Cos(d) * Math.Sin(f) * Math.Sin(b / 2);
    double k3 = Math.Sin(d) * Math.Cos(f) * Math.Sin(b / 2);
    double k2 = Math.Cos(b / 2);
    double k1 = Math.Cos(d) * Math.Cos(f) * Math.Cos(b / 2);
    double h3 = Math.Cos(epsilon) * k6;
    if(theta > Math.PI / 2)
      h3 = -h3;
    double h2 = -k4 + Math.Sin(epsilon) * k5;
    double h1 = k1 - k2 + Math.Sin(epsilon) * k3;

    eta = 2 * Math.Atan((-h3 + Math.Sqrt(Math.Pow(h3, 2) - Math.Pow(h1, 2) + Math.Pow(h2, 2))) / (h1 - h2));
    phi = Math.PI - Math.Acos(
      1 / Math.Sin(alpha) * Math.Sin(b / 2) / Math.Cos(f / 2) -
      1 / Math.Tan(alpha) * Math.Tan(f / 2));
    double B = Math.Sqrt(h3 * h3 - h1 * h1 + h2 * h2);

    double k6_theta = Math.Sin(d) * Math.Cos(f) * f_theta + Math.Cos(d) * Math.Sin(f) * d_theta;//ok
    double k5_theta = Math.Cos(b / 2) * (Math.Sin(d) * Math.Cos(f) * f_theta + Math.Cos(d) * Math.Sin(f) * d_theta);//ok
    double k4_theta = Math.Sin(b / 2) * (Math.Cos(d) * Math.Cos(f) * f_theta - Math.Sin(d) * Math.Sin(f) * d_theta);//ok
    double k3_theta = -Math.Sin(b / 2) * (Math.Sin(d) * Math.Sin(f) * f_theta - Math.Cos(d) * Math.Cos(f) * d_theta);//ok
    double k1_theta = -Math.Cos(b / 2) * (Math.Cos(d) * Math.Sin(f) * f_theta + Math.Sin(d) * Math.Cos(f) * d_theta);//ok

    double h3_theta = -k6 * Math.Sin(epsilon) * eps_theta + Math.Cos(epsilon) * k6_theta;
    if(theta > Math.PI / 2)
      h3_theta = -h3_theta;
    double h2_theta = -k4_theta + k5 * Math.Cos(epsilon) * eps_theta + Math.Sin(epsilon) * k5_theta;//ok
    double h1_theta = k1_theta + k3 * Math.Cos(epsilon) * eps_theta + Math.Sin(epsilon) * k3_theta;//ok

    eta_theta = 2 / Math.Pow(h1 - h2, 2) / (Math.Pow((-h3 + B) / (h1 - h2), 2) + 1)
      * (
      (h1 - h2) * (1 / B * (h3 * h3_theta - h1 * h1_theta + h2 * h2_theta) - h3_theta)
      - (B - h3) * (h1_theta - h2_theta)
      );


  }
# ---------- end c_script ----------
deg = Degrees(Radians=c_script.Theta)
panel = Panel(deg)

force_max = Number(force)
c_script_2 = CSharpScript(maxDppi=max_dppi, minDppi=min_dppi)  # -> out, maxK, minK; inputs maxDppi: Int32, minDppi: Int32
# ---------- c_script_2: C# ----------
maxK = -0.021978*minDppi +8.776832;
minK = -0.021978*maxDppi +8.776832;
# ---------- end c_script_2 ----------
division = Division(A=force_max, B=c_script.Force)
dom = ConstructDomain(DomainStart=c_script_2.minK, DomainEnd=c_script_2.maxK)
inc = Includes(Value=division, Domain=dom)  # -> Includes, Deviation
c_script_3 = CSharpScript(Ks=division, RangeDis=inc.Deviation, maxDppi=max_dppi, minDppi=min_dppi, stiffCoe=stiffness_coe)  # -> out, KInRange, N, Dppi; inputs Ks: list of Double, RangeDis: list of Double, maxDppi: Int32, minDppi: Int32, stiffCoe: Double
# ---------- c_script_3: C# ----------
int index = 0; // default index -> n=3
N = index + 3;
double K = Ks[index];
double minDis = 10000;

for (int i = 0;i < RangeDis.Count;i++) // start from minimum n
{
    if(RangeDis[i] < minDis){
        N = i+3;
        K = Ks[i];
        minDis = RangeDis[i]; //find the minimum proper force and N
    }
}

double ppi = Math.Round((K -8.776832)/-0.021978) * stiffCoe;

if (ppi< minDppi)
    ppi = minDppi;
else if(ppi>maxDppi)
    ppi = maxDppi;

if (minDis == 0)
    //KInRange = "Within Measured Range";
    KInRange = 0;
else
    //KInRange = "Out of Measured Range";
    KInRange = 1;

Dppi =ppi;
# ---------- end c_script_3 ----------

outer_circle_offset = Integer(offset)
fold_percentage = Number(transition)
b_in_radius = Number(rad)

# ----
# diameter
diameter_3 = Number(diameter_2)

N = Number(c_script_3.N)
dppi = Number(c_script_3.Dppi)

# ----
# radius
innerr_2 = Number(expr("x/2", diameter_3))

# ----
# constant value: b/2
division_2 = Division(A=b_in_radius, B=2)

# ----
# calculate x: (R/X=15/2
c_script_4 = CSharpScript(D=diameter_3)  # -> out, H; inputs D: Double
# ---------- c_script_4: C# ----------
H = D/2/15*2; //according to the ratio R/X = 15/2
# ---------- end c_script_4 ----------
X = Number(c_script_4.H)

# ----
# inner circle
cir = Circle(Plane=PlaneXY(0, 0, 0), Radius=innerr_2)

end = EndPoints(Curve=cir)  # -> Start, End
rotate = Rotate(Geometry=end.Start, Angle=expr("-x", division_2), Plane=PlaneXY(0, 0, 0))  # -> Geometry, Transform
rotate_2 = Rotate(Geometry=end.Start, Angle=division_2, Plane=PlaneXY(0, 0, 0))  # -> Geometry, Transform
avr = Average(Input=[rotate_2.Geometry, rotate.Geometry])
pdecon = Deconstruct(Point=avr)  # -> XComponent, YComponent, ZComponent

# ----
# outer circle
# circle: 15/19
# fixed d
# fixed x
eval = Evaluate(F="D/2*(19/15)", D=diameter_3)
cir_2 = Circle(Plane=PlaneXY(0, 0, 0), Radius=eval)

eval_2 = Evaluate(F="D*sin(b)*1.5", D=diameter_3, b=division_2)
pt = ConstructPoint(XCoordinate=pdecon.XComponent, YCoordinate=expr("-x", eval_2), ZCoordinate=pdecon.ZComponent)
pt_2 = ConstructPoint(XCoordinate=pdecon.XComponent, YCoordinate=eval_2, ZCoordinate=pdecon.ZComponent)
X_2 = UnitX(Factor=1)

ln = Line(StartPoint=pt, EndPoint=pt_2)
len = Length(Curve=ln)
line = LineSDL(Start=pt_2, Direction=X_2, Length=len)
line_2 = LineSDL(Start=pt, Direction=X_2, Length=len)
ccx = CurveCurve(CurveA=cir_2, CurveB=line_2)  # -> Points, ParamsA, ParamsB
seam = Seam(Curve=cir_2, Seam=ccx.ParamsA)
ccx_2 = CurveCurve(CurveA=seam, CurveB=line)  # -> Points, ParamsA, ParamsB

# ----
# calculate current theta
# folding range: 70-110
c_script_5 = CSharpScript(foldPer=fold_percentage, D=diameter_3)  # -> out, curTheta, curHeight, curSideRotation; inputs foldPer: Double, D: Double
# ---------- c_script_5: C# ----------
// folding range: 70-110
double theta = (70+(110-70)*foldPer)/180*Math.PI;
curHeight = D/2* Math.Cos(theta);

curTheta = theta;

//0 -> 60
curSideRotation = (40 * foldPer + theta-Math.PI/2)/180*Math.PI;
# ---------- end c_script_5 ----------

ln_2 = Line(StartPoint=rotate_2.Geometry, EndPoint=rotate.Geometry)
X_3 = UnitX(Factor=X)

xy = XYPlane(Origin=Point(0, 0, 0))
ln_3 = Line(StartPoint=rotate_2.Geometry, EndPoint=xy)
ln_4 = Line(StartPoint=rotate.Geometry, EndPoint=xy)

ln_5 = Line(StartPoint=pt, EndPoint=rotate.Geometry)
ln_6 = Line(StartPoint=rotate_2.Geometry, EndPoint=pt_2)
subcrv = SubCurve(BaseCurve=seam, Domain=ccx_2.ParamsA)
ln_7 = Line(StartPoint=pt, EndPoint=ccx.Points)
ln_8 = Line(StartPoint=ccx_2.Points, EndPoint=pt_2)

move = Move(Geometry=ln_2, Motion=X_3)  # -> Geometry, Transform
line_3 = LineSDL(Start=rotate_2.Geometry, Direction=X_2, Length=X_3)
line_4 = LineSDL(Start=rotate.Geometry, Direction=X_2, Length=X_3)

# ----
# remain dis_X
c_script_6 = CSharpScript(D=diameter_3, theta=c_script_5.curTheta)  # -> out, foldR, remainX, foldH; inputs D: Double, theta: Double
# ---------- c_script_6: C# ----------
double R = D/2*Math.Sin(theta);
remainX = D/2 - R;
foldH = D/2*Math.Cos(theta);
foldR = R;
# ---------- end c_script_6 ----------

# ----
# curGammaV
c_script_7 = CSharpScript(N=N, theta=c_script_5.curTheta, b=b_in_radius)  # -> out, Alpha, GammaV; inputs N: Double, theta: Double, b: Double
# ---------- c_script_7: C# ----------
    double theta0 = 0;

    double B = 2 * Math.PI / N;
    double alpha = (Math.PI - N * b) / N;

    double d = Math.Acos(
      Math.Cos(theta) * Math.Cos(theta) +
      Math.Sin(theta) * Math.Sin(theta) * Math.Cos(B));
    double d0 = Math.Acos(
      Math.Cos(theta0) * Math.Cos(theta0) +
      Math.Sin(theta0) * Math.Sin(theta0) * Math.Cos(B));

    double epsilon = Math.Acos(Math.Tan(d / 2) / Math.Tan(theta));
    double epsilon0 = Math.Acos(Math.Tan(d / 2) / Math.Tan(theta0));//0000000

    double f = Math.Acos(
      Math.Cos(b / 2) * Math.Cos(b / 2) * Math.Cos(d) +
      Math.Sin(b) * Math.Sin(d) * Math.Sin(epsilon) +
      Math.Sin(b / 2) * Math.Sin(b / 2) *
      (Math.Cos(epsilon) * Math.Cos(epsilon) - Math.Cos(d) * Math.Sin(epsilon) * Math.Sin(epsilon))
      );
    double f0 = Math.Acos(
      Math.Cos(b / 2) * Math.Cos(b / 2) * Math.Cos(d) +
      Math.Sin(b) * Math.Sin(d) * Math.Sin(epsilon) +
      Math.Sin(b / 2) * Math.Sin(b / 2) *
      (Math.Cos(epsilon0) * Math.Cos(epsilon0) - Math.Cos(d) * Math.Sin(epsilon0) * Math.Sin(epsilon0))
      );

    double k6 = Math.Sin(d) * Math.Sin(f);
    double k5 = Math.Sin(d) * Math.Sin(f) * Math.Cos(b / 2);
    double k4 = Math.Cos(d) * Math.Sin(f) * Math.Sin(b / 2);
    double k3 = Math.Sin(d) * Math.Cos(f) * Math.Sin(b / 2);
    double k2 = Math.Cos(b / 2);
    double k1 = Math.Cos(d) * Math.Cos(f) * Math.Cos(b / 2);
    double h3 = Math.Cos(epsilon) * k6;
    if(theta > Math.PI / 2)
      h3 = -h3;
    double h2 = -k4 + Math.Sin(epsilon) * k5;
    double h1 = k1 - k2 + Math.Sin(epsilon) * k3;

    double eta = 2 * Math.Atan((-h3 + Math.Sqrt(Math.Pow(h3, 2) - Math.Pow(h1, 2) + Math.Pow(h2, 2))) / (h1 - h2));
    double phi = Math.PI - Math.Acos(
      1 / Math.Sin(alpha) * Math.Sin(b / 2) / Math.Cos(f / 2) -
      1 / Math.Tan(alpha) * Math.Tan(f / 2));

    double d_theta = (-Math.Sin(2 * theta) * (Math.Cos(B) - 1)) / Math.Sin(d);
    double d_theta0 = (-Math.Sin(2 * theta0) * (Math.Cos(B) - 1)) / Math.Sin(d);
    double A = Math.Pow(1 - (Math.Cos(b / 2) * Math.Cos(b / 2) * Math.Cos(d) + Math.Sin(b) * Math.Sin(d) * Math.Sin(epsilon) + Math.Sin(b / 2) * Math.Sin(b / 2) * Math.Pow(Math.Cos(epsilon) * Math.Cos(epsilon) - Math.Cos(d) * Math.Sin(epsilon) * Math.Sin(epsilon), 2)), 0.5);
    double eps_theta = (1 - 2 * Math.Cos(2 * d) + Math.Cos(B) + 2 * Math.Cos(4 * theta) * Math.Sin(B) * Math.Sin(B)) * Math.Tan(d / 2) / (4 * Math.Sin(d) * Math.Sin(d) * Math.Sin(theta) * Math.Sin(theta) * Math.Sin(epsilon));
    double eps_theta0 = (1 - 2 * Math.Cos(2 * d) + Math.Cos(B) + 2 * Math.Cos(4 * theta0) * Math.Sin(B) * Math.Sin(B)) * Math.Tan(d / 2) / (4 * Math.Sin(d) * Math.Sin(d) * Math.Sin(theta0) * Math.Sin(theta0) * Math.Sin(epsilon0));
    double f_theta = fTheta(A, b, d, d_theta, eps_theta, epsilon);
    double f_theta0 = fTheta(A, b, d, d_theta0, eps_theta0, epsilon0);
    double gammaM_theta = gamma(alpha, b, f, f_theta);
    double gammaM0_theta = gamma(alpha, b, f, f_theta0);

    double gammaV = phi - eta;
    if(theta > Math.PI / 2)
      gammaV = phi + eta;

// offest 0.08 radians
    GammaV = gammaV + 0.08;
    Alpha = alpha;
# ---------- c_script_7: C# additional code ----------
  double gamma(double alpha, double b, double f, double f_theta)
  {
    double up = 1 / Math.Sin(alpha) / Math.Cos(b / 2) * Math.Cos(f / 2) * f_theta;
    double down = 2 * Math.Pow(1 - Math.Pow(1 / Math.Sin(alpha) / Math.Cos(b / 2) * Math.Cos(f / 2) - 1 / Math.Tan(alpha) * Math.Tan(b / 2), 2), 0.5);
    return up / down;
  }

  double fTheta(double A, double b, double d, double d_theta, double eps_theta, double epsilon)
  {
    double f_theta = 1 / A * (Math.Cos(b / 2) * Math.Cos(b / 2) * Math.Sin(d) * d_theta - Math.Sin(b) * ( Math.Sin(d) * Math.Cos(epsilon) * eps_theta + Math.Sin(epsilon) * Math.Cos(d) * d_theta) - Math.Sin(b / 2) * Math.Sin(b / 2) * Math.Sin(epsilon) * (-2 * (1 + Math.Cos(d)) * Math.Cos(epsilon) * eps_theta + Math.Sin(epsilon) * Math.Sin(d) + d_theta));
    return f_theta;
  }
# ---------- end c_script_7 ----------

# ----
# side_fixed
boundary = BoundarySurfaces(Edges=flatten([line_3, line_4, move.Geometry, ln_5, ln_6, ln_8, ln_7, subcrv]))

X_4 = UnitX(Factor=expr("-x", c_script_6.remainX))

move_2 = Move(Geometry=ln_2, Motion=X_4)  # -> Geometry, Transform
move_3 = Move(Geometry=move.Geometry, Motion=X_4)  # -> Geometry, Transform
rotax = RotateAxis(Geometry=move_3.Geometry, Angle=c_script_5.curSideRotation, Axis=move_2.Geometry)  # -> Geometry, Transform
end_2 = EndPoints(Curve=rotax.Geometry)  # -> Start, End
pdecon_2 = Deconstruct(Point=end_2.Start)  # -> XComponent, YComponent, ZComponent

cyl = Cylinder(Base=ln_2, Radius=line_3, Length=move.Geometry)
yz = YZPlane(Origin=end_2.Start)
sec = BrepPlane(Brep=cyl, Plane=yz)  # -> Curves, Points
item = ListItem(List=sec.Curves, Index=1, Wrap=True)
end_3 = EndPoints(Curve=item)  # -> Start, End
pdecon_3 = Deconstruct(Point=end_3.Start)  # -> XComponent, YComponent, ZComponent

subtraction = Subtraction(A=pdecon_3.ZComponent, B=pdecon_2.ZComponent)
c_script_8 = CSharpScript(theta=c_script_5.curTheta, Z=pdecon_2.ZComponent)  # -> out, h; inputs theta: Double, Z: Double
# ---------- c_script_8: C# ----------
if(theta <Math.PI)
    h = -Z;
else
    h=Z;
# ---------- end c_script_8 ----------
num = Number(subtraction)

addition = Addition(A=c_script_5.curHeight, B=num)
Z = UnitZ(Factor=addition)
Z_2 = UnitZ(Factor=num)
move_4 = Move(Geometry=rotate.Geometry, Motion=X_4)  # -> Geometry, Transform
move_5 = Move(Geometry=rotate_2.Geometry, Motion=X_4)  # -> Geometry, Transform
move_6 = Move(Geometry=xy, Motion=Z)  # -> Geometry, Transform
move_7 = Move(Geometry=move_4.Geometry, Motion=Z_2)  # -> Geometry, Transform
move_8 = Move(Geometry=move_5.Geometry, Motion=Z_2)  # -> Geometry, Transform
ln_9 = Line(StartPoint=move_7.Geometry, EndPoint=move_6.Geometry)
move_9 = Move(Geometry=rotax.Geometry, Motion=Z_2)  # -> Geometry, Transform
ln_10 = Line(StartPoint=move_8.Geometry, EndPoint=move_6.Geometry)
# N
# b_fixed
c_script_9 = CSharpScript(N=N, b=b_in_radius)  # -> out, angle; inputs N: Int32, b: Double
# ---------- c_script_9: C# ----------
angle = (2* Math.PI - (2*N*b))/ (2*N);
# ---------- end c_script_9 ----------
gammav = Number(c_script_7.GammaV)
alpha = Number(c_script_7.Alpha)
ln_11 = Line(StartPoint=move_8.Geometry, EndPoint=move_7.Geometry)
rotate_3 = Rotate(Geometry=move_8.Geometry, Angle=c_script_9.angle, Plane=PlaneXY(0, 0, 0))  # -> Geometry, Transform
boundary_2 = BoundarySurfaces(Edges=flatten([ln_11, ln_9, ln_10]))
pl_3pt = Plane3Pt(PointA=move_6.Geometry, PointB=move_8.Geometry, PointC=rotate_3.Geometry)
xz = XZPlane(Origin=Point(0, 0, 0))
arc = Arc(Plane=pl_3pt, Radius=innerr_2, Angle=c_script_9.angle)  # -> Arc, Length
addition_2 = Addition(A=alpha, B=b_in_radius)
lnpt = LinePt(Line=item, Point=pt_2)
lnpt_2 = LinePt(Line=move.Geometry, Point=pt_2)
end_4 = EndPoints(Curve=arc.Arc)  # -> Start, End
rotate_4 = Rotate(Geometry=xz, Angle=addition_2, Plane=PlaneXY(0, 0, 0))  # -> Geometry, Transform

# ----
# side_folded
rulesrf = RuledSurface(CurveA=ln_11, CurveB=item)
orient = Orient(Geometry=boundary, Source=lnpt_2, Target=lnpt)  # -> Geometry, Transform

ln_12 = Line(StartPoint=move_6.Geometry, EndPoint=end_4.End)
rotax_2 = RotateAxis(Geometry=end_4.End, Angle=expr("-x", gammav), Axis=ln_10)  # -> Geometry, Transform
mirror = Mirror(Geometry=rotax_2.Geometry, Plane=rotate_4.Geometry)  # -> Geometry, Transform
rotax_3 = RotateAxis(Geometry=arc.Arc, Angle=expr("-x", gammav), Axis=ln_10)  # -> Geometry, Transform
rotax_4 = RotateAxis(Geometry=ln_12, Angle=expr("-x", gammav), Axis=ln_10)  # -> Geometry, Transform
vec2pt = Vector2Pt(PointA=move_6.Geometry, PointB=rotax_2.Geometry, Unitize=False)  # -> Vector, Length
vec2pt_2 = Vector2Pt(PointA=move_6.Geometry, PointB=mirror.Geometry, Unitize=False)  # -> Vector, Length
mirror_2 = Mirror(Geometry=rotax_4.Geometry, Plane=rotate_4.Geometry)  # -> Geometry, Transform
pl_3pt_2 = Plane3Pt(PointA=move_6.Geometry, PointB=rotax_2.Geometry, PointC=mirror.Geometry)
angle = Angle(VectorA=vec2pt.Vector, VectorB=vec2pt_2.Vector)  # -> Angle, Reflex
arc_2 = Arc(Plane=pl_3pt_2, Radius=innerr_2, Angle=angle.Angle)  # -> Arc, Length

boundary_3 = BoundarySurfaces(Edges=flatten([rotax_3.Geometry, rotax_4.Geometry, ln_10]))
boundary_4 = BoundarySurfaces(Edges=flatten([rotax_4.Geometry, arc_2.Arc, mirror_2.Geometry]))
mirror_3 = Mirror(Geometry=boundary_3, Plane=rotate_4.Geometry)  # -> Geometry, Transform

merge = Merge(Data1=rulesrf, Data2=orient.Geometry, Data3=boundary_2, Data4=boundary_3, Data5=mirror_3.Geometry, Data6=boundary_4)
arrpolar = PolarArray(Geometry=merge, Plane=PlaneXY(0, 0, 0), Count=N, Angle=6.283185307)  # -> flatten(Geometry), Transform
withinthreshold = ClusterOutput(c_script_3.KInRange)

# ----
# buttom surface
eval_3 = Evaluate(F="2*PI/N-b", N=N, b=division_2)
dom_2 = ConstructDomain(DomainStart=division_2, DomainEnd=eval_3)
arc_3 = Arc(Plane=PlaneXY(0, 0, 0), Radius=innerr_2, Angle=dom_2)  # -> Arc, Length
addition_3 = Addition(A=eval, B=outer_circle_offset)
merge_2 = Merge(Data1=arc_3.Arc, Data2=subcrv, Data3=ln_7, Data4=ln_8)  # -> flatten(Result)
cir_3 = Circle(Plane=PlaneXY(0, 0, 0), Radius=addition_3)

merge_3 = Merge(Data1=ln_6, Data2=ln_5, Data3=merge_2)

arrpolar_2 = PolarArray(Geometry=merge_3, Plane=PlaneXY(0, 0, 0), Count=N, Angle=6.283185307)  # -> Geometry, Transform
join = JoinCurves(Curves=flatten(arrpolar_2.Geometry), Preserve=False)

# ----
# cutting lines
merge_4 = Merge(Data1=merge_2, Data2=line_3, Data3=line_4)  # -> flatten(Result)
arrpolar_3 = PolarArray(Geometry=merge_4, Plane=PlaneXY(0, 0, 0), Count=N, Angle=6.283185307)  # -> Geometry, Transform
merge_5 = Merge(Data1=arrpolar_3.Geometry, Data2=cir_3)

boundary_5 = BoundarySurfaces(Edges=flatten([join, cir_3]))
merge_6 = Merge(Data1=boundary_5, Data2=arrpolar.Geometry)
cuts = ClusterOutput(merge_5)
_3d_geometry = ClusterOutput(merge_6)

# ----
# folding lines
merge_7 = Merge(Data1=ln_6, Data2=ln_5, Data3=move.Geometry, Data4=ln_2)
join_2 = JoinCurves(Curves=[ln_4, ln_3], Preserve=False)
arrpolar_4 = PolarArray(Geometry=join_2, Plane=PlaneXY(0, 0, 0), Count=expr("2*x", N), Angle=6.283185307)  # -> flatten(Geometry), Transform
dppi_2 = Number(dppi)
arrpolar_5 = PolarArray(Geometry=merge_7, Plane=PlaneXY(0, 0, 0), Count=N, Angle=6.283185307)  # -> flatten(Geometry), Transform
c_script_10 = CSharpScript(dpi=dppi_2)  # -> out, dash, gap; inputs dpi: Double; same code as c_script_13

dash = DashPattern(Curve=arrpolar_5.Geometry, Pattern=flatten([c_script_10.dash, c_script_10.gap]))  # -> Dashes, Gaps
dash_2 = DashPattern(Curve=arrpolar_4.Geometry, Pattern=flatten([c_script_10.dash, c_script_10.gap]))  # -> Dashes, Gaps

merge_8 = Merge(Data1=dash.Dashes, Data2=dash_2.Dashes)  # -> flatten(Result)

folds = ClusterOutput(merge_8)

# ==== cluster Cluster_3
res_buttom_offset = ClusterInput()
buttttom_offset = ClusterInput()
stiffness_coe = ClusterInput()
transition = ClusterInput()
max_force = ClusterInput()
res_arms = ClusterInput()
diameter = ClusterInput()
res_beta = ClusterInput()
res_dppi = ClusterInput()
diameter_2 = Number(diameter)

# ---- group: range of Dppi
min_dppi = Integer(50)
max_dppi = Integer(150)

# ---- group: constants
series = Series(Start=3, Step=1, Count=8)
theta0 = Number(70)
b = Number(10)
rad = Radians(Degrees=theta0)
rad_2 = Radians(Degrees=b)

# ----
innerr = Number(expr("x/2", diameter_2))
c_script = CSharpScript(N=series, theta0=rad, b=rad_2, r=innerr)  # -> out, Alpha, GammaV, Force, Theta; inputs N: Double, theta0: Double, b: Double, r: Double; same code as c_script
deg = Degrees(Radians=c_script.Theta)
panel = Panel(deg)

c_script_2 = CSharpScript(maxDppi=max_dppi, minDppi=min_dppi)  # -> out, maxK, minK; inputs maxDppi: Int32, minDppi: Int32; same code as c_script_2
force_max = Number(max_force)
division = Division(A=force_max, B=c_script.Force)
dom = ConstructDomain(DomainStart=c_script_2.minK, DomainEnd=c_script_2.maxK)
inc = Includes(Value=division, Domain=dom)  # -> Includes, Deviation
c_script_3 = CSharpScript(Ks=division, RangeDis=inc.Deviation, maxDppi=max_dppi, minDppi=min_dppi, stiffCoe=stiffness_coe)  # -> out, KInRange, N, Dppi; inputs Ks: list of Double, RangeDis: list of Double, maxDppi: Int32, minDppi: Int32, stiffCoe: Double
# ---------- c_script_3: C# ----------
int index = 0; // default index -> n=3
N = index + 3;
double K = Ks[index];
double minDis = 10000;

for (int i = 0;i < RangeDis.Count;i++) // start from minimum n
{
    if(RangeDis[i] < minDis){
        N = i+3;
        K = Ks[i];
        minDis = RangeDis[i]; //find the minimum proper force and N
    }
}

double ppi = Math.Round((K -8.776832)/-0.021978) * stiffCoe;

if (ppi< minDppi) //the lower boundary for ppi
    ppi = minDppi;
else if(ppi>maxDppi)
    ppi = maxDppi;


if (minDis == 0)
    //KInRange = "Within Measured Range";
    KInRange = 0;
else
    //KInRange = "Out of Measured Range";
    KInRange = 1;
Dppi =ppi;
# ---------- end c_script_3 ----------

diameter_3 = Number(diameter_2)
N = Number(c_script_3.N)
b_2 = Number(b)
dppi = Integer(c_script_3.Dppi)
innerr_2 = Number(expr("x/2", diameter_3))
rad_3 = Radians(Degrees=b_2)
cir = Circle(Plane=PlaneXY(0, 0, 0), Radius=innerr_2)
end = EndPoints(Curve=cir)  # -> Start, End
division_2 = Division(A=rad_3, B=2)

c_script_4 = CSharpScript(D=diameter_3)  # -> out, H; inputs D: Double; same code as c_script_4
X = Number(c_script_4.H)

rotate = Rotate(Geometry=end.Start, Angle=expr("-x", division_2), Plane=PlaneXY(0, 0, 0))  # -> Geometry, Transform
rotate_2 = Rotate(Geometry=end.Start, Angle=division_2, Plane=PlaneXY(0, 0, 0))  # -> Geometry, Transform
avr = Average(Input=[rotate_2.Geometry, rotate.Geometry])
pdecon = Deconstruct(Point=avr)  # -> XComponent, YComponent, ZComponent

eval = Evaluate(F="D/2*(19/15)", D=diameter_3)
cir_2 = Circle(Plane=PlaneXY(0, 0, 0), Radius=eval)

eval_2 = Evaluate(F="D*sin(b)*1.5", D=diameter_3, b=division_2)
pt = ConstructPoint(XCoordinate=pdecon.XComponent, YCoordinate=expr("-x", eval_2), ZCoordinate=pdecon.ZComponent)
pt_2 = ConstructPoint(XCoordinate=pdecon.XComponent, YCoordinate=eval_2, ZCoordinate=pdecon.ZComponent)
X_2 = UnitX(Factor=1)

ln = Line(StartPoint=pt, EndPoint=pt_2)
len = Length(Curve=ln)
line = LineSDL(Start=pt_2, Direction=X_2, Length=len)
line_2 = LineSDL(Start=pt, Direction=X_2, Length=len)
ccx = CurveCurve(CurveA=cir_2, CurveB=line_2)  # -> Points, ParamsA, ParamsB
seam = Seam(Curve=cir_2, Seam=ccx.ParamsA)
ccx_2 = CurveCurve(CurveA=seam, CurveB=line)  # -> Points, ParamsA, ParamsB

remap = RemapNumbers(Value=transition, Source=Domain(0, 2), Target=Domain(0, 1))  # -> Mapped, Clipped
ln_2 = Line(StartPoint=rotate_2.Geometry, EndPoint=rotate.Geometry)
X_3 = UnitX(Factor=X)
c_script_5 = CSharpScript(foldPer=remap.Mapped, D=diameter_3)  # -> out, curTheta, curHeight, curSideRotation; inputs foldPer: Double, D: Double; same code as c_script_5

ln_3 = Line(StartPoint=pt, EndPoint=rotate.Geometry)
ln_4 = Line(StartPoint=rotate_2.Geometry, EndPoint=pt_2)
subcrv = SubCurve(BaseCurve=seam, Domain=ccx_2.ParamsA)
ln_5 = Line(StartPoint=pt, EndPoint=ccx.Points)
ln_6 = Line(StartPoint=ccx_2.Points, EndPoint=pt_2)

move = Move(Geometry=ln_2, Motion=X_3)  # -> Geometry, Transform
line_3 = LineSDL(Start=rotate_2.Geometry, Direction=X_2, Length=X_3)
line_4 = LineSDL(Start=rotate.Geometry, Direction=X_2, Length=X_3)

multiplication = Multiplication(A=innerr_2, B=0.9333333333)
rad_4 = Radians(Degrees=res_beta)

boundary = BoundarySurfaces(Edges=flatten([line_3, line_4, move.Geometry, ln_3, ln_4, ln_6, ln_5, subcrv]))

c_script_6 = CSharpScript(D=diameter_3, theta=c_script_5.curTheta)  # -> out, foldR, remainX, foldH; inputs D: Double, theta: Double; same code as c_script_6
c_script_7 = CSharpScript(N=N, theta=c_script_5.curTheta, b=rad_3)  # -> out, Alpha, GammaV; inputs N: Double, theta: Double, b: Double; same code as c_script_7
diameter_4 = Number(multiplication)
alpha = Alpha(1.047197551)
c_script_8 = CSharpScript(D=diameter_4, Beta=rad_4, alpha=alpha)  # -> out, H; inputs D: Double, Beta: Double, alpha: Double
# ---------- c_script_8: C# ----------
//calculate the value of beta based on Height
//according to equation (1) in paper
H = (D * Math.Sin(alpha/2) * Math.Sin(Beta)) / (1- Math.Cos(Beta));
# ---------- end c_script_8 ----------
cir_3 = Circle(Plane=PlaneXY(0, 0, 0), Radius=expr("x/2", diameter_4))
offset = OffsetCurve(Curve=cir_3, Distance=res_buttom_offset, Plane=PlaneXY(0, 0, 0), Corners=1)
multiplication_2 = Multiplication(A=diameter_4, B=0.31)
X_4 = UnitX(Factor=expr("-x", c_script_6.remainX))

move_2 = Move(Geometry=ln_2, Motion=X_4)  # -> Geometry, Transform
move_3 = Move(Geometry=move.Geometry, Motion=X_4)  # -> Geometry, Transform
rotax = RotateAxis(Geometry=move_3.Geometry, Angle=c_script_5.curSideRotation, Axis=move_2.Geometry)  # -> Geometry, Transform
end_2 = EndPoints(Curve=rotax.Geometry)  # -> Start, End
pdecon_2 = Deconstruct(Point=end_2.Start)  # -> XComponent, YComponent, ZComponent

cyl = Cylinder(Base=ln_2, Radius=line_3, Length=move.Geometry)
yz = YZPlane(Origin=end_2.Start)
sec = BrepPlane(Brep=cyl, Plane=yz)  # -> Curves, Points
item = ListItem(List=sec.Curves, Index=1, Wrap=True)
end_3 = EndPoints(Curve=item)  # -> Start, End
pdecon_3 = Deconstruct(Point=end_3.Start)  # -> XComponent, YComponent, ZComponent

cir_4 = Circle(Plane=PlaneXY(0, 0, 0), Radius=multiplication_2)
c_script_9 = CSharpScript(D=diameter_4, alpha=alpha, beta=rad_4)  # -> out, pointA, pointD; inputs D: Double, alpha: Double, beta: Double; same code as c_script_10
rotate_3 = Rotate(Geometry=c_script_9.pointA, Angle=expr("2*pi/x", res_arms), Plane=PlaneXY(0, 0, 0))  # -> Geometry, Transform

subtraction = Subtraction(A=pdecon_3.ZComponent, B=pdecon_2.ZComponent)
c_script_10 = CSharpScript(theta=c_script_5.curTheta, Z=pdecon_2.ZComponent)  # -> out, h; inputs theta: Double, Z: Double; same code as c_script_8
num = Number(subtraction)

Y = UnitY(Factor=c_script_9.pointD)
addition = Addition(A=c_script_5.curHeight, B=num)

rotate_4 = Rotate(Geometry=rotate_3.Geometry, Angle=expr("-x", alpha), Plane=PlaneXY(0, 0, 0))  # -> Geometry, Transform
Z = UnitZ(Factor=c_script_8.H)
move_4 = Move(Geometry=rotate_4.Geometry, Motion=Z)  # -> Geometry, Transform

Z_2 = UnitZ(Factor=addition)
line_5 = LineSDL(Start=c_script_9.pointD, Direction=Y, Length=1)
Z_3 = UnitZ(Factor=num)
move_5 = Move(Geometry=rotate.Geometry, Motion=X_4)  # -> Geometry, Transform
move_6 = Move(Geometry=rotate_2.Geometry, Motion=X_4)  # -> Geometry, Transform
rotax_2 = RotateAxis(Geometry=rotate_3.Geometry, Angle=expr("-x", rad_4), Axis=line_5)  # -> Geometry, Transform

clx = CurveLine(Curve=cir_3, Line=line_5)  # -> Points, Params, Count
item_2 = ListItem(List=clx.Points, Index=1, Wrap=True)

alpha_2 = Number(c_script_7.Alpha)
move_7 = Move(Geometry=move_5.Geometry, Motion=Z_3)  # -> Geometry, Transform
move_8 = Move(Geometry=move_6.Geometry, Motion=Z_3)  # -> Geometry, Transform
move_9 = Move(Geometry=rotax.Geometry, Motion=Z_3)  # -> Geometry, Transform
gammav = Number(c_script_7.GammaV)
c_script_11 = CSharpScript(N=N, b=rad_3)  # -> out, angle; inputs N: Int32, b: Double; same code as c_script_9
avr_2 = Average(Input=[rotax_2.Geometry, move_4.Geometry])
ln_7 = Line(StartPoint=move_8.Geometry, EndPoint=move_7.Geometry)
subtraction_2 = Subtraction(A=rotax_2.Geometry, B=move_4.Geometry)
rotate_5 = Rotate(Geometry=move_8.Geometry, Angle=c_script_11.angle, Plane=PlaneXY(0, 0, 0))  # -> Geometry, Transform
lnpt = LinePt(Line=line_5, Point=rotax_2.Geometry)
pl = PlaneNormal(Origin=avr_2, ZAxis=subtraction_2)
xz = XZPlane(Origin=Point(0, 0, 0))
addition_2 = Addition(A=alpha_2, B=rad_3)
lnpt_2 = LinePt(Line=item, Point=pt_2)
lnpt_3 = LinePt(Line=move.Geometry, Point=pt_2)
ppx = PlanePlane(PlaneA=lnpt, PlaneB=pl)
rotate_6 = Rotate(Geometry=xz, Angle=addition_2, Plane=PlaneXY(0, 0, 0))  # -> Geometry, Transform

rulesrf = RuledSurface(CurveA=ln_7, CurveB=item)
orient = Orient(Geometry=boundary, Source=lnpt_3, Target=lnpt_2)  # -> Geometry, Transform

rotax_3 = RotateAxis(Geometry=ppx, Angle=rad_4, Axis=line_5)  # -> Geometry, Transform
vec = Vector(rotax_3.Geometry)
pt_3 = Point(c_script_9.pointA)

c_script_12 = CSharpScript(outerD=diameter_4, n=res_arms, vec_q=vec, pointA=pt_3, pointB=rotate_3.Geometry, pointE=item_2)  # -> out, AK, Qr, value_v, delta; inputs outerD: Double, n: Double, vec_q: Vector3d, pointA: Point3d, pointB: Point3d, pointE: Point3d; same code as c_script_11
panel_2 = Panel(c_script_12.value_v)
panel_3 = Panel(c_script_12.AK)
panel_4 = Panel(c_script_12.delta)

num_2 = Number(c_script_12.AK)
arrpolar = PolarArray(Geometry=pt_3, Plane=PlaneXY(0, 0, 0), Count=res_arms, Angle=6.283185307)  # -> Geometry, Transform
inner_r = Number(multiplication_2)
cyl_2 = Cylinder(Base=PlaneXY(0, 0, 0), Radius=inner_r, Length=innerr_2)
amp = Amplitude(Vector=rotax_3.Geometry, Amplitude=expr("-x", num_2))
num_3 = Number(res_arms)
pline = PolyLine(Vertices=arrpolar.Geometry, Closed=True)
move_10 = Move(Geometry=pt_3, Motion=amp)  # -> Geometry, Transform
ln_8 = Line(StartPoint=pt_3, EndPoint=move_10.Geometry)
arc = Arc3Pt(PointA=rotate_3.Geometry, PointB=move_10.Geometry, PointC=item_2)  # -> Arc, Plane, Radius
crv = Curve(arc.Arc)
line_6 = Line(ln_8)
arrpolar_2 = PolarArray(Geometry=arc.Arc, Plane=PlaneXY(0, 0, 0), Count=res_arms, Angle=6.283185307)  # -> Geometry, Transform
item_3 = ListItem(List=arrpolar_2.Geometry, Index=-1, Wrap=True)

line_7 = LineSDL(Start=item_2, Direction=line_5, Length=num_2)
clx_2 = CurveLine(Curve=item_3, Line=line_7)  # -> Points, Params, Count

# ----
# segment EF on line a
ln_9 = Line(StartPoint=item_2, EndPoint=clx_2.Points)

# ----
# sub curve BK
# sub curve KE
clx_3 = CurveLine(Curve=crv, Line=line_6)  # -> Points, Params, Count
dedomain = DeconstructDomain(Domain=crv)  # -> Start, End
dom_2 = ConstructDomain(DomainStart=clx_3.Params, DomainEnd=dedomain.End)
subcrv_2 = SubCurve(BaseCurve=crv, Domain=dom_2)
subcrv_3 = SubCurve(BaseCurve=crv, Domain=clx_3.Params)

# ----
# sub curve AF
clx_4 = CurveLine(Curve=item_3, Line=line_7)  # -> Points, Params, Count
dom_3 = ConstructDomain(DomainStart=clx_4.Params, DomainEnd=dedomain.End)
subcrv_4 = SubCurve(BaseCurve=item_3, Domain=dom_3)

arrpolar_3 = PolarArray(Geometry=[ln_8, ln_9], Plane=PlaneXY(0, 0, 0), Count=res_arms, Angle=6.283185307)  # -> flatten(Geometry), Transform

join = JoinCurves(Curves=[pline, arrpolar_3.Geometry], Preserve=False)  # -> flatten(Curves)
c_script_13 = CSharpScript(dpi=res_dppi)  # -> out, dash, gap; inputs dpi: Int32; same code as c_script_13
dash = DashPattern(Curve=join, Pattern=flatten([c_script_13.dash, c_script_13.gap]))  # -> Dashes, Gaps
merge = Merge(Data1=offset, Data2=arrpolar_2.Geometry)

# ----
# point E/F
end_4 = EndPoints(Curve=ln_9)  # -> Start, End

subcrv_5 = SubCurve(BaseCurve=item_3, Domain=clx_4.Params)

# ----
# rotation R
ln_10 = Line(StartPoint=pt_3, EndPoint=end_4.End)
len_2 = Length(Curve=ln_10)

ln_11 = Line(StartPoint=end_4.Start, EndPoint=move_10.Geometry)
pln = Plane(end_4.End)
len_3 = Length(Curve=ln_11)

# ----
# rotation sphere
sph = Sphere(Base=pln, Radius=len_2)

# ----
# offset cyl
cyl_3 = Cylinder(Base=PlaneXY(0, 0, 0), Radius=inner_r, Length=len_2)

ak = Number(num_2)
qr = Number(c_script_12.Qr)

# ----
# trace of A’
bbx = BrepBrep(BrepA=cyl_3, BrepB=sph)  # -> Curves, Points

# ----
# bottom surfaces
arrpolar_4 = PolarArray(Geometry=[subcrv_4, ln_9], Plane=PlaneXY(0, 0, 0), Count=num_3, Angle=6.283185307)  # -> Geometry, Transform
offset_circle = Circle(offset)
join_2 = JoinCurves(Curves=flatten(arrpolar_4.Geometry), Preserve=False)
boundary_2 = BoundarySurfaces(Edges=flatten([join_2, offset_circle]))

res_cuts = ClusterOutput(merge)
res_folds = ClusterOutput(dash.Dashes)
withinthreshold = ClusterOutput(c_script_3.KInRange)

eval_3 = Evaluate(F="2*PI/N-b", N=N, b=division_2)
dom_4 = ConstructDomain(DomainStart=division_2, DomainEnd=eval_3)
arc_2 = Arc(Plane=PlaneXY(0, 0, 0), Radius=innerr_2, Angle=dom_4)  # -> Arc, Length
addition_3 = Addition(A=eval, B=buttttom_offset)
merge_2 = Merge(Data1=arc_2.Arc, Data2=ln_5, Data3=ln_6, Data4=subcrv)  # -> flatten(Result)
cir_5 = Circle(Plane=PlaneXY(0, 0, 0), Radius=addition_3)

merge_3 = Merge(Data1=ln_4, Data2=ln_3, Data3=merge_2)

arrpolar_5 = PolarArray(Geometry=merge_3, Plane=PlaneXY(0, 0, 0), Count=N, Angle=6.283185307)  # -> Geometry, Transform
join_3 = JoinCurves(Curves=flatten(arrpolar_5.Geometry), Preserve=False)

boundary_3 = BoundarySurfaces(Edges=flatten([join_3, cir_5]))

xy = XYPlane(Origin=Point(0, 0, 0))
ln_12 = Line(StartPoint=rotate_2.Geometry, EndPoint=xy)
ln_13 = Line(StartPoint=rotate.Geometry, EndPoint=xy)

# ---- group: valleyFold
merge_4 = Merge(Data1=ln_13, Data2=ln_12)

# ----
boundary_4 = BoundarySurfaces(Edges=[merge_4, ln_2])

N_2 = Integer(N)
merge_5 = Merge(Data1=ln_13, Data2=ln_12)
arrpolar_6 = PolarArray(Geometry=merge_5, Plane=PlaneXY(0, 0, 0), Count=expr("2*x", N_2), Angle=6.283185307)  # -> Geometry, Transform
merge_6 = Merge(Data1=move.Geometry, Data2=ln_2, Data3=ln_4, Data4=ln_3)  # -> flatten(Result)
arrpolar_7 = PolarArray(Geometry=merge_6, Plane=PlaneXY(0, 0, 0), Count=N_2, Angle=6.283185307)  # -> Geometry, Transform
dppi_2 = Number(dppi)
join_4 = JoinCurves(Curves=[arrpolar_7.Geometry, arrpolar_6.Geometry], Preserve=False)
merge_7 = Merge(Data1=merge_2, Data2=cir_5, Data3=line_3, Data4=line_4)
c_script_14 = CSharpScript(dpi=dppi_2)  # -> out, dash, gap; inputs dpi: Int32; same code as c_script_13
dash_2 = DashPattern(Curve=join_4, Pattern=flatten([c_script_14.dash, c_script_14.gap]))  # -> Dashes, Gaps
arrpolar_8 = PolarArray(Geometry=merge_7, Plane=PlaneXY(0, 0, 0), Count=N_2, Angle=6.283185307)  # -> Geometry, Transform
merge_8 = Merge(Data1=arrpolar_8.Geometry, Data2=dash_2.Dashes)

move_11 = Move(Geometry=xy, Motion=Z_2)  # -> Geometry, Transform
ln_14 = Line(StartPoint=move_7.Geometry, EndPoint=move_11.Geometry)
ln_15 = Line(StartPoint=move_8.Geometry, EndPoint=move_11.Geometry)
boundary_5 = BoundarySurfaces(Edges=flatten([ln_7, ln_14, ln_15]))
bbx_2 = BrepBrep(BrepA=boundary_5, BrepB=cyl_2)  # -> Curves, Points
end_5 = EndPoints(Curve=bbx_2.Curves)  # -> Start, End
devec = DeconstructVector(Vector=end_5.Start)  # -> XComponent, YComponent, ZComponent
pl_3pt = Plane3Pt(PointA=move_11.Geometry, PointB=move_8.Geometry, PointC=rotate_5.Geometry)
c_script_15 = CSharpScript(D=diameter_4, H=devec.ZComponent, AK=c_script_12.AK, iniH=c_script_8.H, iniBeta=rad_4, alpha=alpha)  # -> out, curBeta; inputs D: Double, H: Double, AK: Double, iniH: Double, iniBeta: Double, alpha: Double
# ---------- c_script_15: C# ----------
//calculate the value of beta based on Height
//according to equation (1) in paper

double beta = 2 * Math.Atan(D*0.62 * 0.5 / H);

if (beta < iniBeta){
    beta = iniBeta;
}else if (beta > Math.PI){
    beta = Math.PI;
}

double foldPer = beta/Math.PI;
double offset = AK*Math.Sin(Math.PI*foldPer)*Math.Cos(-alpha/2);


/*
double b = Math.PI*foldPer;
double a = alpha*foldPer;

double phi = Math.Atan(Math.Sin(a)/Math.Tan(Math.PI/2- b));
double offset = AK*Math.Sin(phi);
*/

if (offset<0)
    offset =0;
H = H - offset;

if(H < 0){
    H=0;
}
//new beta
beta = 2 * Math.Atan(D*0.62 * 0.5 / H);

if (beta < iniBeta){
    curBeta = iniBeta;
}else{
    curBeta = beta;
}
# ---------- end c_script_15 ----------
arc_3 = Arc(Plane=pl_3pt, Radius=innerr_2, Angle=c_script_11.angle)  # -> Arc, Length
end_6 = EndPoints(Curve=arc_3.Arc)  # -> Start, End
ln_16 = Line(StartPoint=move_11.Geometry, EndPoint=end_6.End)
rotax_4 = RotateAxis(Geometry=end_6.End, Angle=expr("-x", gammav), Axis=ln_15)  # -> Geometry, Transform
mirror = Mirror(Geometry=rotax_4.Geometry, Plane=rotate_6.Geometry)  # -> Geometry, Transform
rotax_5 = RotateAxis(Geometry=arc_3.Arc, Angle=expr("-x", gammav), Axis=ln_15)  # -> Geometry, Transform
rotax_6 = RotateAxis(Geometry=ln_16, Angle=expr("-x", gammav), Axis=ln_15)  # -> Geometry, Transform
vec2pt = Vector2Pt(PointA=move_11.Geometry, PointB=rotax_4.Geometry, Unitize=False)  # -> Vector, Length
vec2pt_2 = Vector2Pt(PointA=move_11.Geometry, PointB=mirror.Geometry, Unitize=False)  # -> Vector, Length
mirror_2 = Mirror(Geometry=rotax_6.Geometry, Plane=rotate_6.Geometry)  # -> Geometry, Transform
pl_3pt_2 = Plane3Pt(PointA=move_11.Geometry, PointB=rotax_4.Geometry, PointC=mirror.Geometry)
angle = Angle(VectorA=vec2pt.Vector, VectorB=vec2pt_2.Vector)  # -> Angle, Reflex
arc_4 = Arc(Plane=pl_3pt_2, Radius=innerr_2, Angle=angle.Angle)  # -> Arc, Length

boundary_6 = BoundarySurfaces(Edges=flatten([rotax_5.Geometry, rotax_6.Geometry, ln_15]))
boundary_7 = BoundarySurfaces(Edges=flatten([rotax_6.Geometry, arc_4.Arc, mirror_2.Geometry]))
mirror_3 = Mirror(Geometry=boundary_6, Plane=rotate_6.Geometry)  # -> Geometry, Transform

merge_9 = Merge(Data1=rulesrf, Data2=orient.Geometry, Data3=boundary_5, Data4=boundary_6, Data5=mirror_3.Geometry, Data6=boundary_7)
arrpolar_9 = PolarArray(Geometry=merge_9, Plane=PlaneXY(0, 0, 0), Count=N, Angle=6.283185307)  # -> Geometry, Transform
merge_10 = Merge(Data1=boundary_3, Data2=arrpolar_9.Geometry)
num_4 = Number(c_script_15.curBeta)

# ----
# rotation plane
rot3d = Rotate3D(Geometry=pln, Angle=expr("-x", num_4), Center=end_4.End, Axis=ln_9)  # -> Geometry, Transform

# ----
# rotation arc
arc_5 = Arc(Plane=rot3d.Geometry, Radius=len_2, Angle=Domain(0, 1.570796327))  # -> Arc, Length

# ----
# point A’
ccx_3 = CurveCurve(CurveA=bbx.Curves, CurveB=arc_5.Arc)  # -> Points, ParamsA, ParamsB

pl_3pt_3 = Plane3Pt(PointA=end_4.Start, PointB=end_4.End, PointC=ccx_3.Points)
arrpolar_10 = PolarArray(Geometry=ccx_3.Points, Plane=PlaneXY(0, 0, 0), Count=num_3, Angle=6.283185307)  # -> Geometry, Transform
arc_6 = Arc(Plane=pl_3pt_3, Radius=len_3, Angle=Domain(0, 3.141592654))  # -> Arc, Length
pln_2 = Plane(ccx_3.Points)

# ----
# point B’’
item_4 = ListItem(List=arrpolar_10.Geometry, Index=1, Wrap=True)

sph_2 = Sphere(Base=pln_2, Radius=ak)

# ----
# point K’
bcx = BrepCurve(Brep=sph_2, Curve=arc_6.Arc)  # -> Curves, Points
item_5 = ListItem(List=bcx.Points, Index=1, Wrap=True)

# ----
# upper arm
# reset the control points of arc BK
pl_3pt_4 = Plane3Pt(PointA=item_5, PointB=item_4, PointC=ccx_3.Points)
pl_3pt_5 = Plane3Pt(PointA=item_4, PointB=ccx_3.Points, PointC=item_5)
arc_7 = Arc(Plane=pl_3pt_4, Radius=qr, Angle=Domain(0, 1.570796327))  # -> Arc, Length
arc_8 = Arc(Plane=pl_3pt_5, Radius=qr, Angle=Domain(-1.570796327, 0))  # -> Arc, Length
ccx_4 = CurveCurve(CurveA=arc_8.Arc, CurveB=arc_7.Arc)  # -> Points, ParamsA, ParamsB
pl_3pt_6 = Plane3Pt(PointA=ccx_4.Points, PointB=item_4, PointC=ccx_3.Points)
ln_17 = Line(StartPoint=item_4, EndPoint=item_5)
ln_18 = Line(StartPoint=item_4, EndPoint=ccx_3.Points)
arc_9 = Arc(Plane=pl_3pt_6, Radius=qr, Angle=Domain(0, 6.283185307))  # -> Arc, Length
clx_5 = CurveLine(Curve=arc_9.Arc, Line=ln_17)  # -> Points, Params, Count
item_6 = ListItem(List=clx_5.Params, Index=0, Wrap=True)
item_7 = ListItem(List=clx_5.Params, Index=1, Wrap=True)
dom_5 = ConstructDomain(DomainStart=item_6, DomainEnd=item_7)
subcrv_6 = SubCurve(BaseCurve=arc_9.Arc, Domain=dom_5)
rulesrf_2 = RuledSurface(CurveA=subcrv_6, CurveB=ln_18)

pdecon_4 = Deconstruct(Point=item_5)  # -> XComponent, YComponent, ZComponent; disabled

pl_3pt_7 = Plane3Pt(PointA=end_4.End, PointB=pt_3, PointC=move_10.Geometry)
pl_3pt_8 = Plane3Pt(PointA=end_4.End, PointB=ccx_3.Points, PointC=item_5)
pl_3pt_9 = Plane3Pt(PointA=end_4.Start, PointB=move_10.Geometry, PointC=pt_3)
pl_3pt_10 = Plane3Pt(PointA=end_4.Start, PointB=item_5, PointC=ccx_3.Points)

c_script_16 = CSharpScript(x=pdecon_4.XComponent, y=pdecon_4.YComponent)  # -> out, A; inputs x: Double, y: Double; disabled
# ---------- c_script_16: C# ----------
A = Math.Sqrt(x*x + y*y);
# ---------- end c_script_16 ----------

# ----
# Rotate_arc AF
orient_2 = Orient(Geometry=subcrv_5, Source=pl_3pt_7, Target=pl_3pt_8)  # -> Geometry, Transform

# ----
# F/A/K
# lower arm
# F/A/K’
# Rotate_arc KE
orient_3 = Orient(Geometry=subcrv_2, Source=pl_3pt_9, Target=pl_3pt_10)  # -> Geometry, Transform
arc_10 = CircularArc(orient_3.Geometry)
arc_11 = CircularArc(orient_2.Geometry)
rulesrf_3 = RuledSurface(CurveA=arc_11, CurveB=arc_10)

cyl_4 = Cylinder(Base=PlaneXY(0, 0, 0), Radius=c_script_16.A, Length=1)  # disabled

# ----
# arms
brep = Brep([rulesrf_2, rulesrf_3])
arrpolar_11 = PolarArray(Geometry=brep, Plane=PlaneXY(0, 0, 0), Count=num_3, Angle=6.283185307)  # -> Geometry, Transform

# ----
# central polygon
pline_2 = PolyLine(Vertices=arrpolar_10.Geometry, Closed=True)
boundary_8 = BoundarySurfaces(Edges=pline_2)

merge_11 = Merge(Data1=arrpolar_11.Geometry, Data2=boundary_8, Data3=boundary_2)
sfwb_3d = ClusterOutput(merge_10)
res_3d = ClusterOutput(merge_11)
sfwb_cuts = ClusterOutput(arrpolar_8.Geometry)
sfwb_folds = ClusterOutput(dash_2.Dashes)

# ==== cluster Cluster_4
max_force = ClusterInput()
transition = ClusterInput()
diameter = ClusterInput()
stiffness = ClusterInput()
units = ClusterInput()
material_stiffiness = Number(stiffness)

series = Series(Start=30, Step=0.5, Count=41)
c_script = CSharpScript(F=max_force, D=diameter, material=material_stiffiness, Alpha=series)  # -> out, AlphaInRange, alpha, delta; inputs F: Double, D: Double, material: Double, Alpha: list of Double
# ---------- c_script: C# ----------
double press_force = -F;
double properA= 0;
double F_delta = F;

for(int i=0; i< Alpha.Count; i++){
    double a = Alpha[i];
    double force =material*D*D* (
            -0.1517*Math.Pow((a-30),3) +
            0.1410*Math.Pow((a-30),2) +
            0.4294*(a-30)*Math.Pow(10, -5));
    double d = Math.Abs(force-press_force);
    if(F_delta > d){
        F_delta = d;
        properA = a;
    }

}

if (F_delta < 1)
    //AlphaInRange = "Within Measured Range";
    AlphaInRange = 0;
else
    //AlphaInRange = "Out of Measured Range";
    AlphaInRange = 1;

alpha = properA;
delta = F_delta;


/*
double kppi = F/(D*D*(
    -0.1517*Math.Pow((Alpha-30),3) +
    0.1410*Math.Pow((Alpha-30),2) +
    0.4294*(Alpha-30)*Math.Pow(10, -5)));
Kppi = kppi; */

//F(n=6) =material*diameter^2 * ( −0.1517(α − 30◦)^3 + 0.1410(α − 30◦)^2 + 0.4294(α − 30◦) × 10^−5 )
# ---------- end c_script ----------

diameter_2 = Number(diameter)
alpha = Number(c_script.alpha)
rad = Radians(Degrees=alpha)

# ----
# n=6: |edge of polygon| =R
division = Division(A=diameter_2, B=2)

N = Number(6)
subtraction = Subtraction(A="1", B=transition)

# ----
# calculate H
c_script_2 = CSharpScript(alpha=alpha, Lc=division)  # -> out, Hc; inputs alpha: Double, Lc: Double
# ---------- c_script_2: C# ----------
double H_cunit = Lc* Math.Sqrt( 2*Math.Sqrt(3)* Math.Sin((2*alpha- 60)/180*Math.PI));
Hc = H_cunit;
# ---------- end c_script_2 ----------

# ----
# calculate current height
multiplication = Multiplication(A=c_script_2.Hc, B=subtraction)

pt = ConstructPoint(XCoordinate=division, YCoordinate=0, ZCoordinate=0)
xy = XYPlane(Origin=Point(0, 0, 0))

# ----
# length a&b
c_script_3 = CSharpScript(R=division, n=N, alpha=rad)  # -> out, A, B; inputs R: Double, n: Int32, alpha: Double
# ---------- c_script_3: C# ----------
//according to paper : a crawling robot driven by multi stable origami
/*
double theta = Math.PI * (n-2)/(2*n);
double lambda = alpha/theta;
double a = 2*R*(Math.PI/n);

double l = 2*R*Math.Cos(theta*(1-lambda));

double b = Math.Sqrt(l*l + a*a - 2*a*l*Math.Cos(alpha));

B =l;
//A = b;
*/
// default: n equals to 6
A= R/Math.Sin(Math.PI/6) * Math.Sin(alpha);
# ---------- end c_script_3 ----------

polygon = Polygon(Plane=PlaneXY(0, 0, 0), Radius=division, Segments=6, FilletRadius=0)  # -> Polygon, Length
pl_offset = PlaneOffset(BasePlane=xy, Offset=multiplication)
pcen = PolygonCenter(Polyline=polygon.Polygon)  # -> CenterV, CenterE, CenterA
arc = Arc(Plane=pl_offset, Radius=division, Angle=Domain(0, 3.141592654))  # -> Arc, Length
Z = UnitZ(Factor=multiplication)
sph = Sphere(Base=pt, Radius=c_script_3.A)
move = Move(Geometry=pcen.CenterA, Motion=Z)  # -> Geometry, Transform
scx = SurfaceCurve(Surface=sph, Curve=arc.Arc)  # -> Curves, Points, UVPoints, Normals, Parameters, Tangents
arrpolar = PolarArray(Geometry=pt, Plane=PlaneXY(0, 0, 0), Count=N, Angle=6.283185307)  # -> Geometry, Transform
arrpolar_2 = PolarArray(Geometry=scx.Points, Plane=PlaneXY(0, 0, 0), Count=N, Angle=6.283185307)  # -> Geometry, Transform
vec2pt = Vector2Pt(PointA=pcen.CenterA, PointB=pt, Unitize=False)  # -> Vector, Length
vec2pt_2 = Vector2Pt(PointA=move.Geometry, PointB=scx.Points, Unitize=False)  # -> Vector, Length

# ----
# line a with angle beta
addition = Addition(A=0.5235987756, B=rad)
tan = Tangent(Value=addition)
pt_2 = ConstructPoint(XCoordinate=1, YCoordinate=tan, ZCoordinate=0)

item = ListItem(List=arrpolar_2.Geometry, Index=1, Wrap=True)
angle = Angle(VectorA=vec2pt.Vector, VectorB=vec2pt_2.Vector, Plane=xy)  # -> Angle, Reflex
item_2 = ListItem(List=arrpolar.Geometry, Index=1, Wrap=True)
item_3 = ListItem(List=arrpolar.Geometry, Index=2, Wrap=True)
item_4 = ListItem(List=arrpolar.Geometry, Index=3, Wrap=True)

ln = Line(StartPoint=item_2, EndPoint=item)
ln_2 = Line(StartPoint=item_2, EndPoint=pt)

ln_3 = Line(StartPoint=pt, EndPoint=item)
ln_4 = Line(StartPoint=scx.Points, EndPoint=item)
ln_5 = Line(StartPoint=pt, EndPoint=scx.Points)

# ----
# one-side surface
boundary = BoundarySurfaces(Edges=flatten([ln, ln_2, ln_3]))
boundary_2 = BoundarySurfaces(Edges=flatten([ln_4, ln_3, ln_5]))

# ----
# Buttom surface
boundary_3 = BoundarySurfaces(Edges=polygon.Polygon)

shift = ShiftList(List=arrpolar.Geometry, Shift=2, Wrap=True)
multiplication_2 = Multiplication(A=units, B=c_script_3.A)
multiplication_3 = Multiplication(A=N, B=pt)
amp = Amplitude(Vector=pt_2, Amplitude=multiplication_2)
pline = PolyLine(Vertices=shift, Closed=False)
line = LineSDL(Start=item_3, Direction=pt_2, Length=multiplication_2)
move_2 = Move(Geometry=pline, Motion=amp)  # -> Geometry, Transform
move_3 = Move(Geometry=line, Motion=multiplication_3)  # -> Geometry, Transform
end = EndPoints(Curve=line)  # -> Start, End
end_2 = EndPoints(Curve=move_3.Geometry)  # -> Start, End
xz = XZPlane(Origin=end.End)
ln_6 = Line(StartPoint=item_2, EndPoint=end_2.Start)
mirror = Mirror(Geometry=move_2.Geometry, Plane=xz)  # -> Geometry, Transform
end_3 = EndPoints(Curve=mirror.Geometry)  # -> Start, End
ln_7 = Line(StartPoint=end_2.End, EndPoint=end_3.End)

arrpolar_3 = PolarArray(Geometry=[boundary, boundary_2], Plane=PlaneXY(0, 0, 0), Count=N, Angle=6.283185307)  # -> flatten(Geometry), Transform

# ----
# Top surface
multiplication_4 = Multiplication(A=multiplication, B=units)
amp_2 = Amplitude(Vector=Z, Amplitude=multiplication_4)
move_4 = Move(Geometry=boundary_3, Motion=amp_2)  # -> Geometry, Transform
multiplication_5 = Multiplication(A=angle.Angle, B=units)
rotate = Rotate(Geometry=move_4.Geometry, Angle=multiplication_5, Plane=xy)  # -> Geometry, Transform

arrlinear = LinearArray(Geometry=arrpolar_3.Geometry, Direction=Z, UnitsNum=units)  # -> Geometry, Transform
series_2 = Series(Start="0", Step=angle.Angle, Count=units)
rotate_2 = Rotate(Geometry=arrlinear.Geometry, Angle=series_2, Plane=xy)  # -> Geometry, Transform
merge = Merge(Data1=rotate.Geometry, Data2=boundary_3)
cir = Circle(Plane=PlaneXY(0, 0, 0), Radius=expr("x/3", division))
_3d_sides = ClusterOutput(rotate_2.Geometry)
_3d_top_buttom = ClusterOutput(merge)
withinthreshold = ClusterOutput(c_script.AlphaInRange)

amp_3 = Amplitude(Vector=expr("-x", pt), Amplitude=expr("x/2", division))
amp_4 = Amplitude(Vector=pt_2, Amplitude=expr("x/9*8", c_script_3.A))
move_5 = Move(Geometry=item_3, Motion=amp_4)  # -> Geometry, Transform
move_6 = Move(Geometry=line, Motion=amp_3)  # -> Geometry, Transform
end_4 = EndPoints(Curve=move_6.Geometry)  # -> Start, End
ln_8 = Line(StartPoint=end_4.Start, EndPoint=item_3)

amp_5 = Amplitude(Vector=pt_2, Amplitude=c_script_3.A)
move_7 = Move(Geometry=item_2, Motion=amp_5)  # -> Geometry, Transform
ln_9 = Line(StartPoint=move_7.Geometry, EndPoint=item_3)
ln_10 = Line(StartPoint=end_2.Start, EndPoint=item_3)
arrlinear_2 = LinearArray(Geometry=ln_9, Direction=pt, Count=N)  # -> Geometry, Transform
arrlinear_3 = LinearArray(Geometry=line, Direction=pt, Count=N)  # -> Geometry, Transform
ln_11 = Line(StartPoint=end_3.Start, EndPoint=end_3.End)
arrlinear_4 = LinearArray(Geometry=ln_10, Direction=amp_5, Count=units)  # -> Geometry, Transform
ln_12 = Line(StartPoint=item_3, EndPoint=move_5.Geometry)
shift_2 = ShiftList(List=arrlinear_3.Geometry, Shift=1, Wrap=False)
shift_3 = ShiftList(List=arrlinear_4.Geometry, Shift=1, Wrap=False)
ln_13 = Line(StartPoint=item_3, EndPoint=item_2)
arrlinear_5 = LinearArray(Geometry=[arrlinear_2.Geometry, ln_12], Direction=amp_5, Count=units)  # -> Geometry, Transform

move_8 = Move(Geometry=item_3, Motion=amp_5)  # -> Geometry, Transform
vec2pt_3 = Vector2Pt(PointA=move_7.Geometry, PointB=move_5.Geometry, Unitize=False)  # -> Vector, Length
move_9 = Move(Geometry=ln_9, Motion=vec2pt_3.Vector)  # -> Geometry, Transform
ccx = CurveCurve(CurveA=move_6.Geometry, CurveB=move_9.Geometry)  # -> Points, ParamsA, ParamsB
ln_14 = Line(StartPoint=move_8.Geometry, EndPoint=move_5.Geometry)
ln_15 = Line(StartPoint=move_5.Geometry, EndPoint=ccx.Points)
ln_16 = Line(StartPoint=ccx.Points, EndPoint=end_4.Start)
join = JoinCurves(Curves=[ln_8, ln_15, ln_16, ln_14], Preserve=False)
arrlinear_6 = LinearArray(Geometry=join, Direction=amp_5, Count=units)  # -> Geometry, Transform

# ----
# taping part around polygon
ln_17 = Line(StartPoint=move_8.Geometry, EndPoint=item_3)
pt_3 = Point(Point(-0.0004428691553, -0.0002498241449, 0))
ln_18 = Line(StartPoint=item_4, EndPoint=item_3)
division_2 = Division(A=division, B=c_script_3.A)
lnpt = LinePt(Line=ln_17, Point=pt_3)
lnpt_2 = LinePt(Line=ln_18, Point=pt_3)
orient = Orient(Geometry=join, Source=lnpt, Target=lnpt_2)  # -> Geometry, Transform
scale = Scale(Geometry=orient.Geometry, Center=item_4, Factor=expr("x/9*8", division_2))  # -> Geometry, Transform
cp = ControlPoints(Curve=scale.Geometry)  # -> flatten(Points), Weights, Knots
cset = CreateSet(List=cp.Points)  # -> Set, Map
item_5 = ListItem(List=cset.Set, Index=0, Wrap=True)
item_6 = ListItem(List=cset.Set, Index=3, Wrap=False)
ln_19 = Line(StartPoint=item_5, EndPoint=item_6)
vec2pt_4 = Vector2Pt(PointA=item_5, PointB=item_6, Unitize=False)  # -> Vector, Length
ccx_2 = CurveCurve(CurveA=ln_19, CurveB=ln_8)  # -> Points, ParamsA, ParamsB
len = Length(Curve=ln_19)
multiplication_6 = Multiplication(A=ccx_2.ParamsA, B=len)
amp_6 = Amplitude(Vector=vec2pt_4.Vector, Amplitude=expr("x*1.2", multiplication_6))
move_10 = Move(Geometry=item_6, Motion=amp_6)  # -> Geometry, Transform
move_11 = Move(Geometry=item_5, Motion=amp_6)  # -> Geometry, Transform
replace = ReplaceItems(List=cset.Set, Item=move_11.Geometry, Indices=0, Wrap=False)
replace_2 = ReplaceItems(List=replace, Item=move_10.Geometry, Indices=3, Wrap=False)
ins = InsertItems(List=replace_2, Item=item_3, Indices=0, Wrap=True)
item_7 = ListItem(List=ins, Index=[0, 2, 1, 4, 3, 5], Wrap=True)
pline_2 = PolyLine(Vertices=item_7, Closed=False)
arrpolar_4 = PolarArray(Geometry=pline_2, Plane=PlaneXY(0, 0, 0), Count=6, Angle=6.283185307)  # -> Geometry, Transform
shift_4 = ShiftList(List=arrpolar_4.Geometry, Shift=-1, Wrap=False)
move_12 = Move(Geometry=shift_4, Motion=amp)  # -> Geometry, Transform
mirror_2 = Mirror(Geometry=move_12.Geometry, Plane=xz)  # -> Geometry, Transform

# ----
# fold lines of polygon
item_8 = ListItem(List=ins, Index=2, Wrap=True)
item_9 = ListItem(List=ins, Index=3, Wrap=True)
ln_20 = Line(StartPoint=item_8, EndPoint=item_9)
arrpolar_5 = PolarArray(Geometry=ln_20, Plane=PlaneXY(0, 0, 0), Count=6, Angle=6.283185307)  # -> Geometry, Transform
shift_5 = ShiftList(List=arrpolar_5.Geometry, Shift=-1, Wrap=False)
move_13 = Move(Geometry=shift_5, Motion=amp)  # -> Geometry, Transform
mirror_3 = Mirror(Geometry=move_13.Geometry, Plane=xz)  # -> Geometry, Transform

# ----
# fold lines
merge_2 = Merge(
    Data1=shift_2,
    Data2=shift_3,
    Data3=arrlinear_5.Geometry,
    Data4=ln_11,
    Data5=ln_13,
    Data6=mirror_3.Geometry,
    Data7=shift_5)  # -> flatten(Result)

# ----
# cut lines
merge_3 = Merge(
    Data1=move_3.Geometry,
    Data2=ln_7,
    Data3=ln_6,
    Data4=arrlinear_6.Geometry,
    Data5=mirror_2.Geometry,
    Data6=shift_4,
    Data7=cir)  # -> flatten(Result)

cuts = ClusterOutput(merge_3)
folds = ClusterOutput(merge_2)
